# Grasshopper definition AI_copilot_to_AI_stablediffusion_001.gh (Grasshopper 1.0.7)
# plug-ins: Hops

number_slider = Slider(3.035, range=0..10)
# Intro to Hops for
# Grasshopper in VSC
# An Example Hops Node from VSC
# app.py
number_slider_2 = Slider(1, range=0..10)
# Subtract  Hops Node from VSC
# app.py
number_slider_3 = Slider(2.97, range=0..10)
number_slider_4 = Slider(7, range=0..10)
# Complex Number Point  Hops Node from VSC
# app.py
number_slider_5 = Slider(2.91, range=0..10)
# Instructions:
# 1. Drag and drop a hops node on the canvas.
# 2. Set path to:
# http://127.0.0.1:5000/complex
# 3. Name and toggle  component name to :
# complex
complex = Hops(
    Real=Slider(2, range=0..10),
    Imaginary=Slider(2, range=0..10),
    Z=number_slider,
    CacheResultsInMemory=False,
    CacheSolveResults=False,
    RemoteDefinitionLocation="http://127.0.0.1:5000/complex",
    RemoteSolveVersion=(0, 1, 0),
    ShowInput_Enabled=False,
    ShowInput_Path=False,
    SynchronousSolve=True)
# Instructions:
# 1. Drag and drop a hops node on the canvas.
# 2. Set path to:
# http://127.0.0.1:5000/binmult
# 3. Name and toggle  component name to :
# binmult
binmult = Hops(
    A=number_slider_2,
    B=number_slider_3,
    CacheResultsInMemory=False,
    CacheSolveResults=False,
    RemoteDefinitionLocation="http://127.0.0.1:5000/binmult",
    RemoteSolveVersion=(0, 1, 0),
    ShowInput_Enabled=False,
    ShowInput_Path=False,
    SynchronousSolve=True)
# Instructions:
# 1. Drag and drop a hops node on the canvas.
# 2. Set path to:
# http://127.0.0.1:5000/subtract
# 3. Name and toggle  component name to :
# subtract
subtract = Hops(
    A=number_slider_4,
    B=number_slider_5,
    CacheResultsInMemory=False,
    CacheSolveResults=False,
    RemoteDefinitionLocation="http://127.0.0.1:5000/subtract",
    RemoteSolveVersion=(0, 1, 0),
    ShowInput_Enabled=False,
    ShowInput_Path=False,
    SynchronousSolve=True)
panel = Panel(binmult)
construct_point = ConstructPoint(XCoordinate=number_slider_2, YCoordinate=0, ZCoordinate=0)
panel_2 = Panel(subtract)
construct_point_2 = ConstructPoint(XCoordinate=number_slider_4, YCoordinate=0, ZCoordinate=0)
panel_3 = Panel(complex)
circle = Circle(Plane=construct_point, Radius=panel)
circle_2 = Circle(Plane=panel_3, Radius=number_slider)
circle_3 = Circle(Plane=construct_point_2, Radius=subtract)
number_slider_6 = Slider(1, range=0.01..3)
# The Numpy ndarry:
# A N-Dimensional Array from
# Three Lists
# #print(arr.list_to_tree()) not working in grasshopper canvas
# # use entwine node in gh to convert lists to tree
# 
# return arr.tolist()[0], arr.tolist()[1], arr.tolist()[2]
gene_pool = GenePool(
    Decimals=1,
    Maximum=10,
    Minimum=0,
    Value=[0.7722049424, 1.030709841, 1.942153617, 2.344348825, 2.593688327, 4.959225961, 6.161245414, 9.073370702, 10])
# The Numpy ndarry:
# Scaling a  N-Dimensional Array from
# Three Lists
# #print(arr.list_to_tree()) not working in grasshopper canvas
# # use entwine node in gh to convert lists to tree
# 
# return arr.tolist()[0], arr.tolist()[1], arr.tolist()[2]
gene_pool_2 = GenePool(Decimals=1, Maximum=10, Minimum=0, Value=[0.6, 0.9257266209, 2.820610363, 3.8, 4.6, 5.3, 6, 6.8, 8.6])
# From AI copilot to AI Stable Diffusion
# at www.wickersonstudios.com
# Python for Data Manipulation and Mudging
# NumPy Basics
# The Numpy ndarry:
# A Multidimensional Array Object
# #print(arr.list_to_tree()) not working in grasshopper canvas
# # use entwine node in gh to convert lists to tree
# 
# return arr.tolist()[0], arr.tolist()[1], arr.tolist()[2]
gene_pool_3 = GenePool(Decimals=1, Maximum=10, Minimum=0, Value=[3.656586331, 0.8718082127, 6.253444602, 4.276803501, 7.639367952, 0.680677784])
# The Numpy ndarry:
# A Two-Dimensional Array from
# two Lists
# #print(arr.list_to_tree()) not working in grasshopper canvas
# # use entwine node in gh to convert lists to tree
# 
# return arr.tolist()[0], arr.tolist()[1], arr.tolist()[2]
gene_pool_4 = GenePool(Decimals=1, Maximum=10, Minimum=0, Value=[5.5, 10, 1.4, 5.4, 1.5, 10])
explode_tree = ExplodeTree(Data=graft(gene_pool))  # -> Branch0, Branch1, Branch2, Branch3, Branch4, Branch5, Branch6, Branch7, Branch8
explode_tree_2 = ExplodeTree(Data=graft(gene_pool_2))  # -> Branch0, Branch1, Branch2, Branch3, Branch4, Branch5, Branch6, Branch7, Branch8
explode_tree_3 = ExplodeTree(Data=graft(gene_pool_4))  # -> Branch0, Branch1, Branch2, Branch3, Branch4, Branch5
explode_tree_4 = ExplodeTree(Data=graft(gene_pool_3))  # -> Branch0, Branch1, Branch2, Branch3, Branch4, Branch5
panel_4 = Panel([explode_tree.Branch3, explode_tree.Branch4, explode_tree.Branch5])
panel_5 = Panel([explode_tree.Branch0, explode_tree.Branch1, explode_tree.Branch2])
panel_6 = Panel([explode_tree.Branch6, explode_tree.Branch7, explode_tree.Branch8])
panel_7 = Panel([explode_tree_2.Branch0, explode_tree_2.Branch1, explode_tree_2.Branch2])
panel_8 = Panel([explode_tree_2.Branch3, explode_tree_2.Branch4, explode_tree_2.Branch5])
panel_9 = Panel([explode_tree_2.Branch6, explode_tree_2.Branch7, explode_tree_2.Branch8])
panel_10 = Panel([explode_tree_3.Branch3, explode_tree_3.Branch4, explode_tree_3.Branch5])
panel_11 = Panel([explode_tree_3.Branch0, explode_tree_3.Branch1, explode_tree_3.Branch2])
panel_12 = Panel([explode_tree_4.Branch3, explode_tree_4.Branch4, explode_tree_4.Branch5])
panel_13 = Panel([explode_tree_4.Branch0, explode_tree_4.Branch1, explode_tree_4.Branch2])
# Instructions:
# 1. Drag and drop a hops node on the canvas.
# 2. Set path to:
# http://127.0.0.1:5000/numpy_3darray
# 3. Name and toggle  component name to :
# numpy_3darray
number = Number(flatten(panel_5))
number_2 = Number(flatten(panel_4))
number_3 = Number(flatten(panel_7))
number_4 = Number(flatten(panel_6))
number_5 = Number(flatten(panel_8))
number_6 = Number(flatten(panel_11))
number_7 = Number(flatten(panel_9))
number_8 = Number(flatten(panel_10))
number_9 = Number(flatten(panel_13))
number_10 = Number(flatten(panel_12))
numpy_3darray = Hops(
    List1=number,
    List2=number_2,
    List3=number_4,
    CacheResultsInMemory=True,
    CacheSolveResults=True,
    RemoteDefinitionLocation="http://127.0.0.1:5000/numpy_3darray",
    RemoteSolveVersion=(0, 1, 0),
    ShowInput_Enabled=False,
    ShowInput_Path=False,
    SynchronousSolve=True)  # -> Array1, Array2, Array3
# Instructions:
# 1. Drag and drop a hops node on the canvas.
# 2. Set path to:
# http://127.0.0.1:5000/numpy_2darray
# 3. Name and toggle  component name to :
# numpy_2darray
numpy_2darray = Hops(
    List1=number_6,
    List2=number_8,
    CacheResultsInMemory=False,
    CacheSolveResults=False,
    RemoteDefinitionLocation="http://127.0.0.1:5000/numpy_2darray",
    RemoteSolveVersion=(0, 1, 0),
    ShowInput_Enabled=False,
    ShowInput_Path=False,
    SynchronousSolve=True)  # -> Array1, Array2
# Instructions:
# 1. Drag and drop a hops node on the canvas.
# 2. Set path to:
# http://127.0.0.1:5000/numpy_scale
# 3. Name and toggle  component name to :
# numpy_scale
numpy_scale = Hops(
    Array1=number_3,
    Array2=number_5,
    Array3=number_7,
    Scale=number_slider_6,
    CacheResultsInMemory=False,
    CacheSolveResults=False,
    RemoteDefinitionLocation="http://127.0.0.1:5000/numpy_scale",
    RemoteSolveVersion=(0, 1, 0),
    ShowInput_Enabled=False,
    ShowInput_Path=False,
    SynchronousSolve=True)  # -> Array1, Array2, Array3
# Instructions:
# 1. Drag and drop a hops node on the canvas.
# 2. Set path to:
# http://127.0.0.1:5000/numpy_1darray_02
# 3. Name and toggle  component name to :
# numpy_1darray_02
numpy_1darray_02 = Hops(
    List=number_9,
    CacheResultsInMemory=False,
    CacheSolveResults=False,
    RemoteDefinitionLocation="http://127.0.0.1:5000/numpy_1darray_02",
    RemoteSolveVersion=(0, 1, 0),
    ShowInput_Enabled=False,
    ShowInput_Path=False,
    SynchronousSolve=True)
entwine = Entwine(Branch00=numpy_3darray.Array1, Branch01=numpy_3darray.Array2, Branch02=numpy_3darray.Array3, FlattenInputs=True)
entwine_2 = Entwine(Branch00=numpy_scale.Array1, Branch01=numpy_scale.Array2, Branch02=numpy_scale.Array3, FlattenInputs=True)
panel_14 = Panel(numpy_1darray_02)
entwine_3 = Entwine(Branch00=numpy_2darray.Array1, Branch01=numpy_2darray.Array2, FlattenInputs=True)
panel_15 = Panel(entwine_2)

# ----
# DATA VISUALIZATION
list_length = ListLength(List=number_5)
list_length_2 = ListLength(List=number_7)
list_length_3 = ListLength(List=number_3)
series = Series(Start=0, Step=entwine_2, Count=10)
construct_point_3 = ConstructPoint(XCoordinate=graft(panel_15), YCoordinate=panel_15, ZCoordinate=0)
unit_z = UnitZ(Factor=series)
move = Move(Geometry=construct_point_3, Motion=unit_z)  # -> Geometry, Transform
interpolate = Interpolate(Vertices=move.Geometry, Degree=3, Periodic=False, KnotStyle=1)  # -> Curve, Length, Domain
multiplication = Multiplication(A=Slider(100, range=0..100), B=number_slider_6)
negative = Negative(Value=multiplication)
loft = Loft(
    Curves=flatten(interpolate.Curve),
    Options={Adjust=False, Closed=False, LoftEnds=0, LoftSimp=0, LoftType=0, Rebuild=10, Refit=0.01})
construct_domain = ConstructDomain(DomainStart=negative, DomainEnd=multiplication)
deconstruct_brep = DeconstructBrep(Brep=loft)  # -> Faces, Edges, Vertices
xz_plane = XZPlane(Origin=Point(0, 0, 0))
rectangle = Rectangle(Plane=xz_plane, XSize=construct_domain, YSize=construct_domain, Radius=0)  # -> Rectangle, Length
unit_y = UnitY(Factor=1)
boundary_surfaces = BoundarySurfaces(Edges=rectangle.Rectangle)
project = Project(Curve=deconstruct_brep.Edges, Brep=boundary_surfaces, Direction=unit_y)
boundary_surfaces_2 = BoundarySurfaces(Edges=flatten(project))
list_item = ListItem(List=flatten(project), Index=0, Wrap=True)  # -> Item, Item1, Item2, Item3
list_item_2 = ListItem(List=deconstruct_brep.Edges, Index=0, Wrap=True)  # -> Item, Item1, Item2
curve = Curve(list_item_2.Item)
curve_2 = Curve(list_item_2.Item1)
curve_3 = Curve(list_item_2.Item2)
curve_4 = Curve(list_item.Item)
curve_5 = Curve(list_item.Item1)
curve_6 = Curve(list_item.Item2)
loft_2 = Loft(
    Curves=flatten([curve, curve_4]),
    Options={Adjust=True, Closed=False, LoftEnds=0, LoftSimp=0, LoftType=0, Rebuild=10, Refit=0.01})
loft_3 = Loft(
    Curves=flatten([curve_2, curve_5]),
    Options={Adjust=True, Closed=False, LoftEnds=0, LoftSimp=0, LoftType=0, Rebuild=10, Refit=0.01})
loft_4 = Loft(
    Curves=flatten([curve_3, curve_6]),
    Options={Adjust=True, Closed=False, LoftEnds=0, LoftSimp=0, LoftType=0, Rebuild=10, Refit=0.01})
surface = Surface(boundary_surfaces_2)
surface_2 = Surface(loft)
merge = Merge(Data1=surface_2, Data2=loft_2, Data3=loft_3, Data4=loft_4, Data5=surface)
brep_join = BrepJoin(Breps=merge)  # -> Breps, Closed

panel_16 = Panel(entwine)

# ----
# DATA VISUALIZATION
list_length_4 = ListLength(List=numpy_3darray.Array2)
list_length_5 = ListLength(List=numpy_3darray.Array3)
list_length_6 = ListLength(List=numpy_3darray.Array1)
series_2 = Series(Start=0, Step=entwine, Count=10)
construct_point_4 = ConstructPoint(XCoordinate=graft(panel_16), YCoordinate=panel_16, ZCoordinate=0)
unit_z_2 = UnitZ(Factor=series_2)
move_2 = Move(Geometry=construct_point_4, Motion=unit_z_2)  # -> Geometry, Transform
number_slider_7 = Slider(100, range=0..100)
interpolate_2 = Interpolate(Vertices=move_2.Geometry, Degree=3, Periodic=False, KnotStyle=1)  # -> Curve, Length, Domain
negative_2 = Negative(Value=number_slider_7)
loft_5 = Loft(
    Curves=flatten(interpolate_2.Curve),
    Options={Adjust=False, Closed=False, LoftEnds=0, LoftSimp=0, LoftType=0, Rebuild=10, Refit=0.01})
construct_domain_2 = ConstructDomain(DomainStart=negative_2, DomainEnd=number_slider_7)
deconstruct_brep_2 = DeconstructBrep(Brep=loft_5)  # -> Faces, Edges, Vertices
xz_plane_2 = XZPlane(Origin=Point(0, 0, 0))
rectangle_2 = Rectangle(Plane=xz_plane_2, XSize=construct_domain_2, YSize=construct_domain_2, Radius=0)  # -> Rectangle, Length
unit_y_2 = UnitY(Factor=1)
boundary_surfaces_3 = BoundarySurfaces(Edges=rectangle_2.Rectangle)
project_2 = Project(Curve=deconstruct_brep_2.Edges, Brep=boundary_surfaces_3, Direction=unit_y_2)
boundary_surfaces_4 = BoundarySurfaces(Edges=flatten(project_2))
list_item_3 = ListItem(List=flatten(project_2), Index=0, Wrap=True)  # -> Item, Item1, Item2, Item3
list_item_4 = ListItem(List=deconstruct_brep_2.Edges, Index=0, Wrap=True)  # -> Item, Item1, Item2
curve_7 = Curve(list_item_4.Item)
curve_8 = Curve(list_item_4.Item1)
curve_9 = Curve(list_item_4.Item2)
curve_10 = Curve(list_item_3.Item)
curve_11 = Curve(list_item_3.Item1)
curve_12 = Curve(list_item_3.Item2)
loft_6 = Loft(
    Curves=flatten([curve_7, curve_10]),
    Options={Adjust=True, Closed=False, LoftEnds=0, LoftSimp=0, LoftType=0, Rebuild=10, Refit=0.01})
loft_7 = Loft(
    Curves=flatten([curve_8, curve_11]),
    Options={Adjust=True, Closed=False, LoftEnds=0, LoftSimp=0, LoftType=0, Rebuild=10, Refit=0.01})
loft_8 = Loft(
    Curves=flatten([curve_9, curve_12]),
    Options={Adjust=True, Closed=False, LoftEnds=0, LoftSimp=0, LoftType=0, Rebuild=10, Refit=0.01})
surface_3 = Surface(boundary_surfaces_4)
surface_4 = Surface(loft_5)
merge_2 = Merge(Data1=surface_4, Data2=loft_6, Data3=loft_7, Data4=loft_8, Data5=surface_3)
brep_join_2 = BrepJoin(Breps=merge_2)  # -> Breps, Closed

panel_17 = Panel(entwine_3)
series_3 = Series(Start=0, Step=entwine_3, Count=10)
construct_point_5 = ConstructPoint(XCoordinate=graft(panel_16), YCoordinate=panel_16, ZCoordinate=0)
construct_point_6 = ConstructPoint(XCoordinate=graft(entwine_3), YCoordinate=number_10, ZCoordinate=0)
unit_z_3 = UnitZ(Factor=series_3)

# ----
# DATA VISUALIZATION WITH GRIDS
list_length_7 = ListLength(List=numpy_2darray.Array1)
list_length_8 = ListLength(List=numpy_2darray.Array2)
radial = Radial(Plane=PlaneXY(0, 0, 0), Size=entwine_3, ExtentR=list_length_7, ExtentP=list_length_8)  # -> Cells, Points
rectangular = Rectangular(
    Plane=PlaneXY(0, 0, 0),
    SizeX=numpy_2darray.Array1,
    SizeY=numpy_2darray.Array2,
    ExtentX=list_length_7,
    ExtentY=list_length_8)  # -> Cells, Points
hexagonal = Hexagonal(Plane=PlaneXY(0, 0, 0), Size=entwine_3, ExtentX=list_length_7, ExtentY=list_length_8)  # -> Cells, Points
stream_filter = StreamFilter(Gate=Slider(2, range=0..2), Stream0=rectangular.Cells, Stream1=radial.Cells, Stream2=hexagonal.Cells)
move_3 = Move(Geometry=stream_filter, Motion=unit_z_3)  # -> Geometry, Transform
boundary_surfaces_5 = BoundarySurfaces(Edges=move_3.Geometry)

circle_4 = Circle(Plane=construct_point_5, Radius=panel_16)
circle_5 = Circle(Plane=construct_point_6, Radius=panel_17)
gene_pool_5 = GenePool(
    Decimals=1,
    Maximum=10,
    Minimum=0,
    Value=[6.168646447, 9.26363583, 6.688439477, 2.593585934, 5.901433666, 2.814684216, 3.069412223, 6.855053787, 4.3])
# #print(arr.list_to_tree()) not working in grasshopper canvas
# # use entwine node in gh to convert lists to tree
# 
# return arr.tolist()[0], arr.tolist()[1], arr.tolist()[2]
gene_pool_6 = GenePool(
    Decimals=1,
    Maximum=10,
    Minimum=0,
    Value=[7.66625597, 1.254144405, 2.823211207, 1.3656091, 4.002491815, 5.903917745, 2.691353626, 6.345129356, 2.393110559])
# The Numpy ndarry:
# Add an Array to Itself
#  (Doubling) a N-Dimensional Array from
# Three Lists
# #print(arr.list_to_tree()) not working in grasshopper canvas
# # use entwine node in gh to convert lists to tree
# 
# return arr.tolist()[0], arr.tolist()[1], arr.tolist()[2]
gene_pool_7 = GenePool(Decimals=1, Maximum=10, Minimum=0, Value=[0.6, 0.9257266209, 2.820610363, 3.8, 4.6, 5.3, 6, 6.8, 7.6])
# The Numpy ndarray:
# Adding Two
#  N-Dimensional Arrays from
# Three Lists
number_slider_8 = Slider(1.01, range=0.01..3)
# The Numpy ndarry:
# Shape of a N-Dimensional Array
# #print(arr.list_to_tree()) not working in grasshopper canvas
# # use entwine node in gh to convert lists to tree
# 
# return arr.tolist()[0], arr.tolist()[1], arr.tolist()[2]
gene_pool_8 = GenePool(Decimals=1, Maximum=10, Minimum=0, Value=[0.6, 0.9257266209, 2.820610363, 3.8, 4.6, 5.3, 6, 6.8, 7.6])
# The Numpy ndarry:
# DataType of a N-Dimensional Array
number_slider_9 = Slider(1.01, range=0.01..3)
# #print(arr.list_to_tree()) not working in grasshopper canvas
# # use entwine node in gh to convert lists to tree
# 
# return arr.tolist()[0], arr.tolist()[1], arr.tolist()[2]
gene_pool_9 = GenePool(Decimals=1, Maximum=10, Minimum=0, Value=[0.6, 0.9257266209, 2.820610363, 3.8, 4.6, 5.3, 6, 6.8, 7.6])
number_slider_10 = Slider(1.01, range=0.01..3)
explode_tree_5 = ExplodeTree(Data=graft(gene_pool_6))  # -> Branch0, Branch1, Branch2, Branch3, Branch4, Branch5, Branch6, Branch7, Branch8
explode_tree_6 = ExplodeTree(Data=graft(gene_pool_5))  # -> Branch0, Branch1, Branch2, Branch3, Branch4, Branch5, Branch6, Branch7, Branch8
explode_tree_7 = ExplodeTree(Data=graft(gene_pool_7))  # -> Branch0, Branch1, Branch2, Branch3, Branch4, Branch5, Branch6, Branch7, Branch8
explode_tree_8 = ExplodeTree(Data=graft(gene_pool_8))  # -> Branch0, Branch1, Branch2, Branch3, Branch4, Branch5, Branch6, Branch7, Branch8
explode_tree_9 = ExplodeTree(Data=graft(gene_pool_9))  # -> Branch0, Branch1, Branch2, Branch3, Branch4, Branch5, Branch6, Branch7, Branch8
panel_18 = Panel([explode_tree_5.Branch0, explode_tree_5.Branch1, explode_tree_5.Branch2])
panel_19 = Panel([explode_tree_5.Branch3, explode_tree_5.Branch4, explode_tree_5.Branch5])
panel_20 = Panel([explode_tree_5.Branch6, explode_tree_5.Branch7, explode_tree_5.Branch8])
panel_21 = Panel([explode_tree_6.Branch0, explode_tree_6.Branch1, explode_tree_6.Branch2])
panel_22 = Panel([explode_tree_6.Branch3, explode_tree_6.Branch4, explode_tree_6.Branch5])
panel_23 = Panel([explode_tree_6.Branch6, explode_tree_6.Branch7, explode_tree_6.Branch8])
panel_24 = Panel([explode_tree_7.Branch0, explode_tree_7.Branch1, explode_tree_7.Branch2])
panel_25 = Panel([explode_tree_7.Branch3, explode_tree_7.Branch4, explode_tree_7.Branch5])
panel_26 = Panel([explode_tree_7.Branch6, explode_tree_7.Branch7, explode_tree_7.Branch8])
panel_27 = Panel([explode_tree_8.Branch3, explode_tree_8.Branch4, explode_tree_8.Branch5])
panel_28 = Panel([explode_tree_8.Branch0, explode_tree_8.Branch1, explode_tree_8.Branch2])
panel_29 = Panel([explode_tree_8.Branch6, explode_tree_8.Branch7, explode_tree_8.Branch8])
panel_30 = Panel([explode_tree_9.Branch0, explode_tree_9.Branch1, explode_tree_9.Branch2])
panel_31 = Panel([explode_tree_9.Branch3, explode_tree_9.Branch4, explode_tree_9.Branch5])
panel_32 = Panel([explode_tree_9.Branch6, explode_tree_9.Branch7, explode_tree_9.Branch8])
number_11 = Number(flatten(panel_18))
number_12 = Number(flatten(panel_19))
number_13 = Number(flatten(panel_20))
number_14 = Number(flatten(panel_21))
number_15 = Number(flatten(panel_22))
number_16 = Number(flatten(panel_23))
number_17 = Number(flatten(panel_24))
number_18 = Number(flatten(panel_25))
number_19 = Number(flatten(panel_26))
number_20 = Number(flatten(panel_28))
number_21 = Number(flatten(panel_27))
number_22 = Number(flatten(panel_29))
# Instructions:
# 1. Drag and drop a hops node on the canvas.
# 2. Set path to:
# http://127.0.0.1:5000/numpy_shape_02
# 3. Name and toggle  component name to :
# numpy_shape_02
number_23 = Number(flatten(panel_30))
number_24 = Number(flatten(panel_31))
number_25 = Number(flatten(panel_32))
# Instructions:
# 1. Drag and drop a hops node on the canvas.
# 2. Set path to:
# http://127.0.0.1:5000/numpy_double
# 3. Name and toggle  component name to :
# numpy_double
numpy_double = Hops(
    Array1=number_17,
    Array2=number_18,
    Array3=number_19,
    CacheResultsInMemory=False,
    CacheSolveResults=False,
    RemoteDefinitionLocation="http://127.0.0.1:5000/numpy_double",
    RemoteSolveVersion=(0, 1, 0),
    ShowInput_Enabled=False,
    ShowInput_Path=False,
    SynchronousSolve=True)  # -> Array1, Array2, Array3
# Instructions:
# 1. Drag and drop a hops node on the canvas.
# 2. Set path to:
# http://127.0.0.1:5000/numpy_shape_02
# 3. Name and toggle  component name to :
# numpy_shape_02
numpy_shape_02 = Hops(
    Array1=number_20,
    Array2=number_21,
    Array3=number_22,
    CacheResultsInMemory=True,
    CacheSolveResults=True,
    RemoteDefinitionLocation="http://127.0.0.1:5000/numpy_shape_02",
    RemoteSolveVersion=(0, 1, 0),
    ShowInput_Enabled=False,
    ShowInput_Path=False,
    SynchronousSolve=True)  # -> Arr1, Arr2, Arr3, Shape
hops = Hops(
    Array1=number_23,
    Array2=number_24,
    Array3=number_25,
    CacheResultsInMemory=True,
    CacheSolveResults=True,
    RemoteDefinitionLocation="http://127.0.0.1:5000/numpy_dtype_02",
    RemoteSolveVersion=(0, 1, 0),
    ShowInput_Enabled=False,
    ShowInput_Path=False,
    SynchronousSolve=True)  # -> Arr1, Arr2, Arr3, Dtype
# Instructions:
# 1. Drag and drop a hops node on the canvas.
# 2. Set path to:
# http://127.0.0.1:5000/numpy_add
# 3. Name and toggle  component name to :
# numpy_add
numpy_add = Hops(
    Array1=number_11,
    Array2=number_12,
    Array3=number_13,
    Array4=number_14,
    Array5=number_15,
    Array6=number_16,
    CacheResultsInMemory=False,
    CacheSolveResults=False,
    RemoteDefinitionLocation="http://127.0.0.1:5000/numpy_add",
    RemoteSolveVersion=(0, 1, 0),
    ShowInput_Enabled=False,
    ShowInput_Path=False,
    SynchronousSolve=True)  # -> Array1, Array2, Array3
entwine_4 = Entwine(Branch00=numpy_double.Array1, Branch01=numpy_double.Array2, Branch02=numpy_double.Array3, FlattenInputs=True)
entwine_5 = Entwine(Branch00=numpy_shape_02.Arr1, Branch01=numpy_shape_02.Arr2, Branch02=numpy_shape_02.Arr3, FlattenInputs=True)
panel_33 = Panel(numpy_shape_02.Shape)
entwine_6 = Entwine(Branch00=hops.Arr1, Branch01=hops.Arr2, Branch02=hops.Arr3, FlattenInputs=True)
panel_34 = Panel(hops.Dtype)
entwine_7 = Entwine(Branch00=number_11, Branch01=number_12, Branch02=number_13, FlattenInputs=True)
entwine_8 = Entwine(Branch00=numpy_add.Array1, Branch01=numpy_add.Array2, Branch02=numpy_add.Array3, FlattenInputs=True)
entwine_9 = Entwine(Branch00=number_14, Branch01=number_15, Branch02=number_16, FlattenInputs=True)
panel_35 = Panel(entwine_4)
panel_36 = Panel(entwine_5)
panel_37 = Panel(entwine_6)
panel_38 = Panel(entwine_8)
panel_39 = Panel(entwine_9)
panel_40 = Panel(entwine_7)
construct_point_7 = ConstructPoint(XCoordinate=0, YCoordinate=0, ZCoordinate=Slider(3, range=0..10))
construct_plane = ConstructPlane(Origin=construct_point_7, XAxis=Vector(1, 0, 0), YAxis=Vector(0, 1, 0))
galapagos = Galapagos()

# ----
# DATA VISUALIZATION
construct_point_8 = ConstructPoint(XCoordinate=0, YCoordinate=panel_40, ZCoordinate=graft(panel_40))
construct_point_9 = ConstructPoint(XCoordinate=graft(panel_40), YCoordinate=0, ZCoordinate=panel_40)
construct_point_10 = ConstructPoint(XCoordinate=panel_40, YCoordinate=graft(panel_40), ZCoordinate=0)
construct_point_11 = ConstructPoint(XCoordinate=graft(panel_39), YCoordinate=0, ZCoordinate=panel_39)
construct_point_12 = ConstructPoint(XCoordinate=panel_39, YCoordinate=graft(panel_39), ZCoordinate=0)
construct_point_13 = ConstructPoint(XCoordinate=0, YCoordinate=panel_39, ZCoordinate=graft(panel_39))
construct_point_14 = ConstructPoint(XCoordinate=graft(panel_38), YCoordinate=0, ZCoordinate=panel_38)
construct_point_15 = ConstructPoint(XCoordinate=panel_38, YCoordinate=graft(panel_38), ZCoordinate=0)
construct_point_16 = ConstructPoint(XCoordinate=0, YCoordinate=panel_38, ZCoordinate=graft(panel_38))
box_2pt = Box2Pt(PointA=construct_point_10, PointB=construct_point_8, Plane=PlaneXY(0, 0, 0))
box_2pt_2 = Box2Pt(PointA=construct_point_16, PointB=construct_point_14, Plane=PlaneXY(0, 0, 0))
box_2pt_3 = Box2Pt(PointA=construct_point_11, PointB=construct_point_12, Plane=PlaneXY(0, 0, 0))
deconstruct = Deconstruct(Point=construct_point_13)  # -> XComponent, YComponent, ZComponent
deconstruct_2 = Deconstruct(Point=construct_point_15)  # -> XComponent, YComponent, ZComponent
volume = Volume(Geometry=box_2pt_2)  # -> Volume, Centroid
deconstruct_3 = Deconstruct(Point=construct_point_9)  # -> XComponent, YComponent, ZComponent
construct_point_17 = ConstructPoint(XCoordinate=deconstruct_2.XComponent, YCoordinate=deconstruct.YComponent, ZCoordinate=deconstruct_3.ZComponent)
number_slider_11 = Slider(24, range=0..100)
orient = Orient(Geometry=box_2pt_2, Source=volume.Centroid, Target=construct_point_17)  # -> Geometry, Transform
solid_union = SolidUnion(Breps=orient.Geometry)  # -> flatten(Result)
list_length_9 = ListLength(List=solid_union)
construct_point_18 = ConstructPoint(XCoordinate=0, YCoordinate=0, ZCoordinate=0)
series_4 = Series(Start=0, Step=number_slider_11, Count=list_length_9)
construct_point_19 = ConstructPoint(XCoordinate=series_4, YCoordinate=0, ZCoordinate=0)
orient_2 = Orient(Geometry=graft(solid_union), Source=graft(construct_point_18), Target=graft(construct_point_19))  # -> Geometry, Transform

multiplication_2 = Multiplication(A=number_slider_11, B=number_slider_11)
negative_3 = Negative(Value=multiplication_2)
construct_domain_3 = ConstructDomain(DomainStart=negative_3, DomainEnd=multiplication_2)
rectangle_3 = Rectangle(Plane=construct_plane, XSize=construct_domain_3, YSize=construct_domain_3, Radius=0)  # -> Rectangle, Length

boundary_surfaces_6 = BoundarySurfaces(Edges=rectangle_3.Rectangle)
geometry = Geometry([boundary_surfaces_6, orient_2.Geometry])
