# Grasshopper definition AI_copilot_to_AI_stablediffusion_002.gh (Grasshopper 1.0.7)
# plug-ins: Hops, Fologram For Grasshopper Utilities

# From AI copilot to AI Stable Diffusion
# at www.wickersonstudios.com
# Python for Data Manipulation and Mudging
# NUMPY BASICS: Array and Vectorized
# Computation into Grasshopper for Generating
# Rhino3D Geometries
# A N-dimensional Array Object
# with ndim and shape
# #print(arr.list_to_tree()) not working in grasshopper canvas
# # use entwine node in gh to convert lists to tree
# 
# return arr.tolist()[0], arr.tolist()[1], arr.tolist()[2]
gene_pool = GenePool(Decimals=1, Maximum=10, Minimum=0, Value=[0.6, 0.9257266209, 2.820610363, 3.8, 4.6, 5.3, 6, 6.8, 8.2])
# A N-dimensional Zeros Array Object
# with ndim and shape
number_slider = Slider(1.5, range=0.01..3)
# #print(arr.list_to_tree()) not working in grasshopper canvas
# # use entwine node in gh to convert lists to tree
# 
# return arr.tolist()[0], arr.tolist()[1], arr.tolist()[2]
number_slider_2 = Slider(5, range=0..10)
# A N-dimensional arange Array Object
# with ndim and shape
number_slider_3 = Slider(4, range=0..10)
# A N-dimensional Ones Array Object
# with ndim and shape
number_slider_4 = Slider(4, range=0..10)
# #print(arr.list_to_tree()) not working in grasshopper canvas
# # use entwine node in gh to convert lists to tree
# 
# return arr.tolist()[0], arr.tolist()[1], arr.tolist()[2]
panel = Panel("4")
# #print(arr.list_to_tree()) not working in grasshopper canvas
# # use entwine node in gh to convert lists to tree
# 
# return arr.tolist()[0], arr.tolist()[1], arr.tolist()[2]
panel_2 = Panel("4")
panel_3 = Panel("4")
explode_tree = ExplodeTree(Data=graft(gene_pool))  # -> Branch0, Branch1, Branch2, Branch3, Branch4, Branch5, Branch6, Branch7, Branch8
# Instructions:
# 1. Drag and drop a hops node on the canvas.
# 2. Set path to:
# http://127.0.0.1:5000/numpy_ones
# 3. Name and toggle  component name to :
# numpy_ones
numpy_ones = Hops(
    Rows=panel,
    Columns=number_slider_3,
    CacheResultsInMemory=True,
    CacheSolveResults=True,
    RemoteDefinitionLocation="http://127.0.0.1:5000/numpy_ones",
    RemoteSolveVersion=(0, 1, 0),
    ShowInput_Enabled=False,
    ShowInput_Path=False,
    SynchronousSolve=True)  # -> Arr1, Arr2, Arr3, Arr4, Ndim, Shape
umpy_arange_02 = Hops(
    Count=number_slider_2,
    CacheResultsInMemory=True,
    CacheSolveResults=True,
    RemoteDefinitionLocation="http://127.0.0.1:5000/numpy_arange_02",
    RemoteSolveVersion=(0, 1, 0),
    ShowInput_Enabled=False,
    ShowInput_Path=False,
    SynchronousSolve=True)  # -> Array, Ndim, Shape
# Instructions:
# 1. Drag and drop a hops node on the canvas.
# 2. Set path to:
# http://127.0.0.1:5000/numpy_zeros_02
# 3. Name and toggle  component name to :
# numpy_zeros_02
numpy_zeros_02 = Hops(
    Rows=panel_2,
    Columns=number_slider_4,
    CacheResultsInMemory=True,
    CacheSolveResults=True,
    RemoteDefinitionLocation="http://127.0.0.1:5000/numpy_zeros_02",
    RemoteSolveVersion=(0, 1, 0),
    ShowInput_Enabled=False,
    ShowInput_Path=False,
    SynchronousSolve=True)  # -> Arr1, Arr2, Arr3, Arr4, Ndim, Shape
# Instructions:
# 1. Drag and drop a hops node on the canvas.
# 2. Set path to:
# http://127.0.0.1:5000/numpy_ndim_shape_02
# 3. Name and toggle  component name to :
# numpy_ndim_shape_02
panel_4 = Panel([explode_tree.Branch0, explode_tree.Branch1, explode_tree.Branch2])
panel_5 = Panel([explode_tree.Branch3, explode_tree.Branch4, explode_tree.Branch5])
panel_6 = Panel([explode_tree.Branch6, explode_tree.Branch7, explode_tree.Branch8])
panel_7 = Panel(numpy_ones.Ndim)
panel_8 = Panel(numpy_ones.Shape)
panel_9 = Panel(numpy_zeros_02.Ndim)
entwine = Entwine(
    Branch00=numpy_ones.Arr1,
    Branch01=numpy_ones.Arr2,
    Branch02=numpy_ones.Arr3,
    Branch03=numpy_ones.Arr4,
    FlattenInputs=True)
panel_10 = Panel(numpy_zeros_02.Shape)
panel_11 = Panel(umpy_arange_02.Ndim)
panel_12 = Panel(umpy_arange_02.Shape)
entwine_2 = Entwine(
    Branch00=numpy_zeros_02.Arr1,
    Branch01=numpy_zeros_02.Arr2,
    Branch02=numpy_zeros_02.Arr3,
    Branch03=numpy_zeros_02.Arr4,
    FlattenInputs=True)
# Instructions:
# 1. Drag and drop a hops node on the canvas.
# 2. Set path to:
# http://127.0.0.1:5000/umpy_arange_02
# 3. Name and toggle  component name to :
# umpy_arange_02
panel_13 = Panel(umpy_arange_02.Array)
number = Number(flatten(panel_4))
number_2 = Number(flatten(panel_5))
number_3 = Number(flatten(panel_6))
dispatch = Dispatch(List=panel_8, DispatchPattern=[True, False])  # -> ListA, ListB
dispatch_2 = Dispatch(List=panel_10, DispatchPattern=[True, False])  # -> ListA, ListB
panel_14 = Panel(entwine)
panel_15 = Panel(entwine_2)
numpy_ndim_shape_02 = Hops(
    Array1=number,
    Array2=number_2,
    Array3=number_3,
    CacheResultsInMemory=True,
    CacheSolveResults=True,
    RemoteDefinitionLocation="http://127.0.0.1:5000/numpy_ndim_shape_02",
    RemoteSolveVersion=(0, 1, 0),
    ShowInput_Enabled=False,
    ShowInput_Path=False,
    SynchronousSolve=True)  # -> Arr1, Arr2, Arr3, Ndim, Shape
panel_16 = Panel(numpy_ndim_shape_02.Shape)
panel_17 = Panel(numpy_ndim_shape_02.Ndim)
entwine_3 = Entwine(
    Branch00=numpy_ndim_shape_02.Arr1,
    Branch01=numpy_ndim_shape_02.Arr2,
    Branch02=numpy_ndim_shape_02.Arr3,
    FlattenInputs=True)
dispatch_3 = Dispatch(List=panel_16, DispatchPattern=[True, False])  # -> ListA, ListB
panel_18 = Panel(entwine_3)
# A N-dimensional full_like Array Object
# with ndim and shape
# #print(arr.list_to_tree()) not working in grasshopper canvas
# # use entwine node in gh to convert lists to tree
# 
# return arr.tolist()[0], arr.tolist()[1], arr.tolist()[2]
explode_tree_2 = ExplodeTree(Data=panel_18)  # -> Branch0, Branch1, Branch2
# A N-dimensional empty_like Array Object
# with ndim and shape
# #print(arr.list_to_tree()) not working in grasshopper canvas
# # use entwine node in gh to convert lists to tree
# 
# return arr.tolist()[0], arr.tolist()[1], arr.tolist()[2]
explode_tree_3 = ExplodeTree(Data=panel_18)  # -> Branch0, Branch1, Branch2
# A N-dimensional zeros_like Array Object
# with ndim and shape
# #print(arr.list_to_tree()) not working in grasshopper canvas
# # use entwine node in gh to convert lists to tree
# 
# return arr.tolist()[0], arr.tolist()[1], arr.tolist()[2]
explode_tree_4 = ExplodeTree(Data=panel_18)  # -> Branch0, Branch1, Branch2
# A N-dimensional ones_like Array Object
# with ndim and shape
# #print(arr.list_to_tree()) not working in grasshopper canvas
# # use entwine node in gh to convert lists to tree
# 
# return arr.tolist()[0], arr.tolist()[1], arr.tolist()[2]
explode_tree_5 = ExplodeTree(Data=panel_18)  # -> Branch0, Branch1, Branch2
# Instructions:
# 1. Drag and drop a hops node on the canvas.
# 2. Set path to:
# http://127.0.0.1:5000/numpy_full_like
# 3. Name and toggle  component name to :
# numpy_full_like
numpy_full_like = Hops(
    Arr1=explode_tree_2.Branch0,
    Arr2=explode_tree_2.Branch1,
    Arr3=explode_tree_2.Branch2,
    Value=Slider(10, range=0..10),
    CacheResultsInMemory=False,
    CacheSolveResults=False,
    RemoteDefinitionLocation="http://127.0.0.1:5000/numpy_full_like",
    RemoteSolveVersion=(0, 1, 0),
    ShowInput_Enabled=False,
    ShowInput_Path=False,
    SynchronousSolve=True)  # -> Arr1, Arr2, Arr3, Ndim, Shape
# Instructions:
# 1. Drag and drop a hops node on the canvas.
# 2. Set path to:
# http://127.0.0.1:5000/numpy_ones_like_02
# 3. Name and toggle  component name to :
# numpy_ones_like_02
numpy_ones_like_02 = Hops(
    Arr1=explode_tree_5.Branch0,
    Arr2=explode_tree_5.Branch1,
    Arr3=explode_tree_5.Branch2,
    CacheResultsInMemory=True,
    CacheSolveResults=True,
    RemoteDefinitionLocation="http://127.0.0.1:5000/numpy_ones_like_02",
    RemoteSolveVersion=(0, 1, 0),
    ShowInput_Enabled=False,
    ShowInput_Path=False,
    SynchronousSolve=True)  # -> Arr1, Arr2, Arr3, Ndim, Shape
# Instructions:
# 1. Drag and drop a hops node on the canvas.
# 2. Set path to:
# http://127.0.0.1:5000/numpy_zeros_like
# 3. Name and toggle  component name to :
# numpy_zeros_like
numpy_zeros_like = Hops(
    Arr1=explode_tree_4.Branch0,
    Arr2=explode_tree_4.Branch1,
    Arr3=explode_tree_4.Branch2,
    CacheResultsInMemory=True,
    CacheSolveResults=True,
    RemoteDefinitionLocation="http://127.0.0.1:5000/numpy_zeros_like",
    RemoteSolveVersion=(0, 1, 0),
    ShowInput_Enabled=False,
    ShowInput_Path=False,
    SynchronousSolve=True)  # -> Arr1, Arr2, Arr3, Ndim, Shape
# Instructions:
# 1. Drag and drop a hops node on the canvas.
# 2. Set path to:
# http://127.0.0.1:5000/numpy_empty_like
# 3. Name and toggle  component name to :
# numpy_empty_like
numpy_empty_like = Hops(
    Arr1=explode_tree_3.Branch0,
    Arr2=explode_tree_3.Branch1,
    Arr3=explode_tree_3.Branch2,
    CacheResultsInMemory=False,
    CacheSolveResults=False,
    RemoteDefinitionLocation="http://127.0.0.1:5000/numpy_empty_like",
    RemoteSolveVersion=(0, 1, 0),
    ShowInput_Enabled=False,
    ShowInput_Path=False,
    SynchronousSolve=True)  # -> Arr1, Arr2, Arr3, Ndim, Shape
entwine_4 = Entwine(Branch00=numpy_full_like.Arr1, Branch01=numpy_full_like.Arr2, Branch02=numpy_full_like.Arr3, FlattenInputs=True)
panel_19 = Panel(numpy_full_like.Shape)
entwine_5 = Entwine(Branch00=numpy_empty_like.Arr1, Branch01=numpy_empty_like.Arr2, Branch02=numpy_empty_like.Arr3, FlattenInputs=True)
panel_20 = Panel(numpy_empty_like.Shape)
panel_21 = Panel(numpy_full_like.Ndim)
panel_22 = Panel(numpy_ones_like_02.Shape)
panel_23 = Panel(numpy_zeros_like.Shape)
entwine_6 = Entwine(Branch00=numpy_zeros_like.Arr1, Branch01=numpy_zeros_like.Arr2, Branch02=numpy_zeros_like.Arr3, FlattenInputs=True)
entwine_7 = Entwine(Branch00=numpy_ones_like_02.Arr1, Branch01=numpy_ones_like_02.Arr2, Branch02=numpy_ones_like_02.Arr3, FlattenInputs=True)
panel_24 = Panel(numpy_empty_like.Ndim)
panel_25 = Panel(numpy_ones_like_02.Ndim)
panel_26 = Panel(numpy_zeros_like.Ndim)
panel_27 = Panel(entwine_4)
panel_28 = Panel(entwine_5)
panel_29 = Panel(entwine_7)
panel_30 = Panel(entwine_6)
# dtype of
# a Three-dimensional
# Array Object
# Casting or Converting to int with
# Type Code ("i" = int8)
# 
# np.astype(anotherArr.dtype)
gene_pool_2 = GenePool(
    Decimals=1,
    Maximum=10,
    Minimum=0,
    Value=[6.43656384, 6.414596679, 8.682321556, 8.178288153, 0.6086686443, 0.417990545, 4.828051065, 7.878016638, 10])
# A N-dimensional eye Array Object
# with ndim and shape
# #print(arr.list_to_tree()) not working in grasshopper canvas
# # use entwine node in gh to convert lists to tree
# 
# return arr.tolist()[0], arr.tolist()[1], arr.tolist()[2]
number_slider_5 = Slider(4, range=0..10)
# A N-dimensional identity Array Object
# with ndim and shape
number_slider_6 = Slider(0, range=-4..4)
# #print(arr.list_to_tree()) not working in grasshopper canvas
# # use entwine node in gh to convert lists to tree
# 
# return arr.tolist()[0], arr.tolist()[1], arr.tolist()[2]
number_slider_7 = Slider(4, range=0..10)
number_slider_8 = Slider(-1, range=-10..10)
explode_tree_6 = ExplodeTree(Data=graft(gene_pool_2))  # -> Branch0, Branch1, Branch2, Branch3, Branch4, Branch5, Branch6, Branch7, Branch8
# Instructions:
# 1. Drag and drop a hops node on the canvas.
# 2. Set path to:
# http://127.0.0.1:5000/numpy_eye
# 3. Name and toggle  component name to :
# numpy_eye
numpy_eye = Hops(
    Rows="4",
    Columns=number_slider_5,
    K=number_slider_6,
    CacheResultsInMemory=False,
    CacheSolveResults=False,
    RemoteDefinitionLocation="http://127.0.0.1:5000/numpy_eye",
    RemoteSolveVersion=(0, 1, 0),
    ShowInput_Enabled=False,
    ShowInput_Path=False,
    SynchronousSolve=True)  # -> Arr1, Arr2, Arr3, Arr4
# Instructions:
# 1. Drag and drop a hops node on the canvas.
# 2. Set path to:
# http://127.0.0.1:5000/numpy_identity
# 3. Name and toggle  component name to :
# numpy_identity
numpy_identity = Hops(
    N="4",
    CacheResultsInMemory=False,
    CacheSolveResults=False,
    RemoteDefinitionLocation="http://127.0.0.1:5000/numpy_identity",
    RemoteSolveVersion=(0, 1, 0),
    ShowInput_Enabled=False,
    ShowInput_Path=False,
    SynchronousSolve=True)  # -> Arr1, Arr2, Arr3, Arr4
entwine_8 = Entwine(Branch00=numpy_eye.Arr1, Branch01=numpy_eye.Arr2, Branch02=numpy_eye.Arr3, Branch03=numpy_eye.Arr4, FlattenInputs=True)
entwine_9 = Entwine(
    Branch00=numpy_identity.Arr1,
    Branch01=numpy_identity.Arr2,
    Branch02=numpy_identity.Arr3,
    Branch03=numpy_identity.Arr4,
    FlattenInputs=True)
panel_31 = Panel([explode_tree_6.Branch3, explode_tree_6.Branch4, explode_tree_6.Branch5])
panel_32 = Panel([explode_tree_6.Branch0, explode_tree_6.Branch1, explode_tree_6.Branch2])
panel_33 = Panel([explode_tree_6.Branch6, explode_tree_6.Branch7, explode_tree_6.Branch8])
panel_34 = Panel(entwine_8)
panel_35 = Panel(entwine_9)
number_4 = Number(flatten(panel_33))
number_5 = Number(flatten(panel_32))
number_6 = Number(flatten(panel_31))
# Instructions:
# 1. Drag and drop a hops node on the canvas.
# 2. Set path to:
# http://127.0.0.1:5000/numpy_casting
# 3. Name and toggle  component name to :
# numpy_casting
numpy_casting = Hops(
    Arr1=number_5,
    Arr2=number_6,
    Arr3=number_4,
    CacheResultsInMemory=True,
    CacheSolveResults=True,
    RemoteDefinitionLocation="http://127.0.0.1:5000/numpy_casting",
    RemoteSolveVersion=(0, 1, 0),
    ShowInput_Enabled=False,
    ShowInput_Path=False,
    SynchronousSolve=True)  # -> Arr1, Arr2, Arr3

# ----
# DATA VISUALIZATION
rectangle = Rectangle(Plane=PlaneXY(0, 0, 0), XSize=Domain(-1, 1), YSize=Domain(-2, 2), Radius=0)  # -> Rectangle, Length
explode = Explode(Curve=rectangle.Rectangle, Recursive=True)  # -> Segments, Vertices
unit_z = UnitZ(Factor=panel_34)
cull_index = CullIndex(List=explode.Vertices, Indices="0", Wrap=True)
move = Move(Geometry=cull_index, Motion=unit_z)  # -> Geometry, Transform
panel_36 = Panel(move.Geometry)
number_slider_9 = Slider(5, range=0..10)
polyline = PolyLine(Vertices=panel_36, Closed=Toggle(True))
rectangular_array = RectangularArray(Geometry=polyline, Cell=rectangle.Rectangle, XCount=number_slider_9, YCount=number_slider_9)  # -> Geometry, Transform
boolean_toggle = BooleanToggle(True)
mesh_pipe = MeshPipe(
    Polylines=rectangular_array.Geometry,
    NumberOfSides=4,
    Tolerance=0.1,
    Radius=Slider(0.217, range=0..1),
    Cap=boolean_toggle,
    Join=boolean_toggle)

entwine_10 = Entwine(Branch00=numpy_casting.Arr1, Branch01=numpy_casting.Arr2, Branch02=numpy_casting.Arr3, FlattenInputs=True)
panel_37 = Panel(entwine_10)
# Arithmetic with NumPy Arrays
# ADDING TWO
# N-dimensional Array Objects
gene_pool_3 = GenePool(
    Decimals=2,
    Maximum=10,
    Minimum=0,
    Value=[1.699702815, 0.68, 3.995681379, 9.124618126, 1.077562059, 4.518803351, 4.632920872, 9.206508519])
# MULTIPLYING TWO
# N-dimensional Array Objects
# SUBTRACTING  TWO
# N-dimensional Array Objects
scale = Slider(2.49, range=0.01..12)
explode_tree_7 = ExplodeTree(Data=graft(gene_pool_3))  # -> Branch0, Branch1, Branch2, Branch3, Branch4, Branch5, Branch6, Branch7, Branch8
panel_38 = Panel([explode_tree_7.Branch2, explode_tree_7.Branch3])
panel_39 = Panel([explode_tree_7.Branch0, explode_tree_7.Branch1])
panel_40 = Panel([explode_tree_7.Branch6, explode_tree_7.Branch7])
panel_41 = Panel([explode_tree_7.Branch4, explode_tree_7.Branch5])
number_7 = Number(flatten(panel_41))
number_8 = Number(flatten(panel_40))
number_9 = Number(flatten(panel_38))
# Instructions:
# 1. Drag and drop a hops node on the canvas.
# 2. Set path to:
# http://127.0.0.1:5000/numpy_adding
# 3. Name and toggle  component name to :
# numpy_adding
number_10 = Number(flatten(panel_39))
# Instructions:
# 1. Drag and drop a hops node on the canvas.
# 2. Set path to:
# http://127.0.0.1:5000/numpy_multiplication
# 3. Name and toggle  component name to :
# numpy_multiplication
numpy_multiplication = Hops(
    Arr1=number_10,
    Arr2=number_9,
    Arr3=number_7,
    Arr4=number_8,
    CacheResultsInMemory=True,
    CacheSolveResults=True,
    RemoteDefinitionLocation="http://127.0.0.1:5000/numpy_multiplication",
    RemoteSolveVersion=(0, 1, 0),
    ShowInput_Enabled=False,
    ShowInput_Path=False,
    SynchronousSolve=True)  # -> Arr1, Arr2
numpy_adding = Hops(
    Arr1=number_10,
    Arr2=number_9,
    Arr3=number_7,
    Arr4=number_8,
    CacheResultsInMemory=True,
    CacheSolveResults=True,
    RemoteDefinitionLocation="http://127.0.0.1:5000/numpy_adding",
    RemoteSolveVersion=(0, 1, 0),
    ShowInput_Enabled=False,
    ShowInput_Path=False,
    SynchronousSolve=True)  # -> Arr1, Arr2
# Instructions:
# 1. Drag and drop a hops node on the canvas.
# 2. Set path to:
# http://127.0.0.1:5000/numpy_subtracting
# 3. Name and toggle  component name to :
# numpy_subtracting
numpy_subtracting = Hops(
    Arr1=number_10,
    Arr2=number_9,
    Arr3=number_7,
    Arr4=number_8,
    CacheResultsInMemory=False,
    CacheSolveResults=False,
    RemoteDefinitionLocation="http://127.0.0.1:5000/numpy_subtracting",
    RemoteSolveVersion=(0, 1, 0),
    ShowInput_Enabled=False,
    ShowInput_Path=False,
    SynchronousSolve=True)  # -> Arr1, Arr2
# Instructions:
# 1. Drag and drop a hops node on the canvas.
# 2. Set path to:
# http://127.0.0.1:5000/numpy_dividing
# 3. Name and toggle  component name to :
# numpy_dividing
numpy_dividing = Hops(
    Arr1=number_10,
    Arr2=number_9,
    Arr3=number_7,
    Arr4=number_8,
    CacheResultsInMemory=False,
    CacheSolveResults=False,
    RemoteDefinitionLocation="http://127.0.0.1:5000/numpy_dividing",
    RemoteSolveVersion=(0, 1, 0),
    ShowInput_Enabled=False,
    ShowInput_Path=False,
    SynchronousSolve=True)  # -> Arr1, Arr2
entwine_11 = Entwine(Branch00=numpy_multiplication.Arr1, Branch01=numpy_multiplication.Arr2, FlattenInputs=True)
entwine_12 = Entwine(Branch00=numpy_subtracting.Arr1, Branch01=numpy_subtracting.Arr2, FlattenInputs=True)
entwine_13 = Entwine(Branch00=numpy_adding.Arr1, Branch01=numpy_adding.Arr2, FlattenInputs=True)
entwine_14 = Entwine(Branch00=numpy_dividing.Arr1, Branch01=numpy_dividing.Arr2, FlattenInputs=True)
# log base x
# N-dimensional Array Objects
panel_42 = Panel(entwine_12)
panel_43 = Panel(entwine_11)
# EXPONENT OF
# N-dimensional Array Objects
panel_44 = Panel(entwine_13)
panel_45 = Panel(entwine_14)

# ----
# DATA VISUALIZATION
# ADDING TWO
# N-dimensional Array Objects
# MULTIPLYING TWO
# N-dimensional Array Objects
# SUBTRACTING  TWO
# N-dimensional Array Objects
# DIVIDING TWO
# N-dimensional Array Objects
entwine_15 = Entwine(Branch00=number_10, Branch01=number_9, Branch02=number_7, Branch03=number_8, FlattenInputs=True)
# DIVIDING TWO
# N-dimensional Array Objects
panel_46 = Panel(entwine_15)
construct_point = ConstructPoint(XCoordinate=panel_46, YCoordinate=graft(panel_46), ZCoordinate=0)
panel_47 = Panel(construct_point)
point = Point(panel_47)
dispatch_4 = Dispatch(List=point, DispatchPattern=[True, False])  # -> ListA, ListB
panel_48 = Panel(panel_44)
circle = Circle(Plane=dispatch_4.ListA, Radius=panel_48)
circle_2 = Circle(Plane=dispatch_4.ListB, Radius=panel_48)
region_union = RegionUnion(Curves=[circle, circle_2])
panel_49 = Panel(panel_43)
panel_50 = Panel(panel_42)
panel_51 = Panel(panel_45)
sort_list = SortList(Keys=flatten([panel_49, panel_50]))  # -> Keys, ValuesA
unit_z_2 = UnitZ(Factor=sort_list.Keys)  # -> graft(UnitVector)
move_2 = Move(Geometry=region_union, Motion=unit_z_2)  # -> Geometry, Transform
loft = Loft(
    Curves=flatten(move_2.Geometry),
    Options={Adjust=False, Closed=False, LoftEnds=0, LoftSimp=0, LoftType=0, Rebuild=10, Refit=0.01})

number_slider_10 = Slider(0, range=0..1)
number_slider_11 = Slider(1, range=0..1)
exponent = Slider(4, range=0..10)
# LOG OF
# N-dimensional Array Objects
exponent_2 = Slider(2, range=0..10)
# sqrt of
# N-dimensional Array Objects
number_slider_12 = Slider(0.5, range=0..1)
# Instructions:
# 1. Drag and drop a hops node on the canvas.
# 2. Set path to:
# http://127.0.0.1:5000/numpy_log_base_x
# 3. Name and toggle  component name to :
# numpy_log_base_x
numpy_log_base_x = Hops(
    Arr1=number_10,
    Arr2=number_9,
    Arr3=number_8,
    Arr4=number_8,
    Log_base_x=Slider(2, range=0..10),
    CacheResultsInMemory=False,
    CacheSolveResults=False,
    RemoteDefinitionLocation="http://127.0.0.1:5000/numpy_log_base_x",
    RemoteSolveVersion=(0, 1, 0),
    ShowInput_Enabled=False,
    ShowInput_Path=False,
    SynchronousSolve=True)  # -> Arr1, Arr2, Arr3, Arr4
# Instructions:
# 1. Drag and drop a hops node on the canvas.
# 2. Set path to:
# http://127.0.0.1:5000/numpy_log_01
# 3. Name and toggle  component name to :
# numpy_log_01
numpy_log_01 = Hops(
    Arr1=number_10,
    Arr2=number_9,
    Arr3=number_7,
    Arr4=number_8,
    CacheResultsInMemory=True,
    CacheSolveResults=True,
    RemoteDefinitionLocation="http://127.0.0.1:5000/numpy_log_01",
    RemoteSolveVersion=(0, 1, 0),
    ShowInput_Enabled=False,
    ShowInput_Path=False,
    SynchronousSolve=True)  # -> Arr1, Arr2, Arr3, Arr4
# Instructions:
# 1. Drag and drop a hops node on the canvas.
# 2. Set path to:
# http://127.0.0.1:5000/numpy_exponentiation
# 3. Name and toggle  component name to :
# numpy_exponentiation
numpy_exponentiation = Hops(
    Arr1=number_10,
    Arr2=number_9,
    Arr3=number_7,
    Arr4=number_8,
    Expontent=number_slider_12,
    CacheResultsInMemory=True,
    CacheSolveResults=True,
    RemoteDefinitionLocation="http://127.0.0.1:5000/numpy_exponentiation",
    RemoteSolveVersion=(0, 1, 0),
    ShowInput_Enabled=False,
    ShowInput_Path=False,
    SynchronousSolve=True)  # -> Arr1, Arr2, Arr3, Arr4
# Instructions:
# 1. Drag and drop a hops node on the canvas.
# 2. Set path to:
# http://127.0.0.1:5000/numpy_square_root
# 3. Name and toggle  component name to :
# numpy_square_root
numpy_square_root = Hops(
    Arr1=number_10,
    Arr2=number_9,
    Arr3=number_7,
    Arr4=number_8,
    Sqrt=exponent_2,
    CacheResultsInMemory=False,
    CacheSolveResults=False,
    RemoteDefinitionLocation="http://127.0.0.1:5000/numpy_square_root",
    RemoteSolveVersion=(0, 1, 0),
    ShowInput_Enabled=False,
    ShowInput_Path=False,
    SynchronousSolve=True)  # -> Arr1, Arr2, Arr3, Arr4
relay = Relay([number_slider_10, number_slider_11])
relay_2 = Relay([number_slider_10, number_slider_11])
entwine_16 = Entwine(
    Branch00=numpy_log_01.Arr1,
    Branch01=numpy_log_01.Arr2,
    Branch02=numpy_log_01.Arr3,
    Branch03=numpy_log_01.Arr4,
    FlattenInputs=True)
entwine_17 = Entwine(
    Branch00=numpy_log_base_x.Arr1,
    Branch01=numpy_log_base_x.Arr2,
    Branch02=numpy_log_base_x.Arr3,
    Branch03=numpy_log_base_x.Arr4,
    FlattenInputs=True)
entwine_18 = Entwine(Branch00=relay, Branch01=relay_2, FlattenInputs=True)
entwine_19 = Entwine(
    Branch00=numpy_square_root.Arr1,
    Branch01=numpy_square_root.Arr2,
    Branch02=numpy_square_root.Arr3,
    Branch03=numpy_square_root.Arr4,
    FlattenInputs=True)
entwine_20 = Entwine(
    Branch00=numpy_exponentiation.Arr1,
    Branch01=numpy_exponentiation.Arr2,
    Branch02=numpy_exponentiation.Arr3,
    Branch03=numpy_exponentiation.Arr4,
    FlattenInputs=True)
panel_52 = Panel(entwine_16)
panel_53 = Panel(entwine_17)
panel_54 = Panel(entwine_18)
# #tangent function
# #secant function
# #cosecant function
# #cotangent function
# #inverse trigonometric functions
# #hyperbolic functions
# #inverse hyperbolic functions
panel_55 = Panel(entwine_19)
panel_56 = Panel(entwine_20)
# Trigonometric Functions
# sine function  of
# N-dimensional Array Objects
number_11 = Number(number_10)
number_12 = Number(number_9)
number_13 = Number(number_7)
# cosine function  of
# N-dimensional Array Objects
number_14 = Number(number_8)
# Instructions:
# 1. Drag and drop a hops node on the canvas.
# 2. Set path to:
# http://127.0.0.1:5000/numpy_cos
# 3. Name and toggle  component name to :
# numpy_cos
numpy_cos = Hops(
    Arr1=number_11,
    Arr2=number_12,
    Arr3=number_13,
    Arr4=number_14,
    CacheResultsInMemory=True,
    CacheSolveResults=True,
    RemoteDefinitionLocation="http://127.0.0.1:5000/numpy_cos",
    RemoteSolveVersion=(0, 1, 0),
    ShowInput_Enabled=False,
    ShowInput_Path=False,
    SynchronousSolve=True)  # -> Arr1, Arr2, Arr3, Arr4
# Instructions:
# 1. Drag and drop a hops node on the canvas.
# 2. Set path to:
# http://127.0.0.1:5000/numpy_sin
# 3. Name and toggle  component name to :
# numpy_sin
numpy_sin = Hops(
    Arr1=number_11,
    Arr2=number_12,
    Arr3=number_13,
    Arr4=number_14,
    CacheResultsInMemory=True,
    CacheSolveResults=True,
    RemoteDefinitionLocation="http://127.0.0.1:5000/numpy_sin",
    RemoteSolveVersion=(0, 1, 0),
    ShowInput_Enabled=False,
    ShowInput_Path=False,
    SynchronousSolve=True)  # -> Arr1, Arr2, Arr3, Arr4
# rounding function  of
# N-dimensional Array Objects
# Instructions:
# 1. Drag and drop a hops node on the canvas.
# 2. Set path to:
# http://127.0.0.1:5000/numpy_round
# 3. Name and toggle  component name to :
# numpy_round
numpy_round = Hops(
    Arr1=number_11,
    Arr2=number_12,
    Arr3=number_13,
    Arr4=number_14,
    Decimals=Slider(4, range=0..10),
    CacheResultsInMemory=True,
    CacheSolveResults=True,
    RemoteDefinitionLocation="http://127.0.0.1:5000/numpy_round",
    RemoteSolveVersion=(0, 1, 0),
    ShowInput_Enabled=False,
    ShowInput_Path=False,
    SynchronousSolve=True)  # -> Arr1, Arr2, Arr3, Arr4
entwine_21 = Entwine(Branch00=numpy_sin.Arr1, Branch01=numpy_sin.Arr2, Branch02=numpy_sin.Arr3, Branch03=numpy_sin.Arr4, FlattenInputs=True)
entwine_22 = Entwine(Branch00=numpy_cos.Arr1, Branch01=numpy_cos.Arr2, Branch02=numpy_cos.Arr3, Branch03=numpy_cos.Arr4, FlattenInputs=True)
entwine_23 = Entwine(
    Branch00=numpy_round.Arr1,
    Branch01=numpy_round.Arr2,
    Branch02=numpy_round.Arr3,
    Branch03=numpy_round.Arr4,
    FlattenInputs=True)

# ----
# DATA VISUALIZATION
# sine function  of
# N-dimensional Array Objects
# cosine function  of
# N-dimensional Array Objects
# rounding function  of
# N-dimensional Array Objects
panel_57 = Panel(entwine_21)
panel_58 = Panel(entwine_22)
panel_59 = Panel(entwine_23)
construct_point_2 = ConstructPoint(XCoordinate=panel_58, YCoordinate=panel_57, ZCoordinate=0)
construct_point_3 = ConstructPoint(XCoordinate=panel_57, YCoordinate=panel_58, ZCoordinate=0)
circle_3 = Circle(Plane=graft(construct_point_2), Radius=graft(panel_59))
circle_4 = Circle(Plane=graft(construct_point_3), Radius=graft(panel_59))
region_union_2 = RegionUnion(Curves=[circle_4, circle_3])
number_slider_13 = Slider(5, range=0..10)
list_length = ListLength(List=flatten(region_union_2))
panel_60 = Panel(region_union_2)
series = Series(Start=0, Step="5", Count=list_length)
unit_z_3 = UnitZ(Factor=series)
move_3 = Move(Geometry=region_union_2, Motion=graft(unit_z_3))  # -> Geometry, Transform
loft_2 = Loft(
    Curves=flatten(move_3.Geometry),
    Options={Adjust=False, Closed=False, LoftEnds=0, LoftSimp=0, LoftType=0, Rebuild=10, Refit=0.01})

panel_61 = Panel(entwine_21)
panel_62 = Panel(entwine_22)
panel_63 = Panel(entwine_23)
# Comparison Functions
# greater function
# N-dimensional Array Objects
number_slider_14 = Slider(1, range=0..1)
# less function
# N-dimensional Array Objects
number_slider_15 = Slider(1, range=0..1)
panel_64 = Panel([Slider(0, range=0..1), number_slider_15])
panel_65 = Panel([Slider(0, range=0..1), Slider(0, range=0..1)])
# Instructions:
# 1. Drag and drop a hops node on the canvas.
# 2. Set path to:
# http://127.0.0.1:5000/ndarray_comparison
# 3. Name and toggle  component name to :
# ndarray_comparison
panel_66 = Panel([number_slider_14, Slider(1, range=0..1)])
panel_67 = Panel([Slider(1, range=0..1), Slider(0, range=0..1)])
# Instructions:
# 1. Drag and drop a hops node on the canvas.
# 2. Set path to:
# http://127.0.0.1:5000/ndarray_less_than
# 3. Name and toggle  component name to :
# ndarray_less_than
ndarray_less_than = Hops(
    List1=panel_66,
    List2=panel_67,
    List3=panel_65,
    List4=panel_64,
    CacheResultsInMemory=True,
    CacheSolveResults=True,
    RemoteDefinitionLocation="http://127.0.0.1:5000/ndarray_less_than",
    RemoteSolveVersion=(0, 1, 0),
    ShowInput_Enabled=False,
    ShowInput_Path=False,
    SynchronousSolve=True)  # -> Array1, Array2
ndarray_comparison = Hops(
    List1=panel_66,
    List2=panel_67,
    List3=panel_65,
    List4=panel_64,
    CacheResultsInMemory=True,
    CacheSolveResults=True,
    RemoteDefinitionLocation="http://127.0.0.1:5000/ndarray_comparison",
    RemoteSolveVersion=(0, 1, 0),
    ShowInput_Enabled=False,
    ShowInput_Path=False,
    SynchronousSolve=True)  # -> Array1, Array2
panel_68 = Panel(ndarray_comparison.Array1)
panel_69 = Panel(ndarray_comparison.Array2)
panel_70 = Panel(ndarray_less_than.Array1)
panel_71 = Panel(ndarray_less_than.Array2)
entwine_24 = Entwine(Branch00=panel_68, Branch01=panel_69, FlattenInputs=True)
entwine_25 = Entwine(Branch00=panel_70, Branch01=panel_71, FlattenInputs=True)
panel_72 = Panel(entwine_24)
panel_73 = Panel(entwine_25)
number_15 = Number(panel_65)
# LogicalFunctions
# logical_and function
# N-dimensional Array Objects
number_16 = Number(panel_66)
number_17 = Number(panel_67)
# logical_or function
# N-dimensional Array Objects
number_18 = Number(panel_64)
# Instructions:
# 1. Drag and drop a hops node on the canvas.
# 2. Set path to:
# http://127.0.0.1:5000/ndarray_logical_or
# 3. Name and toggle  component name to :
# ndarray_logical_or
ndarray_logical_or = Hops(
    List1=number_16,
    List2=number_17,
    List3=number_15,
    List4=number_18,
    CacheResultsInMemory=False,
    CacheSolveResults=False,
    RemoteDefinitionLocation="http://127.0.0.1:5000/ndarray_logical_or",
    RemoteSolveVersion=(0, 1, 0),
    ShowInput_Enabled=False,
    ShowInput_Path=False,
    SynchronousSolve=True)  # -> Array1, Array2
# Instructions:
# 1. Drag and drop a hops node on the canvas.
# 2. Set path to:
# http://127.0.0.1:5000/ndarray_logical_and_02
# 3. Name and toggle  component name to :
# ndarray_logical_and_02
ndarray_logical_and_02 = Hops(
    List1=number_16,
    List2=number_17,
    List3=number_15,
    List4=number_18,
    CacheResultsInMemory=False,
    CacheSolveResults=False,
    RemoteDefinitionLocation="http://127.0.0.1:5000/ndarray_logical_and_02",
    RemoteSolveVersion=(0, 1, 0),
    ShowInput_Enabled=False,
    ShowInput_Path=False,
    SynchronousSolve=True)  # -> Array1, Array2
panel_74 = Panel(ndarray_logical_and_02.Array2)
panel_75 = Panel(ndarray_logical_or.Array2)
panel_76 = Panel(ndarray_logical_and_02.Array1)
panel_77 = Panel(ndarray_logical_or.Array1)
entwine_26 = Entwine(Branch00=panel_76, Branch01=panel_74, FlattenInputs=True)
entwine_27 = Entwine(Branch00=panel_77, Branch01=panel_75, FlattenInputs=True)
panel_78 = Panel(entwine_26)
panel_79 = Panel(entwine_27)

# ----
# DATA VISUALIZATION
# greater function
# N-dimensional Array Objects
# less function
# N-dimensional Array Objects
# logical_and function
# N-dimensional Array Objects
# logical_or function
# N-dimensional Array Objects
panel_80 = Panel(panel_72)
panel_81 = Panel(panel_73)
panel_82 = Panel(panel_78)
panel_83 = Panel(panel_79)
