# Grasshopper definition AI_copilot_to_AI_stablediffusion_003.gh (Grasshopper 1.0.7)
# plug-ins: Hops, Fologram For Grasshopper Utilities

# From AI copilot to AI Stable Diffusion
# at www.wickersonstudios.com
# Python for Data Manipulation and Mudging
# NUMPY BASICS: Array and Vectorized
# Computation into Grasshopper for Generating
# Rhino3D Geometries
# HARD CODED
# INDEXING NDARRAY OF
# N-dimensional Array Objects
# #print(arr.list_to_tree()) not working in grasshopper canvas
# # use entwine node in gh to convert lists to tree
# 
# return arr.tolist()[0], arr.tolist()[1], arr.tolist()[2]
number_slider = Slider(0.25, range=0..1)
# bare SLICING NDARRAY OF
# N-dimensional Array Objects
# #print(arr.list_to_tree()) not working in grasshopper canvas
# # use entwine node in gh to convert lists to tree
# 
# return arr.tolist()[0], arr.tolist()[1], arr.tolist()[2]
gene_pool = GenePool(
    Decimals=2,
    Maximum=100,
    Minimum=0,
    Value=[92.51232398, 51.05836063, 95.6613231, 28.09343446, 99.59859387, 0, 93.3997062, 21.72031045, 18.19435708, 47.51848879])
# BROADCASTING  NDARRAY OF
# N-dimensional Array Objects
number_slider_2 = Slider(0.75, range=0..1)
# explicitly COPYING NDARRAY OF
# N-dimensional Array Objects
# #print(arr.list_to_tree()) not working in grasshopper canvas
# # use entwine node in gh to convert lists to tree
# 
# return arr.tolist()[0], arr.tolist()[1], arr.tolist()[2]
gene_pool_2 = GenePool(
    Decimals=2,
    Maximum=100,
    Minimum=0,
    Value=[92.51232398, 51.05836063, 95.6613231, 28.09343446, 99.59859387, 0, 93.3997062, 21.72031045, 18.19435708, 47.51848879])
# #print(arr.list_to_tree()) not working in grasshopper canvas
# # use entwine node in gh to convert lists to tree
# 
# return arr.tolist()[0], arr.tolist()[1], arr.tolist()[2]
gene_pool_3 = GenePool(
    Decimals=2,
    Maximum=100,
    Minimum=0,
    Value=[92.51232398, 51.05836063, 95.6613231, 28.09343446, 99.59859387, 0, 93.3997062, 21.72031045, 18.19435708, 47.51848879])
# Instructions:
# 1. Drag and drop a hops node on the canvas.
# 2. Set path to:
# http://127.0.0.1:5000/ndarray_slicing_03
# 3. Name and toggle  component name to :
# ndarray_slicing_03
ndarray_slicing_03 = Hops(
    List1=gene_pool,
    CacheResultsInMemory=True,
    CacheSolveResults=True,
    RemoteDefinitionLocation="http://127.0.0.1:5000/ndarray_slicing_03",
    RemoteSolveVersion=(0, 1, 0),
    ShowInput_Enabled=False,
    ShowInput_Path=False,
    SynchronousSolve=True)
# Instructions:
# 1. Drag and drop a hops node on the canvas.
# 2. Set path to:
# http://127.0.0.1:5000/ndarray_slicing_05
# 3. Name and toggle  component name to :
# ndarray_slicing_05
ndarray_slicing_05 = Hops(
    List1=gene_pool_2,
    CacheResultsInMemory=True,
    CacheSolveResults=True,
    RemoteDefinitionLocation="http://127.0.0.1:5000/ndarray_slicing_05",
    RemoteSolveVersion=(0, 1, 0),
    ShowInput_Enabled=False,
    ShowInput_Path=False,
    SynchronousSolve=True)
# Instructions:
# 1. Drag and drop a hops node on the canvas.
# 2. Set path to:
# http://127.0.0.1:5000/ndarray_slicing_01
# 3. Name and toggle  component name to :
# ndarray_slicing_01
ndarray_slicing_01 = Hops(
    List1=gene_pool_3,
    CacheResultsInMemory=True,
    CacheSolveResults=True,
    RemoteDefinitionLocation="http://127.0.0.1:5000/ndarray_slicing_01",
    RemoteSolveVersion=(0, 1, 0),
    ShowInput_Enabled=False,
    ShowInput_Path=False,
    SynchronousSolve=True)
panel = Panel([number_slider, Slider(1, range=0..1), Slider(0.25, range=0..1), Slider(1, range=0..1), Slider(0.25, range=0..1), Slider(1, range=0..1), Slider(0.25, range=0..1), number_slider_2])
panel_2 = Panel(ndarray_slicing_03)
panel_3 = Panel(ndarray_slicing_05)
panel_4 = Panel(ndarray_slicing_01)
# Instructions:
# 1. Drag and drop a hops node on the canvas.
# 2. Set path to:
# http://127.0.0.1:5000/ndarray_indexing_01
# 3. Name and toggle  component name to :
# ndarray_indexing_01
ndarray_indexing_01 = Hops(
    List1=panel,
    CacheResultsInMemory=True,
    CacheSolveResults=True,
    RemoteDefinitionLocation="http://127.0.0.1:5000/ndarray_indexing_01",
    RemoteSolveVersion=(0, 1, 0),
    ShowInput_Enabled=False,
    ShowInput_Path=False,
    SynchronousSolve=True)
panel_5 = Panel(ndarray_indexing_01)
start = Slider(2, range=0..10)
stop = Slider(9, range=0..10)
# explicitly COPYING NDARRAY OF
# N-dimensional Array Objects
number_slider_3 = Slider(3.09, range=0..10)
# #print(arr.list_to_tree()) not working in grasshopper canvas
# # use entwine node in gh to convert lists to tree
# 
# return arr.tolist()[0], arr.tolist()[1], arr.tolist()[2]
gene_pool_4 = GenePool(
    Decimals=2,
    Maximum=100,
    Minimum=0,
    Value=[92.51232398, 51.05836063, 95.6613231, 28.09343446, 99.59859387, 30.79035894, 93.3997062, 21.72031045, 18.19435708, 47.51848879])
start_2 = Slider(0, range=0..10)
stop_2 = Slider(5, range=0..10)
step = Slider(2, range=0..10)
start_3 = Slider(0, range=0..10)
stop_3 = Slider(5, range=0..10)
# bare SLICING NDARRAY OF
# N-dimensional Array Objects
number_slider_4 = Slider(4.45, range=0..10)
# #print(arr.list_to_tree()) not working in grasshopper canvas
# # use entwine node in gh to convert lists to tree
# 
# return arr.tolist()[0], arr.tolist()[1], arr.tolist()[2]
gene_pool_5 = GenePool(
    Decimals=2,
    Maximum=100,
    Minimum=0,
    Value=[92.51232398, 51.05836063, 95.6613231, 28.09343446, 99.59859387, 30.79035894, 93.3997062, 21.72031045, 18.19435708, 47.51848879])
# #print(arr.list_to_tree()) not working in grasshopper canvas
# # use entwine node in gh to convert lists to tree
# 
# return arr.tolist()[0], arr.tolist()[1], arr.tolist()[2]
gene_pool_6 = GenePool(
    Decimals=2,
    Maximum=100,
    Minimum=0,
    Value=[92.51232398, 51.05836063, 95.6613231, 28.09343446, 99.59859387, 30.79035894, 93.3997062, 21.72031045, 18.19435708, 47.51848879])
# PARAMETRIC
# INDEXING NDARRAY OF
# N-dimensional Array Objects
# #print(arr.list_to_tree()) not working in grasshopper canvas
# # use entwine node in gh to convert lists to tree
# 
# return arr.tolist()[0], arr.tolist()[1], arr.tolist()[2]
number_slider_5 = Slider(0.25, range=0..1)
start_4 = Slider(1, range=0..10)
stop_4 = Slider(5, range=0..10)
# BROADCASTING  NDARRAY OF
# N-dimensional Array Objects
step_2 = Slider(1, range=0..10)
# Instructions:
# 1. Drag and drop a hops node on the canvas.
# 2. Set path to:
# http://127.0.0.1:5000/ndarray_slicing_04
# 3. Name and toggle  component name to :
# ndarray_slicing_04
ndarray_slicing_04 = Hops(
    List1=gene_pool_4,
    Start=start,
    Stop=stop,
    Value=number_slider_3,
    CacheResultsInMemory=True,
    CacheSolveResults=True,
    RemoteDefinitionLocation="http://127.0.0.1:5000/ndarray_slicing_04",
    RemoteSolveVersion=(0, 1, 0),
    ShowInput_Enabled=False,
    ShowInput_Path=False,
    SynchronousSolve=True)
# Instructions:
# 1. Drag and drop a hops node on the canvas.
# 2. Set path to:
# http://127.0.0.1:5000/ndarray_slicing_06
# 3. Name and toggle  component name to :
# ndarray_slicing_06
ndarray_slicing_06 = Hops(
    List1=gene_pool_5,
    Start=start_2,
    Stop=stop_2,
    Value=Slider(4.65, range=0..10),
    CacheResultsInMemory=True,
    CacheSolveResults=True,
    RemoteDefinitionLocation="http://127.0.0.1:5000/ndarray_slicing_06",
    RemoteSolveVersion=(0, 1, 0),
    ShowInput_Enabled=False,
    ShowInput_Path=False,
    SynchronousSolve=True)
# Instructions:
# 1. Drag and drop a hops node on the canvas.
# 2. Set path to:
# http://127.0.0.1:5000/ndarray_slicing_02
# 3. Name and toggle  component name to :
# ndarray_slicing_02
ndarray_slicing_02 = Hops(
    List1=gene_pool_6,
    Start=start_3,
    Stop=stop_3,
    Index=step,
    Value=number_slider_4,
    CacheResultsInMemory=True,
    CacheSolveResults=True,
    RemoteDefinitionLocation="http://127.0.0.1:5000/ndarray_slicing_02",
    RemoteSolveVersion=(0, 1, 0),
    ShowInput_Enabled=False,
    ShowInput_Path=False,
    SynchronousSolve=True)
panel_6 = Panel([number_slider_5, Slider(1, range=0..1), Slider(0.25, range=0..1), Slider(1, range=0..1), Slider(0.25, range=0..1), Slider(1, range=0..1), Slider(0.25, range=0..1), Slider(0.75, range=0..1)])
panel_7 = Panel(ndarray_slicing_04)
panel_8 = Panel(ndarray_slicing_06)
panel_9 = Panel(ndarray_slicing_02)
# Instructions:
# 1. Drag and drop a hops node on the canvas.
# 2. Set path to:
# http://127.0.0.1:5000/ndarray_indexing_04
# 3. Name and toggle  component name to :
# ndarray_indexing_04
ndarray_indexing_04 = Hops(
    List1=panel_6,
    Start=start_4,
    Stop=stop_4,
    Step=step_2,
    CacheResultsInMemory=False,
    CacheSolveResults=False,
    RemoteDefinitionLocation="http://127.0.0.1:5000/ndarray_indexing_04",
    RemoteSolveVersion=(0, 1, 0),
    ShowInput_Enabled=False,
    ShowInput_Path=False,
    SynchronousSolve=True)
panel_10 = Panel(ndarray_indexing_04)
# SLICING  2DARRAY OF
# N-dimensional Array Objects
# #print(arr.list_to_tree()) not working in grasshopper canvas
# # use entwine node in gh to convert lists to tree
# 
# return arr.tolist()[0], arr.tolist()[1], arr.tolist()[2]
gene_pool_7 = GenePool(Decimals=1, Maximum=100, Minimum=0, Value=[92.51232398, 51.05836063, 95.6613231])
gene_pool_8 = GenePool(Decimals=1, Maximum=100, Minimum=0, Value=[37.04717003, 7.294234125, 74.73045922])
gene_pool_9 = GenePool(Decimals=1, Maximum=100, Minimum=0, Value=[87.96161075, 58.62227913, 94.3045215])
# INDEXING RECURSIVELY
# 2DARRAY OF
# N-dimensional Array Objects
# #print(arr.list_to_tree()) not working in grasshopper canvas
# # use entwine node in gh to convert lists to tree
# 
# return arr.tolist()[0], arr.tolist()[1], arr.tolist()[2]
gene_pool_10 = GenePool(Decimals=1, Maximum=100, Minimum=0, Value=[0, 11.2, 22.6])
gene_pool_11 = GenePool(Decimals=1, Maximum=100, Minimum=0, Value=[37.04717003, 53.8, 79.1])
gene_pool_12 = GenePool(Decimals=1, Maximum=100, Minimum=0, Value=[83.7, 91.2, 100])
# Instructions:
# 1. Drag and drop a hops node on the canvas.
# 2. Set path to:
# http://127.0.0.1:5000/2d_ndarray_indexing_03
# 3. Name and toggle  component name to :
# 2d_ndarray_indexing_03
_2d_ndarray_indexing_03 = Hops(
    List1=gene_pool_7,
    List2=gene_pool_8,
    List3=gene_pool_9,
    Index=Slider(1, range=0..2),
    CacheResultsInMemory=True,
    CacheSolveResults=True,
    RemoteDefinitionLocation="http://127.0.0.1:5000/2d_ndarray_indexing_03",
    RemoteSolveVersion=(0, 1, 0),
    ShowInput_Enabled=False,
    ShowInput_Path=False,
    SynchronousSolve=True)  # -> Array1, Array2, Array3
# Instructions:
# 1. Drag and drop a hops node on the canvas.
# 2. Set path to:
# http://127.0.0.1:5000/2d_ndarray_indexing_05
# 3. Name and toggle  component name to :
# 2d_ndarray_indexing_05
_2d_ndarray_indexing_05 = Hops(
    List1=gene_pool_10,
    List2=gene_pool_11,
    List3=gene_pool_12,
    Index=Slider(2, range=0..2),
    Element=Slider(2, range=0..2),
    CacheResultsInMemory=True,
    CacheSolveResults=True,
    RemoteDefinitionLocation="http://127.0.0.1:5000/2d_ndarray_indexing_05",
    RemoteSolveVersion=(0, 1, 0),
    ShowInput_Enabled=False,
    ShowInput_Path=False,
    SynchronousSolve=True)
entwine = Entwine(
    Branch00=_2d_ndarray_indexing_03.Array1,
    Branch01=_2d_ndarray_indexing_03.Array2,
    Branch02=_2d_ndarray_indexing_03.Array3,
    FlattenInputs=True)
panel_11 = Panel(_2d_ndarray_indexing_05)
panel_12 = Panel(entwine)
# INDEXING recursively
# 3DARRAY OF
# N-dimensional Array Objects
number_slider_6 = Slider(1, range=0..1)
# HARD CODED
# INDEXING AND SLICING
# 3DARRAY OF
# N-dimensional Array Objects
number_slider_7 = Slider(1, range=0..2)
# INDEXING
# 3DARRAY OF
# N-dimensional Array Objects
# #print(arr.list_to_tree()) not working in grasshopper canvas
# # use entwine node in gh to convert lists to tree
# 
# return arr.tolist()[0], arr.tolist()[1], arr.tolist()[2]
gene_pool_13 = GenePool(Decimals=0, Maximum=12, Minimum=0, Value=[1, 2, 3])
gene_pool_14 = GenePool(Decimals=0, Maximum=12, Minimum=0, Value=[4, 5, 6])
gene_pool_15 = GenePool(Decimals=0, Maximum=12, Minimum=0, Value=[7, 8, 9])
gene_pool_16 = GenePool(Decimals=0, Maximum=12, Minimum=0, Value=[10, 11, 12])
# #print(arr.list_to_tree()) not working in grasshopper canvas
# # use entwine node in gh to convert lists to tree
# 
# return arr.tolist()[0], arr.tolist()[1], arr.tolist()[2]
gene_pool_17 = GenePool(Decimals=0, Maximum=12, Minimum=0, Value=[1, 2, 3])
gene_pool_18 = GenePool(Decimals=0, Maximum=12, Minimum=0, Value=[4, 5, 6])
gene_pool_19 = GenePool(Decimals=0, Maximum=12, Minimum=0, Value=[7, 8, 9])
gene_pool_20 = GenePool(Decimals=0, Maximum=12, Minimum=0, Value=[10, 11, 12])
gene_pool_21 = GenePool(Decimals=0, Maximum=12, Minimum=0, Value=[10, 11, 12])
# #print(arr.list_to_tree()) not working in grasshopper canvas
# # use entwine node in gh to convert lists to tree
# 
# return arr.tolist()[0], arr.tolist()[1], arr.tolist()[2]
gene_pool_22 = GenePool(Decimals=0, Maximum=12, Minimum=0, Value=[1, 2, 3])
gene_pool_23 = GenePool(Decimals=0, Maximum=12, Minimum=0, Value=[4, 5, 6])
gene_pool_24 = GenePool(Decimals=0, Maximum=12, Minimum=0, Value=[7, 8, 9])
# Instructions:
# 1. Drag and drop a hops node on the canvas.
# 2. Set path to:
# http://127.0.0.1:5000/3d_ndarray_indexing_02d
# 3. Name and toggle  component name to :
# 3d_ndarray_indexing_02d
_3d_ndarray_indexing_02d = Hops(
    List1=gene_pool_17,
    List2=gene_pool_18,
    List3=gene_pool_19,
    List4=gene_pool_20,
    Index1=Slider(0, range=0..1),
    Index2=Slider(1, range=0..1),
    Element=number_slider_7,
    CacheResultsInMemory=False,
    CacheSolveResults=False,
    RemoteDefinitionLocation="http://127.0.0.1:5000/3d_ndarray_indexing_02d",
    RemoteSolveVersion=(0, 1, 0),
    ShowInput_Enabled=False,
    ShowInput_Path=False,
    SynchronousSolve=True)
_3d_ndarray_indexing_02c = Hops(
    List1=gene_pool_13,
    List2=gene_pool_14,
    List3=gene_pool_15,
    List4=gene_pool_16,
    Index1=Slider(0, range=0..1),
    Index2=number_slider_6,
    CacheResultsInMemory=True,
    CacheSolveResults=True,
    RemoteDefinitionLocation="http://127.0.0.1:5000/3d_ndarray_indexing_02c",
    RemoteSolveVersion=(0, 1, 0),
    ShowInput_Enabled=False,
    ShowInput_Path=False,
    SynchronousSolve=True)
# Instructions:
# 1. Drag and drop a hops node on the canvas.
# 2. Set path to:
# http://127.0.0.1:5000/3d_ndarray_slicing_01c
# 3. Name and toggle  component name to :
# 3d_ndarray_slicing_01c
_3d_ndarray_slicing_01c = Hops(
    List1=gene_pool_22,
    List2=gene_pool_23,
    List3=gene_pool_24,
    List4=gene_pool_21,
    Index1=Slider(0, range=0..1),
    Index2=Slider(1, range=0..1),
    CacheResultsInMemory=False,
    CacheSolveResults=False,
    RemoteDefinitionLocation="http://127.0.0.1:5000/3d_ndarray_slicing_01c",
    RemoteSolveVersion=(0, 1, 0),
    ShowInput_Enabled=False,
    ShowInput_Path=False,
    SynchronousSolve=True)
panel_13 = Panel(_3d_ndarray_indexing_02d)
# #print(arr.list_to_tree()) not working in grasshopper canvas
# # use entwine node in gh to convert lists to tree
# 
# return arr.tolist()[0], arr.tolist()[1], arr.tolist()[2]
# Instructions:
# 1. Drag and drop a hops node on the canvas.
# 2. Set path to:
# http://127.0.0.1:5000/3d_ndarray_indexing_02c
# 3. Name and toggle  component name to :
# 3d_ndarray_indexing_02c
panel_14 = Panel(_3d_ndarray_indexing_02c)
panel_15 = Panel(_3d_ndarray_slicing_01c)
axis0 = Slider(1, range=0..1)
axis1 = Slider(1, range=0..1)
gene_pool_25 = GenePool(Decimals=0, Maximum=12, Minimum=0, Value=[10, 11, 12])
box = Slider(2, range=1..3)
# PARAMETRIC
# INDEXING AND SLICING
# 3DARRAY OF
# N-dimensional Array Objects
# #print(arr.list_to_tree()) not working in grasshopper canvas
# # use entwine node in gh to convert lists to tree
# 
# return arr.tolist()[0], arr.tolist()[1], arr.tolist()[2]
gene_pool_26 = GenePool(Decimals=0, Maximum=12, Minimum=0, Value=[1, 2, 3])
gene_pool_27 = GenePool(Decimals=0, Maximum=12, Minimum=0, Value=[4, 5, 6])
gene_pool_28 = GenePool(Decimals=0, Maximum=12, Minimum=0, Value=[7, 8, 9])
# Instructions:
# 1. Drag and drop a hops node on the canvas.
# 2. Set path to:
# http://127.0.0.1:5000/3d_ndarray_slicing_01e
# 3. Name and toggle  component name to :
# 3d_ndarray_slicing_01e
_3d_ndarray_slicing_01e = Hops(
    List1=gene_pool_26,
    List2=gene_pool_27,
    List3=gene_pool_28,
    List4=gene_pool_25,
    Index1=axis0,
    Index2=axis1,
    Index3=box,
    CacheResultsInMemory=False,
    CacheSolveResults=False,
    RemoteDefinitionLocation="http://127.0.0.1:5000/3d_ndarray_slicing_01e",
    RemoteSolveVersion=(0, 1, 0),
    ShowInput_Enabled=False,
    ShowInput_Path=False,
    SynchronousSolve=True)
panel_16 = Panel(_3d_ndarray_slicing_01e)

# ----
# DATA VISUALIZATION
construct_point = ConstructPoint(XCoordinate=panel_16, YCoordinate=graft(panel_16), ZCoordinate=0)  # -> graft(Point)
construct_point_2 = ConstructPoint(XCoordinate=0, YCoordinate=0, ZCoordinate=0)
list_length = ListLength(List=construct_point)
unit_z = UnitZ(Factor=list_length)
move = Move(Geometry=construct_point, Motion=unit_z)  # -> Geometry, Transform
line = Line(StartPoint=construct_point_2, EndPoint=move.Geometry)
line_2 = Line(StartPoint=construct_point_2, EndPoint=construct_point)
line_3 = Line(StartPoint=construct_point, EndPoint=move.Geometry)
join_curves = JoinCurves(Curves=[line_2, line_3, line], Preserve=False)
list_length_2 = ListLength(List=flatten(join_curves))
range = Range(Domain=Slider(1.9, range=0..2), Steps=expr("x-1", list_length_2))
pi = Pi(Factor=range)
rotate_3d = Rotate3D(Geometry=join_curves, Angle=graft(pi), Center=Point(0, 0, 0), Axis=Vector(0, 0, 1))  # -> Geometry, Transform
loft = Loft(
    Curves=flatten(rotate_3d.Geometry),
    Options={Adjust=False, Closed=True, LoftEnds=0, LoftSimp=0, LoftType=0, Rebuild=10, Refit=0.01})

# ----
# INDEXING  with SLICING OF
# 2-dimensional Array Objects
number_slider_8 = Slider(1, range=0..10)
# INDEXING  with SLICING STEP OF
# 3-dimensional Array Objects
number_slider_9 = Slider(1, range=0..10)
# INDEXING  with SLICING STEP OF
# 2-dimensional Array Objects
number_slider_10 = Slider(1, range=0..10)
gene_pool_29 = GenePool(Decimals=0, Maximum=10, Minimum=0, Value=[0, 1, 2, 3, 4, 5, 6, 7, 8, 9])
# INDEXING  with SLICING STEP OF
# 1-dimensional Array Objects
number_slider_11 = Slider(3, range=0..3)
# Instructions:
# 1. Drag and drop a hops node on the canvas.
# 2. Set path to:
# http://127.0.0.1:5000/ndarray_indexSlice_6
# 3. Name and toggle  component name to :
# ndarray_indexSlice_6
panel_17 = Panel([number_slider_8, Slider(2, range=0..10), Slider(3, range=0..10)])
panel_18 = Panel([Slider(7, range=0..10), Slider(8, range=0..10), Slider(9, range=0..10)])
panel_19 = Panel([Slider(4, range=0..10), Slider(5, range=0..10), Slider(6, range=0..10)])
panel_20 = Panel([number_slider_9, Slider(2, range=0..10), Slider(3, range=0..10)])
panel_21 = Panel([Slider(4, range=0..10), Slider(5, range=0..10), Slider(6, range=0..10)])
panel_22 = Panel([Slider(7, range=0..10), Slider(8, range=0..10), Slider(9, range=0..10)])
panel_23 = Panel([Slider(10, range=0..10), Slider(11, range=0..11), Slider(12, range=0..12)])
panel_24 = Panel([number_slider_10, Slider(2, range=0..10), Slider(3, range=0..10)])
panel_25 = Panel([Slider(7, range=0..10), Slider(8, range=0..10), Slider(9, range=0..10)])
panel_26 = Panel([Slider(4, range=0..10), Slider(5, range=0..10), Slider(6, range=0..10)])
panel_27 = Panel(gene_pool_29)
ndarray_indexslice_6 = Hops(
    List1=panel_17,
    List2=panel_19,
    List3=panel_18,
    Start0=Slider(0, range=0..3),
    End0=Slider(3, range=0..3),
    Start1=Slider(0, range=0..3),
    End1=number_slider_11,
    CacheResultsInMemory=True,
    CacheSolveResults=True,
    RemoteDefinitionLocation="http://127.0.0.1:5000/ndarray_indexSlice_6",
    RemoteSolveVersion=(0, 1, 0),
    ShowInput_Enabled=False,
    ShowInput_Path=False,
    SynchronousSolve=True)
ndarray_indexslice_8 = Hops(
    List1=panel_27,
    Start=Slider(2, range=0..10),
    End=Slider(8, range=0..10),
    Step=Slider(2, range=0..10),
    CacheResultsInMemory=True,
    CacheSolveResults=True,
    RemoteDefinitionLocation="http://127.0.0.1:5000/ndarray_indexSlice_8",
    RemoteSolveVersion=(0, 1, 0),
    ShowInput_Enabled=False,
    ShowInput_Path=False,
    SynchronousSolve=True)
# Instructions:
# 1. Drag and drop a hops node on the canvas.
# 2. Set path to:
# http://127.0.0.1:5000/ndarray_indexSlice_10
# 3. Name and toggle  component name to :
# ndarray_indexSlice_10
ndarray_indexslice_10 = Hops(
    List1=panel_24,
    List2=panel_26,
    List3=panel_25,
    Start0=Slider(0, range=0..3),
    End0=Slider(3, range=0..3),
    Step0=Slider(1, range=0..3),
    Start1=Slider(0, range=0..3),
    End1=Slider(3, range=0..3),
    Step1=Slider(1, range=0..3),
    CacheResultsInMemory=False,
    CacheSolveResults=False,
    RemoteDefinitionLocation="http://127.0.0.1:5000/ndarray_indexSlice_10",
    RemoteSolveVersion=(0, 1, 0),
    ShowInput_Enabled=False,
    ShowInput_Path=False,
    SynchronousSolve=True)
# Instructions:
# 1. Drag and drop a hops node on the canvas.
# 2. Set path to:
# http://127.0.0.1:5000/ndarray_indexSlice_19
# 3. Name and toggle  component name to :
# ndarray_indexSlice_19
ndarray_indexslice_19 = Hops(
    List1=panel_20,
    List2=panel_21,
    List3=panel_22,
    List4=panel_23,
    CacheResultsInMemory=True,
    CacheSolveResults=True,
    RemoteDefinitionLocation="http://127.0.0.1:5000/ndarray_indexSlice_19",
    RemoteSolveVersion=(0, 1, 0),
    ShowInput_Enabled=False,
    ShowInput_Path=False,
    SynchronousSolve=True)
panel_28 = Panel(ndarray_indexslice_6)
# Instructions:
# 1. Drag and drop a hops node on the canvas.
# 2. Set path to:
# http://127.0.0.1:5000/ndarray_indexSlice_8
# 3. Name and toggle  component name to :
# ndarray_indexSlice_8
panel_29 = Panel(ndarray_indexslice_8)
panel_30 = Panel(ndarray_indexslice_10)
panel_31 = Panel(ndarray_indexslice_19)

# ----
# INDEXING  with SLICING OF
# 1-dimensional Array Objects
# Instructions:
# 1. Drag and drop a hops node on the canvas.
# 2. Set path to:
# http://127.0.0.1:5000/ndarray_indexSlice_2b
# 3. Name and toggle  component name to :
# ndarray_indexSlice_2b
# Instructions:
# 1. Drag and drop a hops node on the canvas.
# 2. Set path to:
# http://127.0.0.1:5000/ndarray_indexSlice_4
# 3. Name and toggle  component name to :
# ndarray_indexSlice_4
# INDEXING  with SLICING OF
# 2-dimensional Array Objects
# INDEXING  with SLICING OF
# 2-dimensional Array Objects
# Instructions:
# 1. Drag and drop a hops node on the canvas.
# 2. Set path to:
# http://127.0.0.1:5000/ndarray_indexSlice_6b
# 3. Name and toggle  component name to :
# ndarray_indexSlice_6b
# INDEXING  with SLICING STEP OF
# 1-dimensional Array Objects
# Instructions:
# 1. Drag and drop a hops node on the canvas.
# 2. Set path to:
# http://127.0.0.1:5000/ndarray_indexSlice_8c
# 3. Name and toggle  component name to :
# ndarray_indexSlice_8c
# INDEXING  with SLICING STEP OF
# 2-dimensional Array Objects
# Instructions:
# 1. Drag and drop a hops node on the canvas.
# 2. Set path to:
# http://127.0.0.1:5000/ndarray_indexSlice_10d
# 3. Name and toggle  component name to :
# ndarray_indexSlice_10d
# INDEXING  with SLICING STEP OF
# 3-dimensional Array Objects
# Instructions:
# 1. Drag and drop a hops node on the canvas.
# 2. Set path to:
# http://127.0.0.1:5000/ndarray_indexSlice_19d
# 3. Name and toggle  component name to :
# ndarray_indexSlice_19d
number_slider_12 = Slider(1, range=0..10)
gene_pool_30 = GenePool(Decimals=0, Maximum=10, Minimum=0, Value=[0, 1, 2, 3, 4, 5, 6, 7, 8, 9])
gene_pool_31 = GenePool(Decimals=0, Maximum=10, Minimum=0, Value=[0, 1, 2, 3, 4, 5, 6, 7, 8, 9])
panel_32 = Panel([Slider(1, range=0..10), Slider(2, range=0..10), Slider(3, range=0..10)])
panel_33 = Panel([Slider(4, range=0..10), Slider(5, range=0..10), Slider(6, range=0..10)])
panel_34 = Panel([Slider(7, range=0..10), Slider(8, range=0..10), Slider(9, range=0..10)])
panel_35 = Panel([number_slider_12, Slider(2, range=0..10), Slider(3, range=0..10)])
panel_36 = Panel([Slider(4, range=0..10), Slider(5, range=0..10), Slider(6, range=0..10)])
panel_37 = Panel([Slider(7, range=0..10), Slider(8, range=0..10), Slider(9, range=0..10)])
panel_38 = Panel(gene_pool_30)
panel_39 = Panel(gene_pool_31)
panel_40 = Panel([Slider(1, range=0..10), Slider(2, range=0..10), Slider(3, range=0..10)])
panel_41 = Panel([Slider(4, range=0..10), Slider(5, range=0..10), Slider(6, range=0..10)])
panel_42 = Panel([Slider(7, range=0..10), Slider(8, range=0..10), Slider(9, range=0..10)])
panel_43 = Panel([Slider(10, range=0..10), Slider(11, range=0..11), Slider(12, range=0..12)])
panel_44 = Panel([Slider(1, range=0..10), Slider(2, range=0..10), Slider(3, range=0..10)])
panel_45 = Panel([Slider(4, range=0..10), Slider(5, range=0..10), Slider(6, range=0..10)])
panel_46 = Panel([Slider(7, range=0..10), Slider(8, range=0..10), Slider(9, range=0..10)])
ndarray_indexslice_2b = Hops(
    List1=panel_38,
    Start=Slider(2, range=0..10),
    End=Slider(8, range=0..10),
    CacheResultsInMemory=True,
    CacheSolveResults=True,
    RemoteDefinitionLocation="http://127.0.0.1:5000/ndarray_indexSlice_2b",
    RemoteSolveVersion=(0, 1, 0),
    ShowInput_Enabled=False,
    ShowInput_Path=False,
    SynchronousSolve=True)
ndarray_indexslice_4 = Hops(
    List1=panel_32,
    List2=panel_33,
    List3=panel_34,
    Start0=Slider(0, range=0..2),
    End0=Slider(1, range=0..2),
    CacheResultsInMemory=False,
    CacheSolveResults=False,
    RemoteDefinitionLocation="http://127.0.0.1:5000/ndarray_indexSlice_4",
    RemoteSolveVersion=(0, 1, 0),
    ShowInput_Enabled=False,
    ShowInput_Path=False,
    SynchronousSolve=True)
ndarray_indexslice_6b = Hops(
    List1=panel_35,
    List2=panel_36,
    List3=panel_37,
    Start1=Slider(0, range=0..3),
    End1=Slider(3, range=0..3),
    CacheResultsInMemory=True,
    CacheSolveResults=True,
    RemoteDefinitionLocation="http://127.0.0.1:5000/ndarray_indexSlice_6b",
    RemoteSolveVersion=(0, 1, 0),
    ShowInput_Enabled=False,
    ShowInput_Path=False,
    SynchronousSolve=True)  # -> Array1, Array2, Array3
ndarray_indexslice_8c = Hops(
    List1=panel_39,
    Start=Slider(3, range=0..10),
    End=Slider(7, range=0..10),
    Step=Slider(2, range=0..10),
    CacheResultsInMemory=True,
    CacheSolveResults=True,
    RemoteDefinitionLocation="http://127.0.0.1:5000/ndarray_indexSlice_8c",
    RemoteSolveVersion=(0, 1, 0),
    ShowInput_Enabled=False,
    ShowInput_Path=False,
    SynchronousSolve=True)
ndarray_indexslice_10d = Hops(
    List1=panel_44,
    List2=panel_45,
    List3=panel_46,
    Start1=Slider(0, range=0..3),
    End1=Slider(2, range=0..3),
    Step1=Slider(1, range=0..3),
    CacheResultsInMemory=True,
    CacheSolveResults=True,
    RemoteDefinitionLocation="http://127.0.0.1:5000/ndarray_indexSlice_10d",
    RemoteSolveVersion=(0, 1, 0),
    ShowInput_Enabled=False,
    ShowInput_Path=False,
    SynchronousSolve=True)  # -> Array1, Array2, Array3
ndarray_indexslice_19d = Hops(
    List1=panel_40,
    List2=panel_41,
    List3=panel_42,
    List4=panel_43,
    CacheResultsInMemory=True,
    CacheSolveResults=True,
    RemoteDefinitionLocation="http://127.0.0.1:5000/ndarray_indexSlice_19d",
    RemoteSolveVersion=(0, 1, 0),
    ShowInput_Enabled=False,
    ShowInput_Path=False,
    SynchronousSolve=True)  # -> Array1, Array2, Array3, Array4
entwine_2 = Entwine(
    Branch00=ndarray_indexslice_6b.Array1,
    Branch01=ndarray_indexslice_6b.Array2,
    Branch02=ndarray_indexslice_6b.Array3,
    FlattenInputs=True)
panel_47 = Panel(ndarray_indexslice_4)
panel_48 = Panel(ndarray_indexslice_2b)
entwine_3 = Entwine(
    Branch00=ndarray_indexslice_10d.Array1,
    Branch01=ndarray_indexslice_10d.Array2,
    Branch02=ndarray_indexslice_10d.Array3,
    FlattenInputs=True)
entwine_4 = Entwine(
    Branch00=ndarray_indexslice_19d.Array1,
    Branch01=ndarray_indexslice_19d.Array2,
    Branch02=ndarray_indexslice_19d.Array3,
    Branch03=ndarray_indexslice_19d.Array4,
    FlattenInputs=True)
panel_49 = Panel(ndarray_indexslice_8c)
panel_50 = Panel(entwine_2)
panel_51 = Panel(entwine_3)
panel_52 = Panel(entwine_4)

# ----
# INDEXING  with SLICING STEP OF
# 3-dimensional Array Objects
# Instructions:
# 1. Drag and drop a hops node on the canvas.
# 2. Set path to:
# http://127.0.0.1:5000/ndarray_indexSlice_20m
# 3. Name and toggle  component name to :
# ndarray_indexSlice_20m
gene_pool_32 = GenePool(Decimals=0, Maximum=12, Minimum=1, Value=[1, 2, 3.120559657, 4, 5, 6, 7, 8, 9, 10, 11, 12])
explode_tree = ExplodeTree(Data=graft(gene_pool_32))  # -> Branch0, Branch1, Branch2, Branch3, Branch4, Branch5, Branch6, Branch7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
ee = Slider(2, range=0..3)
se = Slider(0, range=0..2)
ee_2 = Slider(3, range=0..3)
panel_53 = Panel([explode_tree.Branch0, explode_tree.Branch1, explode_tree.Branch2])
panel_54 = Panel([explode_tree.Branch6, explode_tree.Branch7, explode_tree.Branch8])
panel_55 = Panel([explode_tree.Branch9, explode_tree.Branch10, explode_tree.Branch11])
panel_56 = Panel([explode_tree.Branch3, explode_tree.Branch4, explode_tree.Branch5])
ndarray_indexslice_20m = Hops(
    List1=flatten(panel_53),
    List2=flatten(panel_56),
    List3=flatten(panel_54),
    List4=flatten(panel_55),
    ES=se,
    EE=ee_2,
    Step=ee,
    CacheResultsInMemory=True,
    CacheSolveResults=True,
    RemoteDefinitionLocation="http://127.0.0.1:5000/ndarray_indexSlice_20m",
    RemoteSolveVersion=(0, 1, 0),
    ShowInput_Enabled=False,
    ShowInput_Path=False,
    SynchronousSolve=True)  # -> Array1, Array2, Array3, Array4
entwine_5 = Entwine(
    Branch00=ndarray_indexslice_20m.Array1,
    Branch01=ndarray_indexslice_20m.Array2,
    Branch02=ndarray_indexslice_20m.Array3,
    Branch03=ndarray_indexslice_20m.Array4,
    FlattenInputs=True)
panel_57 = Panel(entwine_5)

# ----
# INDEXING  with SLICING STEP OF
# 3-dimensional Array Objects
number_slider_13 = Slider(1, range=0..10)

# ----
# DATA VISUALIZATION
list_length_3 = ListLength(List=flatten(panel_57))
number_slider_14 = Slider(100, range=0..100)
square = Square(Plane=PlaneXY(0, 0, 0), Size=panel_57, ExtentX=list_length_3, ExtentY=list_length_3)  # -> Cells, Points
list_length_4 = ListLength(List=flatten(square.Cells))
range_2 = Range(Domain=number_slider_14, Steps=expr("x-1", list_length_4))
unit_z_2 = UnitZ(Factor=range_2)
move_2 = Move(Geometry=graft(square.Cells), Motion=graft(unit_z_2))  # -> Geometry, Transform
area = Area(Geometry=move_2.Geometry)  # -> Area, Centroid
construct_point_3 = ConstructPoint(XCoordinate=0, YCoordinate=0, ZCoordinate=0)
explode = Explode(Curve=move_2.Geometry, Recursive=True)  # -> Segments, Vertices
unit_z_3 = UnitZ(Factor=Slider(-10, range=-10..0))
move_3 = Move(Geometry=area.Centroid, Motion=unit_z_3)  # -> Geometry, Transform
multiplication = Multiplication(A=number_slider_14, B="3")
curve = Curve(move_2.Geometry)
line_4 = Line(StartPoint=move_3.Geometry, EndPoint=explode.Vertices)
line_5 = Line(StartPoint=construct_point_3, EndPoint=move_3.Geometry)
number_slider_15 = Slider(1, range=0..2)
join_curves_2 = JoinCurves(Curves=[curve, line_5, line_4], Preserve=False)  # -> graft(Curves)
polygon = Polygon(Plane=PlaneXY(0, 0, 0), Radius=multiplication, Segments=6, FilletRadius=0)  # -> Polygon, Length
mesh_pipe = MeshPipe(
    Polylines=graft(join_curves_2),
    NumberOfSides=4,
    Tolerance=0.1,
    Radius=Slider(1.19, range=0..10),
    Cap=number_slider_15,
    Join=number_slider_15)
boundary_surfaces = BoundarySurfaces(Edges=polygon.Polygon)

# ----
# INDEXING  with SLICING STEP OF
# 3-dimensional Array Objects
# Instructions:
# 1. Drag and drop a hops node on the canvas.
# 2. Set path to:
# http://127.0.0.1:5000/ndarray_indexSlice_20b
# 3. Name and toggle  component name to :
# ndarray_indexSlice_20b
number_slider_16 = Slider(1, range=0..10)
number_slider_17 = Slider(1, range=0..3)
number_slider_18 = Slider(0, range=0..3)
number_slider_19 = Slider(3, range=0..3)
panel_58 = Panel([number_slider_16, Slider(2, range=0..10), Slider(3, range=0..10)])
panel_59 = Panel([Slider(4, range=0..10), Slider(5, range=0..10), Slider(6, range=0..10)])
panel_60 = Panel([Slider(7, range=0..10), Slider(8, range=0..10), Slider(9, range=0..10)])
panel_61 = Panel([Slider(10, range=0..10), Slider(11, range=0..11), Slider(12, range=0..12)])
entwine_6 = Entwine(FlattenInputs=True)
panel_62 = Panel(entwine_6)

se_2 = Slider(0, range=0..2)
ee_3 = Slider(3, range=0..3)
se_3 = Slider(0, range=0..2)
ee_4 = Slider(1, range=0..3)
panel_63 = Panel([number_slider_13, Slider(2, range=0..10), Slider(3, range=0..10)])
panel_64 = Panel([Slider(4, range=0..10), Slider(5, range=0..10), Slider(6, range=0..10)])
panel_65 = Panel([Slider(7, range=0..10), Slider(8, range=0..10), Slider(9, range=0..10)])
panel_66 = Panel([Slider(10, range=0..10), Slider(11, range=0..11), Slider(12, range=0..12)])
# INDEXING  with SLICING STEP OF
# 3-dimensional Array Objects
panel_67 = Panel([Slider(1, range=0..10), Slider(2, range=0..10), Slider(3, range=0..10)])
panel_68 = Panel([Slider(4, range=0..10), Slider(5, range=0..10), Slider(6, range=0..10)])
panel_69 = Panel([Slider(7, range=0..10), Slider(8, range=0..10), Slider(9, range=0..10)])
panel_70 = Panel([Slider(10, range=0..10), Slider(11, range=0..11), Slider(12, range=0..12)])
# INDEXING  with SLICING STEP OF
# 3-dimensional Array Objects
panel_71 = Panel([Slider(1, range=0..10), Slider(2, range=0..10), Slider(3, range=0..10)])
panel_72 = Panel([Slider(7, range=0..10), Slider(8, range=0..10), Slider(9, range=0..10)])
panel_73 = Panel([Slider(4, range=0..10), Slider(5, range=0..10), Slider(6, range=0..10)])
panel_74 = Panel([Slider(10, range=0..10), Slider(11, range=0..11), Slider(12, range=0..12)])
# Instructions:
# 1. Drag and drop a hops node on the canvas.
# 2. Set path to:
# http://127.0.0.1:5000/ndarray_indexSlice_20f
# 3. Name and toggle  component name to :
# ndarray_indexSlice_20f
ndarray_indexslice_20f = Hops(
    List1=panel_63,
    List2=panel_64,
    List3=panel_65,
    List4=panel_66,
    Element=Slider(1, range=0..2),
    CacheResultsInMemory=True,
    CacheSolveResults=True,
    RemoteDefinitionLocation="http://127.0.0.1:5000/ndarray_indexSlice_20f",
    RemoteSolveVersion=(0, 1, 0),
    ShowInput_Enabled=False,
    ShowInput_Path=False,
    SynchronousSolve=True)  # -> Array1, Array2, Array3, Array4
# Instructions:
# 1. Drag and drop a hops node on the canvas.
# 2. Set path to:
# http://127.0.0.1:5000/ndarray_indexSlice_20g
# 3. Name and toggle  component name to :
# ndarray_indexSlice_20g
ndarray_indexslice_20g = Hops(
    List1=panel_67,
    List2=panel_68,
    List3=panel_69,
    List4=panel_70,
    ES=se_2,
    EE=ee_3,
    CacheResultsInMemory=True,
    CacheSolveResults=True,
    RemoteDefinitionLocation="http://127.0.0.1:5000/ndarray_indexSlice_20g",
    RemoteSolveVersion=(0, 1, 0),
    ShowInput_Enabled=False,
    ShowInput_Path=False,
    SynchronousSolve=True)  # -> Array1, Array2, Array3, Array4
# Instructions:
# 1. Drag and drop a hops node on the canvas.
# 2. Set path to:
# http://127.0.0.1:5000/ndarray_indexSlice_20h
# 3. Name and toggle  component name to :
# ndarray_indexSlice_20h
ndarray_indexslice_20h = Hops(
    List1=panel_71,
    List2=panel_73,
    List3=panel_72,
    List4=panel_74,
    ES=se_3,
    EE=ee_4,
    CacheResultsInMemory=True,
    CacheSolveResults=True,
    RemoteDefinitionLocation="http://127.0.0.1:5000/ndarray_indexSlice_20h",
    RemoteSolveVersion=(0, 1, 0),
    ShowInput_Enabled=False,
    ShowInput_Path=False,
    SynchronousSolve=True)  # -> Array1, Array2, Array3, Array4
entwine_7 = Entwine(
    Branch00=ndarray_indexslice_20f.Array1,
    Branch01=ndarray_indexslice_20f.Array2,
    Branch02=ndarray_indexslice_20f.Array3,
    Branch03=ndarray_indexslice_20f.Array4,
    FlattenInputs=True)
entwine_8 = Entwine(
    Branch00=ndarray_indexslice_20g.Array1,
    Branch01=ndarray_indexslice_20g.Array2,
    Branch02=ndarray_indexslice_20g.Array3,
    Branch03=ndarray_indexslice_20g.Array4,
    FlattenInputs=True)
entwine_9 = Entwine(
    Branch00=ndarray_indexslice_20h.Array1,
    Branch01=ndarray_indexslice_20h.Array2,
    Branch02=ndarray_indexslice_20h.Array3,
    Branch03=ndarray_indexslice_20h.Array4,
    FlattenInputs=True)
panel_75 = Panel(entwine_8)
panel_76 = Panel(entwine_9)
panel_77 = Panel(entwine_7)
# BOOLEAN INDEXING
# N-dimensional Array Objects
panel_78 = Panel("""Bob
Joe
Will
Bob""")
panel_79 = Panel("""4
7""")
panel_80 = Panel("""-5
6""")
panel_81 = Panel("""0
0""")
panel_82 = Panel("""0
2""")
# Instructions:
# 1. Drag and drop a hops node on the canvas.
# 2. Set path to:
# http://127.0.0.1:5000/ndarray_indexSlice_22
# 3. Name and toggle  component name to :
# ndarray_indexSlice_22
ndarray_indexslice_22 = Hops(
    Name=panel_78,
    List1=panel_79,
    List2=panel_82,
    List3=panel_80,
    List4=panel_81,
    CacheResultsInMemory=True,
    CacheSolveResults=True,
    RemoteDefinitionLocation="http://127.0.0.1:5000/ndarray_indexSlice_22",
    RemoteSolveVersion=(0, 1, 0),
    ShowInput_Enabled=False,
    ShowInput_Path=False,
    SynchronousSolve=True)
panel_83 = Panel(ndarray_indexslice_22)
# BOOLEAN INDEXING
# N-dimensional Array Objects
panel_84 = Panel("""Bob
Joe
Will
Bob""")
panel_85 = Panel("""4
7""")
panel_86 = Panel("""-5
6""")
number_slider_20 = Slider(5, range=0..10)
# TRANSPOSE
# N-dimensional Array Objects
number_slider_21 = Slider(3, range=0..10)
# SWAPAXES
# N-dimensional Array Objects
number_slider_22 = Slider(5, range=0..10)
# FANCY INDEXING
# N-dimensional Array Objects
panel_87 = Panel("""0
0""")
panel_88 = Panel("""0
2""")
# MATRIX MULTIPLICATION
# N-dimensional Array Objects
panel_89 = Panel("5")
# Instructions:
# 1. Drag and drop a hops node on the canvas.
# 2. Set path to:
# http://127.0.0.1:5000/ndarray_indexSlice_22b
# 3. Name and toggle  component name to :
# ndarray_indexSlice_22b
ndarray_indexslice_22b = Hops(
    Name=panel_84,
    List1=panel_85,
    List2=panel_88,
    List3=panel_86,
    List4=panel_87,
    CacheResultsInMemory=True,
    CacheSolveResults=True,
    RemoteDefinitionLocation="http://127.0.0.1:5000/ndarray_indexSlice_22b",
    RemoteSolveVersion=(0, 1, 0),
    ShowInput_Enabled=False,
    ShowInput_Path=False,
    SynchronousSolve=True)  # -> Array1, Array2
# Instructions:
# 1. Drag and drop a hops node on the canvas.
# 2. Set path to:
# http://127.0.0.1:5000/ndarray_transpose
# 3. Name and toggle  component name to :
# ndarray_transpose
ndarray_transpose = Hops(
    Rows="3",
    Columns=panel_89,
    CacheResultsInMemory=True,
    CacheSolveResults=True,
    RemoteDefinitionLocation="http://127.0.0.1:5000/ndarray_transpose",
    RemoteSolveVersion=(0, 1, 0),
    ShowInput_Enabled=False,
    ShowInput_Path=False,
    SynchronousSolve=True)  # -> L0, L1, L2, L3, L4
entwine_10 = Entwine(Branch00=ndarray_indexslice_22b.Array1, Branch01=ndarray_indexslice_22b.Array2, FlattenInputs=True)
# Instructions:
# 1. Drag and drop a hops node on the canvas.
# 2. Set path to:
# http://127.0.0.1:5000/ndarray_fancyIndexing_3
# 3. Name and toggle  component name to :
# ndarray_fancyIndexing_3
ndarray_fancyindexing_3 = Hops(
    Rows="3",
    Columns=number_slider_21,
    CacheResultsInMemory=False,
    CacheSolveResults=False,
    RemoteDefinitionLocation="http://127.0.0.1:5000/ndarray_fancyIndexing_3",
    RemoteSolveVersion=(0, 1, 0),
    ShowInput_Enabled=False,
    ShowInput_Path=False,
    SynchronousSolve=True)  # -> L0, L1, L2
# Instructions:
# 1. Drag and drop a hops node on the canvas.
# 2. Set path to:
# http://127.0.0.1:5000/ndarray_matrixMultiplication_3
# 3. Name and toggle  component name to :
# ndarray_matrixMultiplication_3
ndarray_matrixmultiplication_3 = Hops(
    Rows="3",
    Columns="5",
    CacheResultsInMemory=True,
    CacheSolveResults=True,
    RemoteDefinitionLocation="http://127.0.0.1:5000/ndarray_matrixMultiplication_3",
    RemoteSolveVersion=(0, 1, 0),
    ShowInput_Enabled=False,
    ShowInput_Path=False,
    SynchronousSolve=True)  # -> L0, L1, L2, L3, L4
# Instructions:
# 1. Drag and drop a hops node on the canvas.
# 2. Set path to:
# http://127.0.0.1:5000/ndarray_swapaxes2
# 3. Name and toggle  component name to :
# ndarray_swapaxes2
ndarray_swapaxes2 = Hops(
    Rows=number_slider_22,
    Columns=Slider(3, range=0..10),
    Axis1=Slider(0, range=0..1),
    Axis2=Slider(1, range=0..1),
    CacheResultsInMemory=True,
    CacheSolveResults=True,
    RemoteDefinitionLocation="http://127.0.0.1:5000/ndarray_swapaxes2",
    RemoteSolveVersion=(0, 1, 0),
    ShowInput_Enabled=False,
    ShowInput_Path=False,
    SynchronousSolve=True)  # -> L0, L1, L2
entwine_11 = Entwine(
    Branch00=ndarray_transpose.L0,
    Branch01=ndarray_transpose.L1,
    Branch02=ndarray_transpose.L2,
    Branch03=ndarray_transpose.L3,
    Branch04=ndarray_transpose.L4,
    FlattenInputs=True)
panel_90 = Panel(entwine_10)
entwine_12 = Entwine(
    Branch00=ndarray_fancyindexing_3.L0,
    Branch01=ndarray_fancyindexing_3.L1,
    Branch02=ndarray_fancyindexing_3.L2,
    FlattenInputs=True)
entwine_13 = Entwine(
    Branch00=ndarray_matrixmultiplication_3.L0,
    Branch01=ndarray_matrixmultiplication_3.L1,
    Branch02=ndarray_matrixmultiplication_3.L2,
    Branch03=ndarray_matrixmultiplication_3.L3,
    Branch04=ndarray_matrixmultiplication_3.L4,
    FlattenInputs=True)
entwine_14 = Entwine(Branch00=ndarray_swapaxes2.L0, Branch01=ndarray_swapaxes2.L1, Branch02=ndarray_swapaxes2.L2, FlattenInputs=True)
panel_91 = Panel(entwine_11)
panel_92 = Panel(entwine_12)
panel_93 = Panel(entwine_13)
panel_94 = Panel(entwine_14)
