# Grasshopper definition AI_copilot_to_AI_stablediffusion_004.gh (Grasshopper 1.0.7)
# plug-ins: Hops

panel = Panel("http://127.0.0.1:5000")
# #print(arr.list_to_tree()) not working in grasshopper canvas
# # use entwine node in gh to convert lists to tree
# 
# return arr.tolist()[0], arr.tolist()[1], arr.tolist()[2]
number_slider = Slider(4, range=0..10)
# NUMPY.RANDOM SHUFFLE
# N-dimensional Array Objects
number_slider_2 = Slider(2922, range=0..10000)
# #print(arr.list_to_tree()) not working in grasshopper canvas
# # use entwine node in gh to convert lists to tree
# 
# return arr.tolist()[0], arr.tolist()[1], arr.tolist()[2]
number_slider_3 = Slider(2, range=0..10)
# #print(arr.list_to_tree()) not working in grasshopper canvas
# # use entwine node in gh to convert lists to tree
# 
# return arr.tolist()[0], arr.tolist()[1], arr.tolist()[2]
number_slider_4 = Slider(4, range=0..10)
# NUMPY.RANDOM UNIFORM
# N-dimensional Array Objects
number_slider_5 = Slider(3863, range=0..10000)
# #print(arr.list_to_tree()) not working in grasshopper canvas
# # use entwine node in gh to convert lists to tree
# 
# return arr.tolist()[0], arr.tolist()[1], arr.tolist()[2]
number_slider_6 = Slider(4, range=0..10)
# #print(arr.list_to_tree()) not working in grasshopper canvas
# # use entwine node in gh to convert lists to tree
# 
# return arr.tolist()[0], arr.tolist()[1], arr.tolist()[2]
number_slider_7 = Slider(4, range=0..10)
# NUMPY.RANDOM BINOMIAL
# N-dimensional Array Objects
number_slider_8 = Slider(10, range=0..10)
# #print(arr.list_to_tree()) not working in grasshopper canvas
# # use entwine node in gh to convert lists to tree
# 
# return arr.tolist()[0], arr.tolist()[1], arr.tolist()[2]
number_slider_9 = Slider(4, range=0..10)
# #print(arr.list_to_tree()) not working in grasshopper canvas
# # use entwine node in gh to convert lists to tree
# 
# return arr.tolist()[0], arr.tolist()[1], arr.tolist()[2]
number_slider_10 = Slider(4, range=0..10)
# #print(arr.list_to_tree()) not working in grasshopper canvas
# # use entwine node in gh to convert lists to tree
# 
# return arr.tolist()[0], arr.tolist()[1], arr.tolist()[2]
number_slider_11 = Slider(4, range=0..10)
# NUMPY.RANDOM INTEGERS
# N-dimensional Array Objects
number_slider_12 = Slider(10, range=0..10)
# #print(arr.list_to_tree()) not working in grasshopper canvas
# # use entwine node in gh to convert lists to tree
# 
# return arr.tolist()[0], arr.tolist()[1], arr.tolist()[2]
number_slider_13 = Slider(4, range=0..10)
ndarray_random_gamma = Hops(
    CacheResultsInMemory=True,
    CacheSolveResults=True,
    RemoteDefinitionLocation="http://127.0.0.1:5000/ndarray_random_gamma",
    RemoteSolveVersion=(0, 1, 0),
    ShowInput_Enabled=False,
    ShowInput_Path=False,
    SynchronousSolve=True)  # -> L0, L1, L2, L3
# NUMPY.RANDOM SEED GENERATOR
# N-dimensional Array Objects
panel_2 = Panel("4")
# NUMPY.RANDOM BINOMIAL
# N-dimensional Array Objects
panel_3 = Panel("4")
# NUMPY.RANDOM PERMUTATIONS
# N-dimensional Array Objects
panel_4 = Panel("4")
# NUMPY.RANDOM CHISQUARE
# N-dimensional Array Objects
panel_5 = Panel("4")
# From AI copilot to AI Stable Diffusion
# at www.wickersonstudios.com
# Python for Data Manipulation and Mudging
# NUMPY BASICS: Array and Vectorized
# Computation into Grasshopper for Generating
# Rhino3D Geometries
# PSEUDORANDOM NUMBER GENERATION
# NUMPY.RANDOM MODULE
# N-dimensional Array Objects
panel_6 = Panel("4")
ndarray_random_laplace = Hops(
    CacheResultsInMemory=True,
    CacheSolveResults=True,
    RemoteDefinitionLocation="http://127.0.0.1:5000/ndarray_random_laplace",
    RemoteSolveVersion=(0, 1, 0),
    ShowInput_Enabled=False,
    ShowInput_Path=False,
    SynchronousSolve=True)  # -> L0, L1, L2, L3
# Instructions:
# 1. Drag and drop a hops node on the canvas.
# 2. Set path to:
# http://127.0.0.1:5000/ndarray_random_seed
# 3. Name and toggle  component name to :
# ndarray_random_seed
ndarray_random_seed = Hops(
    Rows=panel_2,
    Columns=number_slider,
    Seed=Slider(2922, range=0..10000),
    CacheResultsInMemory=True,
    CacheSolveResults=True,
    RemoteDefinitionLocation="http://127.0.0.1:5000/ndarray_random_seed",
    RemoteSolveVersion=(0, 1, 0),
    ShowInput_Enabled=False,
    ShowInput_Path=False,
    SynchronousSolve=True)  # -> L0, L1, L2, L3
# Instructions:
# 1. Drag and drop a hops node on the canvas.
# 2. Set path to:
# http://127.0.0.1:5000/ndarray_random_integers
# 3. Name and toggle  component name to :
# ndarray_random_integers
ndarray_random_integers = Hops(
    Rows="4",
    Columns=number_slider_7,
    Low=Slider(0, range=0..10),
    High=number_slider_8,
    CacheResultsInMemory=False,
    CacheSolveResults=False,
    RemoteDefinitionLocation="http://127.0.0.1:5000/ndarray_random_integers",
    RemoteSolveVersion=(0, 1, 0),
    ShowInput_Enabled=False,
    ShowInput_Path=False,
    SynchronousSolve=True)  # -> L0, L1, L2, L3
# Instructions:
# 1. Drag and drop a hops node on the canvas.
# 2. Set path to:
# http://127.0.0.1:5000/ndarray_random_permutations
# 3. Name and toggle  component name to :
# ndarray_random_permutations
ndarray_random_permutations = Hops(
    Rows=panel_4,
    Columns=number_slider_4,
    CacheResultsInMemory=False,
    CacheSolveResults=False,
    RemoteDefinitionLocation="http://127.0.0.1:5000/ndarray_random_permutations",
    RemoteSolveVersion=(0, 1, 0),
    ShowInput_Enabled=False,
    ShowInput_Path=False,
    SynchronousSolve=True)  # -> L0, L1, L2, L3
# Instructions:
# 1. Drag and drop a hops node on the canvas.
# 2. Set path to:
# http://127.0.0.1:5000/nndarray_random_logistic
# 3. Name and toggle  component name to :
# ndarray_random_logistic
ndarray_random_logistic = Hops(
    Rows=panel_3,
    Columns=number_slider_3,
    Loc=Slider(0, range=0..10),
    Scale=Slider(0.89, range=0..1),
    CacheResultsInMemory=False,
    CacheSolveResults=False,
    RemoteDefinitionLocation="http://127.0.0.1:5000/ndarray_random_logistic",
    RemoteSolveVersion=(0, 1, 0),
    ShowInput_Enabled=False,
    ShowInput_Path=False,
    SynchronousSolve=True)  # -> L0, L1, L2, L3
ndarray_random_beta = Hops(
    CacheResultsInMemory=True,
    CacheSolveResults=True,
    RemoteDefinitionLocation="http://127.0.0.1:5000/ndarray_random_beta",
    RemoteSolveVersion=(0, 1, 0),
    ShowInput_Enabled=False,
    ShowInput_Path=False,
    SynchronousSolve=True)  # -> L0, L1, L2, L3
# Instructions:
# 1. Drag and drop a hops node on the canvas.
# 2. Set path to:
# http://127.0.0.1:5000/ndarray_random_shuffle
# 3. Name and toggle  component name to :
# ndarray_random_shuffle
ndarray_random_shuffle = Hops(
    Rows="4",
    Columns=number_slider_6,
    Seed=number_slider_5,
    CacheResultsInMemory=True,
    CacheSolveResults=True,
    RemoteDefinitionLocation="http://127.0.0.1:5000/ndarray_random_shuffle",
    RemoteSolveVersion=(0, 1, 0),
    ShowInput_Enabled=False,
    ShowInput_Path=False,
    SynchronousSolve=True)  # -> L0, L1, L2, L3
# Instructions:
# 1. Drag and drop a hops node on the canvas.
# 2. Set path to:
# http://127.0.0.1:5000/nndarray_random_logistic
# 3. Name and toggle  component name to :
# ndarray_random_logistic
ndarray_random_chisquare = Hops(
    Rows=panel_5,
    Columns=number_slider_10,
    Df=Slider(10, range=0..10),
    CacheResultsInMemory=True,
    CacheSolveResults=True,
    RemoteDefinitionLocation="http://127.0.0.1:5000/ndarray_random_chisquare",
    RemoteSolveVersion=(0, 1, 0),
    ShowInput_Enabled=False,
    ShowInput_Path=False,
    SynchronousSolve=True)  # -> L0, L1, L2, L3
# Instructions:
# 1. Drag and drop a hops node on the canvas.
# 2. Set path to:
# http://127.0.0.1:5000/ndarray_random_binomial
# 3. Name and toggle  component name to :
# ndarray_random_binomial
ndarray_random_binomial = Hops(
    Rows="4",
    Columns=number_slider_9,
    N=Slider(1, range=0..1),
    P=Slider(0.748, range=0..1),
    CacheResultsInMemory=True,
    CacheSolveResults=True,
    RemoteDefinitionLocation="http://127.0.0.1:5000/ndarray_random_binomial",
    RemoteSolveVersion=(0, 1, 0),
    ShowInput_Enabled=False,
    ShowInput_Path=False,
    SynchronousSolve=True)  # -> L0, L1, L2, L3
# Instructions:
# 1. Drag and drop a hops node on the canvas.
# 2. Set path to:
# http://127.0.0.1:5000/ndarray_random_uniform
# 3. Name and toggle  component name to :
# ndarray_random_uniform
ndarray_random_uniform = Hops(
    Rows="4",
    Columns=number_slider_11,
    Low=Slider(0, range=0..10),
    High=number_slider_12,
    CacheResultsInMemory=False,
    CacheSolveResults=False,
    RemoteDefinitionLocation="http://127.0.0.1:5000/ndarray_random_uniform",
    RemoteSolveVersion=(0, 1, 0),
    ShowInput_Enabled=False,
    ShowInput_Path=False,
    SynchronousSolve=True)  # -> L0, L1, L2, L3
ndarray_random_1 = Hops(
    Rows=panel_6,
    Columns=number_slider_13,
    CacheResultsInMemory=False,
    CacheSolveResults=False,
    RemoteDefinitionLocation="http://127.0.0.1:5000/ndarray_random_1",
    RemoteSolveVersion=(0, 1, 0),
    ShowInput_Enabled=False,
    ShowInput_Path=False,
    SynchronousSolve=True)  # -> L0, L1, L2, L3
ndarray_random_logistic_2 = Hops(
    CacheResultsInMemory=True,
    CacheSolveResults=True,
    RemoteDefinitionLocation="http://127.0.0.1:5000/ndarray_random_logistic",
    RemoteSolveVersion=(0, 1, 0),
    ShowInput_Enabled=False,
    ShowInput_Path=False,
    SynchronousSolve=True)  # -> L0, L1, L2, L3
entwine = Entwine(
    Branch00=ndarray_random_logistic.L0,
    Branch01=ndarray_random_logistic.L1,
    Branch02=ndarray_random_logistic.L2,
    Branch03=ndarray_random_logistic.L3,
    FlattenInputs=True)
entwine_2 = Entwine(
    Branch00=ndarray_random_integers.L0,
    Branch01=ndarray_random_integers.L1,
    Branch02=ndarray_random_integers.L2,
    Branch03=ndarray_random_integers.L3,
    FlattenInputs=True)
entwine_3 = Entwine(
    Branch00=ndarray_random_seed.L0,
    Branch01=ndarray_random_seed.L1,
    Branch02=ndarray_random_seed.L2,
    Branch03=ndarray_random_seed.L3,
    FlattenInputs=True)
entwine_4 = Entwine(
    Branch00=ndarray_random_binomial.L0,
    Branch01=ndarray_random_binomial.L1,
    Branch02=ndarray_random_binomial.L2,
    Branch03=ndarray_random_binomial.L3,
    FlattenInputs=True)
entwine_5 = Entwine(
    Branch00=ndarray_random_chisquare.L0,
    Branch01=ndarray_random_chisquare.L1,
    Branch02=ndarray_random_chisquare.L2,
    Branch03=ndarray_random_chisquare.L3,
    FlattenInputs=True)
entwine_6 = Entwine(
    Branch00=ndarray_random_uniform.L0,
    Branch01=ndarray_random_uniform.L1,
    Branch02=ndarray_random_uniform.L2,
    Branch03=ndarray_random_uniform.L3,
    FlattenInputs=True)
entwine_7 = Entwine(
    Branch00=ndarray_random_permutations.L0,
    Branch01=ndarray_random_permutations.L1,
    Branch02=ndarray_random_permutations.L2,
    Branch03=ndarray_random_permutations.L3,
    FlattenInputs=True)
entwine_8 = Entwine(
    Branch00=ndarray_random_shuffle.L0,
    Branch01=ndarray_random_shuffle.L1,
    Branch02=ndarray_random_shuffle.L2,
    Branch03=ndarray_random_shuffle.L3,
    FlattenInputs=True)
# Instructions:
# 1. Drag and drop a hops node on the canvas.
# 2. Set path to:
# http://127.0.0.1:5000/ndarray_random_1
# 3. Name and toggle  component name to :
# ndarray_random_1
entwine_9 = Entwine(
    Branch00=ndarray_random_1.L0,
    Branch01=ndarray_random_1.L1,
    Branch02=ndarray_random_1.L2,
    Branch03=ndarray_random_1.L3,
    FlattenInputs=True)
ndarray_random_lognormal = Hops(
    CacheResultsInMemory=True,
    CacheSolveResults=True,
    RemoteDefinitionLocation="http://127.0.0.1:5000/ndarray_random_lognormal",
    RemoteSolveVersion=(0, 1, 0),
    ShowInput_Enabled=False,
    ShowInput_Path=False,
    SynchronousSolve=True)  # -> L0, L1, L2, L3
panel_7 = Panel(entwine)
panel_8 = Panel(entwine_2)
panel_9 = Panel(entwine_7)
panel_10 = Panel(entwine_4)
panel_11 = Panel(entwine_8)
panel_12 = Panel(entwine_6)
panel_13 = Panel(entwine_5)
panel_14 = Panel(entwine_3)
# #print(arr.list_to_tree()) not working in grasshopper canvas
# # use entwine node in gh to convert lists to tree
# 
# return arr.tolist()[0], arr.tolist()[1], arr.tolist()[2]
panel_15 = Panel(entwine_9)

# ----
# DATA VISUALIZATION
number_slider_14 = Slider(0, range=0..100)  # disabled
number_slider_15 = Slider(3.81, range=0..100)  # disabled
construct_point = ConstructPoint(XCoordinate=panel_13, YCoordinate=graft(panel_13), ZCoordinate=0)  # disabled
list_length = ListLength(List=flatten(construct_point))  # disabled
construct_domain = ConstructDomain(DomainStart=number_slider_14, DomainEnd=number_slider_15)  # disabled
range = Range(Domain=construct_domain, Steps=expr("x-1", list_length))  # disabled
unit_z = UnitZ(Factor=range)  # disabled
point = Point(construct_point)  # disabled
number_slider_16 = Slider(0.37, range=0..1)  # disabled
move = Move(Geometry=graft(point), Motion=graft(unit_z))  # -> Geometry, Transform; disabled
point_2 = Point(graft(point))  # disabled
param_viewer = ParamViewer(point_2)  # disabled
circle = Circle(Plane=point, Radius=number_slider_16)  # -> graft(Circle); disabled
circle_2 = Circle(Plane=move.Geometry, Radius=number_slider_16)  # disabled
loft = Loft(
    Curves=[circle_2, circle],
    Options={Adjust=False, Closed=False, LoftEnds=0, LoftSimp=0, LoftType=0, Rebuild=10, Refit=0.01})  # disabled
cap_holes = CapHoles(Brep=loft)  # disabled

# ----
# DATA VISUALIZATION
number_slider_17 = Slider(10, range=0..10)
construct_point_2 = ConstructPoint(XCoordinate=panel_7, YCoordinate=graft(panel_7), ZCoordinate=0)
shift_list = ShiftList(List=flatten(construct_point_2), Shift=number_slider_17, Wrap=True)
line = Line(StartPoint=construct_point_2, EndPoint=shift_list)
list_length_2 = ListLength(List=flatten(line))
range_2 = Range(Domain=Slider(12, range=0..100), Steps=expr("x-1", list_length_2))
unit_z_2 = UnitZ(Factor=range_2)
move_2 = Move(Geometry=graft(line), Motion=graft(unit_z_2))  # -> Geometry, Transform
clean_tree = CleanTree(RemoveNulls=True, RemoveInvalid=True, RemoveEmpty=False, Tree=move_2.Geometry)
loft_2 = Loft(
    Curves=flatten(clean_tree),
    Options={Adjust=False, Closed=False, LoftEnds=0, LoftSimp=0, LoftType=0, Rebuild=10, Refit=0.01})
