# Grasshopper definition AI_copilot_to_AI_stablediffusion_005.gh (Grasshopper 1.0.7)
# plug-ins: Hops

# binary ufuncs
# 1-dimensional Array Objects
# #print(arr.list_to_tree()) not working in grasshopper canvas
# # use entwine node in gh to convert lists to tree
# 
# return arr.tolist()[0], arr.tolist()[1], arr.tolist()[2]
number_slider = Slider(0, range=0..10)
# numpy.modf ufuncs
# 1-dimensional Array Objects
number_slider_2 = Slider(10, range=0..10)
# Universal Functions :
# Fast Element-Wise
# Array Function
# unary ufuncs
# 1-dimensional Array Objects
# #print(arr.list_to_tree()) not working in grasshopper canvas
# # use entwine node in gh to convert lists to tree
# 
# return arr.tolist()[0], arr.tolist()[1], arr.tolist()[2]
number_slider_3 = Slider(0, range=0..10)
# #print(arr.list_to_tree()) not working in grasshopper canvas
# # use entwine node in gh to convert lists to tree
# 
# return arr.tolist()[0], arr.tolist()[1], arr.tolist()[2]
number_slider_4 = Slider(0, range=0..10)
series = Series(Start=number_slider, Step=Slider(1, range=0..10), Count=Slider(10, range=0..10))
series_2 = Series(Start=Slider(-10, range=-10..10), Step=Slider(3, range=0..10), Count=number_slider_2)
series_3 = Series(Start=number_slider_3, Step=Slider(1, range=0..10), Count=Slider(10, range=0..10))
series_4 = Series(Start=number_slider_4, Step=Slider(2.04, range=0..10), Count=Slider(10, range=0..10))
series_5 = Series(Start=Slider(-10, range=-10..10), Step=Slider(3, range=0..10), Count=Slider(10, range=0..10))
ndarray_binary_ufuncs = Hops(
    X=series,
    Y=series_2,
    CacheResultsInMemory=True,
    CacheSolveResults=True,
    RemoteDefinitionLocation="http://127.0.0.1:5000/ndarray_binary_ufuncs",
    RemoteSolveVersion=(0, 1, 0),
    ShowInput_Enabled=False,
    ShowInput_Path=False,
    SynchronousSolve=True)
ndarray_unary_ufuncs = Hops(
    Arr=series_3,
    CacheResultsInMemory=True,
    CacheSolveResults=True,
    RemoteDefinitionLocation="http://127.0.0.1:5000/ndarray_unary_ufuncs",
    RemoteSolveVersion=(0, 1, 0),
    ShowInput_Enabled=False,
    ShowInput_Path=False,
    SynchronousSolve=True)  # -> Sqrt, Exp
ndarray_modf = Hops(
    Arr=series_4,
    CacheResultsInMemory=True,
    CacheSolveResults=True,
    RemoteDefinitionLocation="http://127.0.0.1:5000/ndarray_modf",
    RemoteSolveVersion=(0, 1, 0),
    ShowInput_Enabled=False,
    ShowInput_Path=False,
    SynchronousSolve=True)  # -> Remainder, Whole_part
# Instructions:
# 1. Drag and drop a hops node on the canvas.
# 2. Set path to:
# http://127.0.0.1:5000/ndarray_binary_ufuncs
# 3. Name and toggle  component name to :
# ndarray_binary_ufuncs
panel = Panel(ndarray_binary_ufuncs)
# Instructions:
# 1. Drag and drop a hops node on the canvas.
# 2. Set path to:
# http://127.0.0.1:5000/ndarray_unary_ufuncs
# 3. Name and toggle  component name to :
# ndarray_unary_ufuncs
panel_2 = Panel(ndarray_unary_ufuncs.Sqrt)
# Instructions:
# 1. Drag and drop a hops node on the canvas.
# 2. Set path to:
# http://127.0.0.1:5000/ndarray_modf
# 3. Name and toggle  component name to :
# ndarray_modf
panel_3 = Panel(ndarray_modf.Whole_part)
panel_4 = Panel(ndarray_unary_ufuncs.Exp)
panel_5 = Panel(ndarray_modf.Remainder)
# Array Oriented
# Programming
panel_6 = Panel(".5")
# From AI copilot to AI Stable Diffusion
# at www.wickersonstudios.com
# Python for Data Manipulation and Mudging
# NUMPY BASICS: Array and Vectorized
# Computation into Grasshopper for Generating
# Rhino3D Geometries
negative = Negative(Value=panel_6)
# #print(arr.list_to_tree()) not working in grasshopper canvas
# # use entwine node in gh to convert lists to tree
# 
# return arr.tolist()[0], arr.tolist()[1], arr.tolist()[2]
number_slider_5 = Slider(5, range=0..10)
# numpy.meshgrid with Function sqrt
# N-dimensional Array Objects
# #print(arr.list_to_tree()) not working in grasshopper canvas
# # use entwine node in gh to convert lists to tree
# 
# return arr.tolist()[0], arr.tolist()[1], arr.tolist()[2]
number_slider_6 = Slider(5, range=5..10)
# numpy.meshgrid
# 1-dimensional Array Objects
number_slider_7 = Slider(10, range=0..100)
construct_domain = ConstructDomain(DomainStart=negative, DomainEnd=panel_6)
# #print(arr.list_to_tree()) not working in grasshopper canvas
# # use entwine node in gh to convert lists to tree
# 
# return arr.tolist()[0], arr.tolist()[1], arr.tolist()[2]
# numpy.meshgrid
# 1-dimensional Array Objects
number_slider_8 = Slider(10, range=0..10)
negative_2 = Negative(Value=number_slider_5)
negative_3 = Negative(Value=number_slider_6)
range = Range(Domain=construct_domain, Steps=number_slider_7)
# Instructions:
# 1. Drag and drop a hops node on the canvas.
# 2. Set path to:
# http://127.0.0.1:5000/ndarray_meshgrid_05
# 3. Name and toggle  component name to :
# ndarray_meshgrid_05
hops = Hops(
    Start=negative_2,
    Stop=number_slider_5,
    Step="1",
    CacheResultsInMemory=True,
    CacheSolveResults=True,
    RemoteDefinitionLocation="http://127.0.0.1:5000/ndarray_meshgrid_05",
    RemoteSolveVersion=(0, 1, 0),
    ShowInput_Enabled=False,
    ShowInput_Path=False,
    SynchronousSolve=True)  # -> YsRow1, YsRow2, YsRow3, YsRow4, YsRow5, YsRow6, YsRow7, YsRow8, YsRow9, YsRow10
# Instructions:
# 1. Drag and drop a hops node on the canvas.
# 2. Set path to:
# http://127.0.0.1:5000/ndarray_meshgrid_06
# 3. Name and toggle  component name to :
# ndarray_meshgrid_06
ndarray_meshgrid_06 = Hops(
    Start=negative_3,
    Stop=number_slider_6,
    Step="1",
    CacheResultsInMemory=True,
    CacheSolveResults=True,
    RemoteDefinitionLocation="http://127.0.0.1:5000/ndarray_meshgrid_06",
    RemoteSolveVersion=(0, 1, 0),
    ShowInput_Enabled=False,
    ShowInput_Path=False,
    SynchronousSolve=True)  # -> YzRow1, YzRow2, YzRow3, YzRow4, YzRow5, YzRow6, YzRow7, YzRow8, YzRow9, YzRow10
partition_list = PartitionList(List=range, Size=number_slider_8)
entwine = Entwine(
    Branch00=hops.YsRow1,
    Branch01=hops.YsRow2,
    Branch02=hops.YsRow3,
    Branch03=hops.YsRow4,
    Branch04=hops.YsRow5,
    Branch05=hops.YsRow6,
    Branch06=hops.YsRow7,
    Branch07=hops.YsRow8,
    Branch08=hops.YsRow9,
    Branch09=hops.YsRow10,
    FlattenInputs=True)
entwine_2 = Entwine(
    Branch00=ndarray_meshgrid_06.YzRow1,
    Branch01=ndarray_meshgrid_06.YzRow2,
    Branch02=ndarray_meshgrid_06.YzRow3,
    Branch03=ndarray_meshgrid_06.YzRow4,
    Branch04=ndarray_meshgrid_06.YzRow5,
    Branch05=ndarray_meshgrid_06.YzRow6,
    Branch06=ndarray_meshgrid_06.YzRow7,
    Branch07=ndarray_meshgrid_06.YzRow8,
    Branch08=ndarray_meshgrid_06.YzRow9,
    Branch09=ndarray_meshgrid_06.YzRow10,
    FlattenInputs=True)
# Instructions:
# 1. Drag and drop a hops node on the canvas.
# 2. Set path to:
# http://127.0.0.1:5000/ndarray_meshgrid_02
# 3. Name and toggle  component name to :
# ndarray_meshgrid_02
panel_7 = Panel(partition_list)
ndarray_meshgrid_02 = Hops(
    Points=panel_7,
    CacheResultsInMemory=True,
    CacheSolveResults=True,
    RemoteDefinitionLocation="http://127.0.0.1:5000/ndarray_meshgrid_02",
    RemoteSolveVersion=(0, 1, 0),
    ShowInput_Enabled=False,
    ShowInput_Path=False,
    SynchronousSolve=True)  # -> Xs, Ys
panel_8 = Panel(entwine)
panel_9 = Panel(entwine_2)
panel_10 = Panel(ndarray_meshgrid_02.Xs)
panel_11 = Panel(ndarray_meshgrid_02.Ys)

# ----
# Data Visualization
series_6 = Series(Start=0, Step=1, Count=10)
construct_point = ConstructPoint(XCoordinate=panel_8, YCoordinate=series_6, ZCoordinate=0)
interpolate = Interpolate(Vertices=construct_point, Degree=3, Periodic=False, KnotStyle=1)  # -> Curve, Length, Domain
loft = Loft(
    Curves=flatten(interpolate.Curve),
    Options={Adjust=False, Closed=False, LoftEnds=0, LoftSimp=0, LoftType=0, Rebuild=10, Refit=0.01})

# ----
# Data Visualization
series_7 = Series(Start=0, Step=1, Count=10)
construct_point_2 = ConstructPoint(XCoordinate=panel_9, YCoordinate=series_7, ZCoordinate=0)
interpolate_2 = Interpolate(Vertices=construct_point_2, Degree=3, Periodic=False, KnotStyle=1)  # -> Curve, Length, Domain
unit_z = UnitZ(Factor=series_7)
number_slider_9 = Slider(0.34, range=0..1)
number_slider_10 = Slider(0.38, range=0..1)
number_slider_11 = Slider(0.18, range=0..1)
number_slider_12 = Slider(0.47, range=0..1)
move = Move(Geometry=flatten(interpolate_2.Curve), Motion=unit_z)  # -> Geometry, Transform
construct_point_3 = ConstructPoint(XCoordinate=number_slider_12, YCoordinate=number_slider_10, ZCoordinate=0)
construct_point_4 = ConstructPoint(XCoordinate=number_slider_9, YCoordinate=number_slider_11, ZCoordinate=0)
loft_2 = Loft(Curves=move.Geometry, Options={Adjust=False, Closed=False, LoftEnds=0, LoftSimp=0, LoftType=0, Rebuild=10, Refit=0.01})
mirror = Mirror(Geometry=loft_2, Plane=PlaneYZ(0, 0, 0))  # -> Geometry, Transform
evaluate_surface = EvaluateSurface(Surface=reparameterize(loft_2), Point=construct_point_4)  # -> Point, Normal, UDirection, VDirection, Frame
evaluate_surface_2 = EvaluateSurface(Surface=reparameterize(mirror.Geometry), Point=construct_point_3)  # -> Point, Normal, UDirection, VDirection, Frame
orient = Orient(Geometry=mirror.Geometry, Source=evaluate_surface_2.Point, Target=evaluate_surface.Point)  # -> Geometry, Transform
solid_intersection = SolidIntersection(BrepsA=orient.Geometry, BrepsB=loft_2)
volume = Volume(Geometry=solid_intersection)  # -> Volume, Centroid
galapagos = Galapagos(fitness=volume, gene=[number_slider_9, number_slider_12, number_slider_11, number_slider_10])

panel_12 = Panel(volume.Volume)
# numpy.where  continued
# Array Objects
# #print(arr.list_to_tree()) not working in grasshopper canvas
# # use entwine node in gh to convert lists to tree
# 
# return arr.tolist()[0], arr.tolist()[1], arr.tolist()[2]
panel_13 = Panel("4")
# numpy.where
# N-dimensional Array Objects
# #print(arr.list_to_tree()) not working in grasshopper canvas
# # use entwine node in gh to convert lists to tree
# 
# return arr.tolist()[0], arr.tolist()[1], arr.tolist()[2]
steps = Steps(10)
gene_pool = GenePool(
    Decimals=0,
    Maximum=1,
    Minimum=0,
    Value=[0.6566099285, 0.1317207032, 0.8196242022, 0.9934868026, 0.8989049396, 0.1011112114, 0.2552108514, 0.4947937855, 0.9048845782, 0.6969611732, 0.724155451])
# Expressing Conditional Logic
# as Array Operations
series_8 = Series(Start=0, Step=1, Count=expr("x+1", steps))
range_2 = Range(Domain=Domain(0, 1), Steps=steps)
ndarray_where_03 = Hops(
    Rows=panel_13,
    Columns=Slider(4, range=0..10),
    CacheResultsInMemory=True,
    CacheSolveResults=True,
    RemoteDefinitionLocation="http://127.0.0.1:5000/ndarray_where_03",
    RemoteSolveVersion=(0, 1, 0),
    ShowInput_Enabled=False,
    ShowInput_Path=False,
    SynchronousSolve=True)  # -> Arr1, Arr2, Arr3, Arr4
ndarray_where_01 = Hops(
    Xarr=series_8,
    Yarr=range_2,
    Cond=gene_pool,
    CacheResultsInMemory=True,
    CacheSolveResults=True,
    RemoteDefinitionLocation="http://127.0.0.1:5000/ndarray_where_01",
    RemoteSolveVersion=(0, 1, 0),
    ShowInput_Enabled=False,
    ShowInput_Path=False,
    SynchronousSolve=True)
# Instructions:
# 1. Drag and drop a hops node on the canvas.
# 2. Set path to:
# http://127.0.0.1:5000/ndarray_where_03
# 3. Name and toggle  component name to :
# ndarray_where_03
entwine_3 = Entwine(
    Branch00=ndarray_where_03.Arr1,
    Branch01=ndarray_where_03.Arr2,
    Branch02=ndarray_where_03.Arr3,
    Branch03=ndarray_where_03.Arr4,
    FlattenInputs=True)
panel_14 = Panel(range_2)
# Instructions:
# 1. Drag and drop a hops node on the canvas.
# 2. Set path to:
# http://127.0.0.1:5000/ndarray_where_01
# 3. Name and toggle  component name to :
# ndarray_where_01
panel_15 = Panel(ndarray_where_01)
panel_16 = Panel(entwine_3)

# ----
# Data Visualization
number_slider_13 = Slider(0.47, range=0..1)
number_slider_14 = Slider(12, range=0..100)
series_9 = Series(Start=0, Step=1, Count=steps)
unit_y = UnitY(Factor=series_9)
construct_point_5 = ConstructPoint(XCoordinate=series_9, YCoordinate=0, ZCoordinate=panel_15)
interpolate_3 = Interpolate(Vertices=construct_point_5, Degree=3, Periodic=False, KnotStyle=1)  # -> Curve, Length, Domain
move_2 = Move(Geometry=flatten(interpolate_3.Curve), Motion=unit_y)  # -> Geometry, Transform
loft_3 = Loft(Curves=move_2.Geometry, Options={Adjust=False, Closed=False, LoftEnds=0, LoftSimp=0, LoftType=0, Rebuild=10, Refit=0.01})
surface = Surface(loft_3)
divide_surface = DivideSurface(Surface=surface, UCount=number_slider_14, VCount=number_slider_14)  # -> Points, Normals, Parameters
multiplication = Multiplication(A=divide_surface.Normals, B=number_slider_13)
negative_4 = Negative(Value=multiplication)
move_3 = Move(Geometry=divide_surface.Points, Motion=negative_4)  # -> Geometry, Transform
surface_from_points = SurfaceFromPoints(Points=flatten(move_3.Geometry), UCount=expr("x+1", number_slider_14), Interpolate=False)
surface_2 = Surface(surface_from_points)
divide_surface_2 = DivideSurface(Surface=surface_2, UCount=number_slider_14, VCount=number_slider_14)  # -> Points, Normals, Parameters
multiplication_2 = Multiplication(A=divide_surface_2.Normals, B=Slider(0.58, range=0..1))
negative_5 = Negative(Value=multiplication_2)
deconstruct_brep = DeconstructBrep(Brep=surface_from_points)  # -> Faces, graft(Edges), Vertices
move_4 = Move(Geometry=divide_surface_2.Points, Motion=negative_5)  # -> Geometry, Transform
surface_from_points_2 = SurfaceFromPoints(Points=flatten(move_4.Geometry), UCount=expr("x+1", number_slider_14), Interpolate=False)
deconstruct_brep_2 = DeconstructBrep(Brep=surface_from_points_2)  # -> Faces, graft(Edges), Vertices
loft_4 = Loft(
    Curves=[deconstruct_brep.Edges, deconstruct_brep_2.Edges],
    Options={Adjust=False, Closed=False, LoftEnds=0, LoftSimp=0, LoftType=0, Rebuild=10, Refit=0.01})
merge = Merge(Data1=surface_from_points, Data2=surface_from_points_2, Data3=loft_4)  # -> flatten(Result)
brep_join = BrepJoin(Breps=merge)  # -> Breps, Closed

# ----
# cumsum method
# Array Objects
axis = Slider(1, range=0..1)
# cumprod method
# Array Objects
number_slider_15 = Slider(1, range=0..1)
# Mathematical and Statistical Methods
# mean, sum, std
# Array Objects
# #print(arr.list_to_tree()) not working in grasshopper canvas
# # use entwine node in gh to convert lists to tree
# 
# return arr.tolist()[0], arr.tolist()[1], arr.tolist()[2]
panel_17 = Panel("4")
# axis argument
# Array Objects
# #print(arr.list_to_tree()) not working in grasshopper canvas
# # use entwine node in gh to convert lists to tree
# 
# return arr.tolist()[0], arr.tolist()[1], arr.tolist()[2]
panel_18 = Panel("4")
# #print(arr.list_to_tree()) not working in grasshopper canvas
# # use entwine node in gh to convert lists to tree
# 
# return arr.tolist()[0], arr.tolist()[1], arr.tolist()[2]
panel_19 = Panel("4")
# #print(arr.list_to_tree()) not working in grasshopper canvas
# # use entwine node in gh to convert lists to tree
# 
# return arr.tolist()[0], arr.tolist()[1], arr.tolist()[2]
panel_20 = Panel("4")
ndarray_mean_02 = Hops(
    Rows=panel_17,
    Columns=Slider(4, range=0..10),
    CacheResultsInMemory=True,
    CacheSolveResults=True,
    RemoteDefinitionLocation="http://127.0.0.1:5000/ndarray_mean_02",
    RemoteSolveVersion=(0, 1, 0),
    ShowInput_Enabled=False,
    ShowInput_Path=False,
    SynchronousSolve=True)  # -> Arr1, Arr2, Arr3, Arr4, Mean
ndarray_mean_03 = Hops(
    Rows=panel_18,
    Columns=Slider(4, range=0..10),
    Axis=axis,
    CacheResultsInMemory=True,
    CacheSolveResults=True,
    RemoteDefinitionLocation="http://127.0.0.1:5000/ndarray_mean_03",
    RemoteSolveVersion=(0, 1, 0),
    ShowInput_Enabled=False,
    ShowInput_Path=False,
    SynchronousSolve=True)  # -> Arr1, Arr2, Arr3, Arr4, Mean
ndarray_cumsum_06 = Hops(
    Rows=panel_19,
    Columns=Slider(2, range=0..10),
    Axis=number_slider_15,
    CacheResultsInMemory=True,
    CacheSolveResults=True,
    RemoteDefinitionLocation="http://127.0.0.1:5000/ndarray_cumsum_06",
    RemoteSolveVersion=(0, 1, 0),
    ShowInput_Enabled=False,
    ShowInput_Path=False,
    SynchronousSolve=True)  # -> Arr1, Arr2, Arr3, Arr4
ndarray_cumprod_07 = Hops(
    Rows=panel_20,
    Columns=Slider(2, range=0..10),
    Axis=Slider(1, range=0..1),
    CacheResultsInMemory=True,
    CacheSolveResults=True,
    RemoteDefinitionLocation="http://127.0.0.1:5000/ndarray_cumprod_07",
    RemoteSolveVersion=(0, 1, 0),
    ShowInput_Enabled=False,
    ShowInput_Path=False,
    SynchronousSolve=True)  # -> Arr1, Arr2, Arr3, Arr4
panel_21 = Panel(ndarray_mean_02.Mean)
# Instructions:
# 1. Drag and drop a hops node on the canvas.
# 2. Set path to:
# http://127.0.0.1:5000/ndarray_mean_02
# 3. Name and toggle  component name to :
# ndarray_mean_02
entwine_4 = Entwine(
    Branch00=ndarray_mean_02.Arr1,
    Branch01=ndarray_mean_02.Arr2,
    Branch02=ndarray_mean_02.Arr3,
    Branch03=ndarray_mean_02.Arr4,
    FlattenInputs=True)
panel_22 = Panel(ndarray_mean_03.Mean)
# Instructions:
# 1. Drag and drop a hops node on the canvas.
# 2. Set path to:
# http://127.0.0.1:5000/ndarray_cumsum_06
# 3. Name and toggle  component name to :
# ndarray_cumsum_06
entwine_5 = Entwine(
    Branch00=ndarray_cumsum_06.Arr1,
    Branch01=ndarray_cumsum_06.Arr2,
    Branch02=ndarray_cumsum_06.Arr3,
    Branch03=ndarray_cumsum_06.Arr4,
    FlattenInputs=True)
# Instructions:
# 1. Drag and drop a hops node on the canvas.
# 2. Set path to:
# http://127.0.0.1:5000/ndndarray_mean_03
# 3. Name and toggle  component name to :
# ndarray_mean_03
entwine_6 = Entwine(
    Branch00=ndarray_mean_03.Arr1,
    Branch01=ndarray_mean_03.Arr2,
    Branch02=ndarray_mean_03.Arr3,
    Branch03=ndarray_mean_03.Arr4,
    FlattenInputs=True)
# Instructions:
# 1. Drag and drop a hops node on the canvas.
# 2. Set path to:
# http://127.0.0.1:5000/ndarray_cumprod_07
# 3. Name and toggle  component name to :
# ndarray_cumprod_07
entwine_7 = Entwine(
    Branch00=ndarray_cumprod_07.Arr1,
    Branch01=ndarray_cumprod_07.Arr2,
    Branch02=ndarray_cumprod_07.Arr3,
    Branch03=ndarray_cumprod_07.Arr4,
    FlattenInputs=True)
panel_23 = Panel(entwine_6)
panel_24 = Panel(entwine_5)
panel_25 = Panel(entwine_7)
# #Basic array statistical methods
# #min, max, argmin, argmax, sum, mean, std, var, cumsum, cumprod
# #min and max return the minimum and maximum values in an array
# #argmin and argmax return the index of the minimum and maximum elements
# #std and var compute the standard deviation and variance
# #cumsum and cumprod compute the cumulative sums and products
panel_26 = Panel(entwine_4)
# min method
# Array Objects
# #print(arr.list_to_tree()) not working in grasshopper canvas
# # use entwine node in gh to convert lists to tree
# 
# return arr.tolist()[0], arr.tolist()[1], arr.tolist()[2]
# max method
# Array Objects
number_slider_16 = Slider(4, range=0..10)
# argmin method
# Array Objects
# #print(arr.list_to_tree()) not working in grasshopper canvas
# # use entwine node in gh to convert lists to tree
# 
# return arr.tolist()[0], arr.tolist()[1], arr.tolist()[2]
number_slider_17 = Slider(4, range=0..10)
# argmax method
# Array Objects
number_slider_18 = Slider(4, range=0..10)
# #print(arr.list_to_tree()) not working in grasshopper canvas
# # use entwine node in gh to convert lists to tree
# 
# return arr.tolist()[0], arr.tolist()[1], arr.tolist()[2]
# var method
# Array Objects
number_slider_19 = Slider(4, range=0..10)
# #print(arr.list_to_tree()) not working in grasshopper canvas
# # use entwine node in gh to convert lists to tree
# 
# return arr.tolist()[0], arr.tolist()[1], arr.tolist()[2]
number_slider_20 = Slider(0, range=0..1)
# #print(arr.list_to_tree()) not working in grasshopper canvas
# # use entwine node in gh to convert lists to tree
# 
# return arr.tolist()[0], arr.tolist()[1], arr.tolist()[2]
number_slider_21 = Slider(4, range=0..10)
# #print(arr.list_to_tree()) not working in grasshopper canvas
# # use entwine node in gh to convert lists to tree
# 
# return arr.tolist()[0], arr.tolist()[1], arr.tolist()[2]
number_slider_22 = Slider(0, range=0..1)
# std method
# Array Objects
number_slider_23 = Slider(0, range=0..1)
# Instructions:
# 1. Drag and drop a hops node on the canvas.
# 2. Set path to:
# http://127.0.0.1:5000/ndarray_min
# 3. Name and toggle  component name to :
# ndarray_min
ndarray_min = Hops(
    Rows="4",
    Columns=number_slider_16,
    Axis=number_slider_20,
    CacheResultsInMemory=False,
    CacheSolveResults=False,
    RemoteDefinitionLocation="http://127.0.0.1:5000/ndarray_min",
    RemoteSolveVersion=(0, 1, 0),
    ShowInput_Enabled=False,
    ShowInput_Path=False,
    SynchronousSolve=True)  # -> Arr1, Arr2, Arr3, Arr4
# Instructions:
# 1. Drag and drop a hops node on the canvas.
# 2. Set path to:
# http://127.0.0.1:5000/ndarray_max
# 3. Name and toggle  component name to :
# ndarray_max
ndarray_max = Hops(
    Rows="4",
    Columns=number_slider_17,
    Axis=Slider(0, range=0..1),
    CacheResultsInMemory=True,
    CacheSolveResults=True,
    RemoteDefinitionLocation="http://127.0.0.1:5000/ndarray_max",
    RemoteSolveVersion=(0, 1, 0),
    ShowInput_Enabled=False,
    ShowInput_Path=False,
    SynchronousSolve=True)  # -> Arr1, Arr2, Arr3, Arr4
# Instructions:
# 1. Drag and drop a hops node on the canvas.
# 2. Set path to:
# http://127.0.0.1:5000/ndarray_argmin_05
# 3. Name and toggle  component name to :
# ndarray_argmin_05
ndarray_argmax_05 = Hops(
    Rows="4",
    Columns=Slider(4, range=0..10),
    Axis=number_slider_23,
    CacheResultsInMemory=True,
    CacheSolveResults=True,
    RemoteDefinitionLocation="http://127.0.0.1:5000/ndarray_argmax_05",
    RemoteSolveVersion=(0, 1, 0),
    ShowInput_Enabled=False,
    ShowInput_Path=False,
    SynchronousSolve=True)  # -> Arr1, Arr2, Arr3, Arr4
# Instructions:
# 1. Drag and drop a hops node on the canvas.
# 2. Set path to:
# http://127.0.0.1:5000/ndarray_argmin_05
# 3. Name and toggle  component name to :
# ndarray_argmin_05
ndarray_argmin_05 = Hops(
    Rows="4",
    Columns=number_slider_18,
    Axis=number_slider_22,
    CacheResultsInMemory=True,
    CacheSolveResults=True,
    RemoteDefinitionLocation="http://127.0.0.1:5000/ndarray_argmin_05",
    RemoteSolveVersion=(0, 1, 0),
    ShowInput_Enabled=False,
    ShowInput_Path=False,
    SynchronousSolve=True)  # -> Arr1, Arr2, Arr3, Arr4
# Instructions:
# 1. Drag and drop a hops node on the canvas.
# 2. Set path to:
# http://127.0.0.1:5000/ndarray_std_05
# 3. Name and toggle  component name to :
# ndarray_std_05
ndarray_std_05 = Hops(
    Rows="4",
    Columns=number_slider_19,
    Axis=Slider(0, range=0..1),
    CacheResultsInMemory=True,
    CacheSolveResults=True,
    RemoteDefinitionLocation="http://127.0.0.1:5000/ndarray_std_05",
    RemoteSolveVersion=(0, 1, 0),
    ShowInput_Enabled=False,
    ShowInput_Path=False,
    SynchronousSolve=True)  # -> Arr1, Arr2, Arr3, Arr4
# Instructions:
# 1. Drag and drop a hops node on the canvas.
# 2. Set path to:
# http://127.0.0.1:5000/ndarray_var_05
# 3. Name and toggle  component name to :
# ndarray_var_05
ndarray_var_05 = Hops(
    Rows="4",
    Columns=number_slider_21,
    Axis=Slider(0, range=0..1),
    CacheResultsInMemory=True,
    CacheSolveResults=True,
    RemoteDefinitionLocation="http://127.0.0.1:5000/ndarray_var_05",
    RemoteSolveVersion=(0, 1, 0),
    ShowInput_Enabled=False,
    ShowInput_Path=False,
    SynchronousSolve=True)  # -> Arr1, Arr2, Arr3, Arr4
entwine_8 = Entwine(
    Branch00=ndarray_min.Arr1,
    Branch01=ndarray_min.Arr2,
    Branch02=ndarray_min.Arr3,
    Branch03=ndarray_min.Arr4,
    FlattenInputs=True)
entwine_9 = Entwine(
    Branch00=ndarray_max.Arr1,
    Branch01=ndarray_max.Arr2,
    Branch02=ndarray_max.Arr3,
    Branch03=ndarray_max.Arr4,
    FlattenInputs=True)
entwine_10 = Entwine(
    Branch00=ndarray_argmin_05.Arr1,
    Branch01=ndarray_argmin_05.Arr2,
    Branch02=ndarray_argmin_05.Arr3,
    Branch03=ndarray_argmin_05.Arr4,
    FlattenInputs=True)
entwine_11 = Entwine(
    Branch00=ndarray_var_05.Arr1,
    Branch01=ndarray_var_05.Arr2,
    Branch02=ndarray_var_05.Arr3,
    Branch03=ndarray_var_05.Arr4,
    FlattenInputs=True)
entwine_12 = Entwine(
    Branch00=ndarray_argmax_05.Arr1,
    Branch01=ndarray_argmax_05.Arr2,
    Branch02=ndarray_argmax_05.Arr3,
    Branch03=ndarray_argmax_05.Arr4,
    FlattenInputs=True)
entwine_13 = Entwine(
    Branch00=ndarray_std_05.Arr1,
    Branch01=ndarray_std_05.Arr2,
    Branch02=ndarray_std_05.Arr3,
    Branch03=ndarray_std_05.Arr4,
    FlattenInputs=True)
panel_27 = Panel(entwine_8)
panel_28 = Panel(entwine_9)
panel_29 = Panel(entwine_13)
panel_30 = Panel(entwine_11)
panel_31 = Panel(entwine_10)
panel_32 = Panel(entwine_12)
# Boolean Arrays
# N-dimensional Array Objects
# Coerced to 1 and 0  Arrays
# N-dimensional Array Objects
# #print(arr.list_to_tree()) not working in grasshopper canvas
# # use entwine node in gh to convert lists to tree
# 
# return arr.tolist()[0], arr.tolist()[1], arr.tolist()[2]
# Any and All Methods
# N-dimensional Array Objects
# (best for Boolean Arrays)
# #print(arr.list_to_tree()) not working in grasshopper canvas
# # use entwine node in gh to convert lists to tree
# 
# return arr.tolist()[0], arr.tolist()[1], arr.tolist()[2]
number_slider_24 = Slider(4, range=0..10)
# Methods for Boolean Arrays
panel_33 = Panel("4")
# Instructions:
# 1. Drag and drop a hops node on the canvas.
# 2. Set path to:
# http://127.0.0.1:5000/ndarray_any
# 3. Name and toggle  component name to :
# ndarray_any
ndarray_any = Hops(
    Rows="4",
    Columns=Slider(4, range=0..10),
    CacheResultsInMemory=True,
    CacheSolveResults=True,
    RemoteDefinitionLocation="http://127.0.0.1:5000/ndarray_any",
    RemoteSolveVersion=(0, 1, 0),
    ShowInput_Enabled=False,
    ShowInput_Path=False,
    SynchronousSolve=True)  # -> Any, All
# Instructions:
# 1. Drag and drop a hops node on the canvas.
# 2. Set path to:
# http://127.0.0.1:5000/ndarray_sum_3
# 3. Name and toggle  component name to :
# ndarray_sum_3
ndarray_sum_3 = Hops(
    Rows=panel_33,
    Columns=number_slider_24,
    CacheResultsInMemory=False,
    CacheSolveResults=False,
    RemoteDefinitionLocation="http://127.0.0.1:5000/ndarray_sum_3",
    RemoteSolveVersion=(0, 1, 0),
    ShowInput_Enabled=False,
    ShowInput_Path=False,
    SynchronousSolve=True)  # -> NPos, NNeg
panel_34 = Panel(ndarray_any.All)
panel_35 = Panel(ndarray_any.Any)
panel_36 = Panel(ndarray_sum_3.NPos)
panel_37 = Panel(ndarray_sum_3.NNeg)
# #print(arr.list_to_tree()) not working in grasshopper canvas
# # use entwine node in gh to convert lists to tree
# 
# return arr.tolist()[0], arr.tolist()[1], arr.tolist()[2]
number_slider_25 = Slider(4, range=0..10)
# Top Level Sort Copy Method
# N-dimensional Array Objects
# (best for Boolean Arrays)
# #print(arr.list_to_tree()) not working in grasshopper canvas
# # use entwine node in gh to convert lists to tree
# 
# return arr.tolist()[0], arr.tolist()[1], arr.tolist()[2]
number_slider_26 = Slider(0, range=0..1)
# Methods for Sorting Arrays
# Sort with Axis Methods
# N-dimensional Array Objects
# (best for Boolean Arrays)
# Instructions:
# 1. Drag and drop a hops node on the canvas.
# 2. Set path to:
# http://127.0.0.1:5000/ndarray_sort
# 3. Name and toggle  component name to :
# ndarray_sort
panel_38 = Panel("4")
ndarray_sort = Hops(
    Rows=panel_38,
    Columns=number_slider_25,
    Axis=number_slider_26,
    CacheResultsInMemory=True,
    CacheSolveResults=True,
    RemoteDefinitionLocation="http://127.0.0.1:5000/ndarray_sort",
    RemoteSolveVersion=(0, 1, 0),
    ShowInput_Enabled=False,
    ShowInput_Path=False,
    SynchronousSolve=True)  # -> Arr1, Arr2, Arr3, Arr4
# Instructions:
# 1. Drag and drop a hops node on the canvas.
# 2. Set path to:
# http://127.0.0.1:5000/ndarray_top_level_sort
# 3. Name and toggle  component name to :
# ndarray_top_level_sort
ndarray_top_level_sort = Hops(
    Rows="4",
    Columns=Slider(4, range=0..10),
    CacheResultsInMemory=True,
    CacheSolveResults=True,
    RemoteDefinitionLocation="http://127.0.0.1:5000/ndarray_top_level_sort",
    RemoteSolveVersion=(0, 1, 0),
    ShowInput_Enabled=False,
    ShowInput_Path=False,
    SynchronousSolve=True)  # -> Arr1, Arr2, Arr3, Arr4
entwine_14 = Entwine(
    Branch00=ndarray_sort.Arr1,
    Branch01=ndarray_sort.Arr2,
    Branch02=ndarray_sort.Arr3,
    Branch03=ndarray_sort.Arr4,
    FlattenInputs=True)
entwine_15 = Entwine(
    Branch00=ndarray_top_level_sort.Arr1,
    Branch01=ndarray_top_level_sort.Arr2,
    Branch02=ndarray_top_level_sort.Arr3,
    Branch03=ndarray_top_level_sort.Arr4,
    FlattenInputs=True)
panel_39 = Panel(entwine_14)
panel_40 = Panel(entwine_15)
# #Array set operations
# #unique(x) #compute the sorted, unique elements in x
# #intersect1d(x, y) #compute the sorted, common elements in x and y
# #union1d(x, y) #compute the sorted union of elements
# #in1d(x, y) #compute a boolean array indicating whether each element of x is contained in y
# #setdiff1d(x, y) #set difference, elements in x that are not in y
# #setxor1d(x, y) #set symmetric differences, elements that are in either of the arrays, but not both
# Unique and other set Logic
# Sorted Unique Values  Method
# 1-dimensional Array Objects
# #print(arr.list_to_tree()) not working in grasshopper canvas
# # use entwine node in gh to convert lists to tree
# 
# return arr.tolist()[0], arr.tolist()[1], arr.tolist()[2]
gene_pool_2 = GenePool(
    Decimals=0,
    Maximum=5,
    Minimum=0,
    Value=[3.565567638, 1.485026088, 4.637795903, 2.890328422, 2.717690697, 4.337944998, 3.615065684, 3.399696761, 0.5958027814, 0.6987066547])
# #print(arr.list_to_tree()) not working in grasshopper canvas
# # use entwine node in gh to convert lists to tree
# 
# return arr.tolist()[0], arr.tolist()[1], arr.tolist()[2]
gene_pool_3 = GenePool(Decimals=0, Maximum=10, Minimum=0, Value=[6, 0, 0.05795054606, 3, 2, 5, 6])
gene_pool_4 = GenePool(Decimals=0, Maximum=10, Minimum=0, Value=[2, 5, 6])
# Tests Membership between 2 arrays  Method
# 1-dimensional Array Objects
# #print(arr.list_to_tree()) not working in grasshopper canvas
# # use entwine node in gh to convert lists to tree
# 
# return arr.tolist()[0], arr.tolist()[1], arr.tolist()[2]
gene_pool_5 = GenePool(Decimals=0, Maximum=10, Minimum=0, Value=[6, 0, 0.05795054606, 3, 2, 5, 6])
# Misc Array Set Operation Methods
# 1-dimensional Array Objects
gene_pool_6 = GenePool(Decimals=0, Maximum=10, Minimum=0, Value=[2, 5, 6])
# Instructions:
# 1. Drag and drop a hops node on the canvas.
# 2. Set path to:
# http://127.0.0.1:5000/ndarray_sort
# 3. Name and toggle  component name to :
# ndarray_sort
ndarray_unique_02 = Hops(
    List=gene_pool_2,
    CacheResultsInMemory=True,
    CacheSolveResults=True,
    RemoteDefinitionLocation="http://127.0.0.1:5000/ndarray_unique_02",
    RemoteSolveVersion=(0, 1, 0),
    ShowInput_Enabled=False,
    ShowInput_Path=False,
    SynchronousSolve=True)
# Instructions:
# 1. Drag and drop a hops node on the canvas.
# 2. Set path to:
# http://127.0.0.1:5000/ndarray_in1d
# 3. Name and toggle  component name to :
# ndarray_in1d
ndarray_in1d = Hops(
    List=gene_pool_5,
    Values=gene_pool_6,
    CacheResultsInMemory=True,
    CacheSolveResults=True,
    RemoteDefinitionLocation="http://127.0.0.1:5000/ndarray_in1d",
    RemoteSolveVersion=(0, 1, 0),
    ShowInput_Enabled=False,
    ShowInput_Path=False,
    SynchronousSolve=True)
# ndarray_intersect1d
# ndarray_union1d
# ndarray_setdiff1d
# ndarray_setxor1d
hops_2 = Hops(
    CacheResultsInMemory=True,
    CacheSolveResults=True,
    RemoteSolveVersion=(0, 1, 0),
    ShowInput_Enabled=False,
    ShowInput_Path=False,
    SynchronousSolve=True)
panel_41 = Panel(ndarray_unique_02)
panel_42 = Panel(ndarray_in1d)
