# Grasshopper definition AI_copilot_to_AI_stablediffusion_006.gh (Grasshopper 1.0.7)
# plug-ins: Hops, Kangaroo2 Components

# ----
# File Input and Output
# with Arrays
# Saving Single Array
# N-dimensional Array Objects
# Instructions:
# 1. Drag and drop a hops node on the canvas.
# 2. Set path to:
# http://127.0.0.1:5000/ndarray_save_01
# 3. Name and toggle  component name to :
# ndarray_save_01
# #print(arr.list_to_tree()) not working in grasshopper canvas
# # use entwine node in gh to convert lists to tree
# 
# return arr.tolist()[0], arr.tolist()[1], arr.tolist()[2]
# Saving Multiple Arrays
# N-dimensional Array Objects
# #print(arr.list_to_tree()) not working in grasshopper canvas
# # use entwine node in gh to convert lists to tree
# 
# return arr.tolist()[0], arr.tolist()[1], arr.tolist()[2]
# Instructions:
# 1. Drag and drop a hops node on the canvas.
# 2. Set path to:
# http://127.0.0.1:5000/ndarray_savez_03b
# 3. Name and toggle  component name to :
# ndarray_savez_03b
gene_pool = GenePool(
    Decimals=0,
    Maximum=100,
    Minimum=0,
    Value=[24.20998929, 34.13562213, 53.60529984, 69.15555143, 87.03460716, 19.75641699, 24.25707622, 40.90763141, 50.02048251, 94.81890471])
gene_pool_2 = GenePool(
    Decimals=0,
    Maximum=100,
    Minimum=0,
    Value=[46.99610558, 74.34688531, 75.23318193, 65.4357842, 0.04315357657, 45.90833124, 35.48918186, 51.12633884, 36.20782091, 52.16489148])
# From AI copilot to AI Stable Diffusion
# at www.wickersonstudios.com
# Python for Data Manipulation and Mudging
# NUMPY BASICS: Array and Vectorized
# Computation into Grasshopper for Generating
# Rhino3D Geometries
gene_pool_3 = GenePool(
    Decimals=0,
    Maximum=100,
    Minimum=0,
    Value=[24.20998929, 34.13562213, 53.60529984, 69.15555143, 87.03460716, 19.75641699, 24.25707622, 40.90763141, 50.02048251, 94.81890471])
ndarray_save_01 = Hops(
    Arr=gene_pool_3,
    CacheResultsInMemory=True,
    CacheSolveResults=True,
    RemoteDefinitionLocation="http://127.0.0.1:5000/ndarray_save_01",
    RemoteSolveVersion=(0, 1, 0),
    ShowInput_Enabled=False,
    ShowInput_Path=False,
    SynchronousSolve=True)
ndarray_savez_03b = Hops(
    Arr1=gene_pool_2,
    Arr2=gene_pool,
    CacheResultsInMemory=True,
    CacheSolveResults=True,
    RemoteDefinitionLocation="http://127.0.0.1:5000/ndarray_savez_03b",
    RemoteSolveVersion=(0, 1, 0),
    ShowInput_Enabled=False,
    ShowInput_Path=False,
    SynchronousSolve=True)  # -> ArrZa_saved, ArrZb_saved
panel = Panel(ndarray_save_01)
panel_2 = Panel(ndarray_savez_03b.ArrZa_saved)
panel_3 = Panel(ndarray_savez_03b.ArrZb_saved)

# ----
# Linear Algebra
# Matrix Multiplication Array
# N-dimensional Array Objects
# #print(arr.list_to_tree()) not working in grasshopper canvas
# # use entwine node in gh to convert lists to tree
# 
# return arr.tolist()[0], arr.tolist()[1], arr.tolist()[2]
number_slider = Slider(4, range=2..10)
number_slider_2 = Slider(6, range=0..10)
# Inverse Array Test
# N-dimensional Array Objects
# #print(arr.list_to_tree()) not working in grasshopper canvas
# # use entwine node in gh to convert lists to tree
# 
# return arr.tolist()[0], arr.tolist()[1], arr.tolist()[2]
panel_4 = Panel("4")
ndarray_inverse_03 = Hops(
    Rows=panel_4,
    Columns=panel_4,
    CacheResultsInMemory=False,
    CacheSolveResults=False,
    RemoteDefinitionLocation="http://127.0.0.1:5000/ndarray_inverse_03",
    RemoteSolveVersion=(0, 1, 0),
    ShowInput_Enabled=False,
    ShowInput_Path=False,
    SynchronousSolve=True)  # -> Arr1list1, Arr1list2, Arr1list3, Arr1list4, Arr2list1, Arr2list2, Arr2list3, Arr2list4
# #print(arr.list_to_tree()) not working in grasshopper canvas
# # use entwine node in gh to convert lists to tree
# 
# return arr.tolist()[0], arr.tolist()[1], arr.tolist()[2]
# determinant of a
# N-dimensional Array Objects
panel_5 = Panel("4")
# diag | off-diagonal elements of square matrix
# N-dimensional Array Objects
# #print(arr.list_to_tree()) not working in grasshopper canvas
# # use entwine node in gh to convert lists to tree
# 
# return arr.tolist()[0], arr.tolist()[1], arr.tolist()[2]
# trace of a
# N-dimensional Array Objects
panel_6 = Panel("4")
# Instructions:
# 1. Drag and drop a hops node on the canvas.
# 2. Set path to:
# http://127.0.0.1:5000/ndarray_matrix_multiplication
# 3. Name and toggle  component name to :
# ndarray_matrix_multiplication
ndarray_matrix_multiplication = Hops(
    RowsX=number_slider,
    ColumnsX=number_slider_2,
    RowsY=number_slider_2,
    ColumnsY=number_slider,
    CacheResultsInMemory=True,
    CacheSolveResults=True,
    RemoteDefinitionLocation="http://127.0.0.1:5000/ndarray_matrix_multiplication",
    RemoteSolveVersion=(0, 1, 0),
    ShowInput_Enabled=False,
    ShowInput_Path=False,
    SynchronousSolve=True)  # -> List1, List2
# #print(arr.list_to_tree()) not working in grasshopper canvas
# # use entwine node in gh to convert lists to tree
# 
# return arr.tolist()[0], arr.tolist()[1], arr.tolist()[2]
# #pinv #compute the Moore-Penrose pseudo-inverse of a matrix
# #qr #compute the QR decomposition
# #svd #compute the singular value decomposition (SVD)
# #solve #solve the linear system Ax = b for x, where A is a square matrix
# #lstsq #compute the least-squares solution to Ax = b
panel_7 = Panel("4")

# ----
# eigenvectors of a
# N-dimensional Array Objects
# Instructions:
# 1. Drag and drop a hops node on the canvas.
# 2. Set path to:
# http://127.0.0.1:5000/ndarray_diag_01
# 3. Name and toggle  component name to :
# ndarray_diag_01
# #print(arr.list_to_tree()) not working in grasshopper canvas
# # use entwine node in gh to convert lists to tree
# 
# return arr.tolist()[0], arr.tolist()[1], arr.tolist()[2]
# determinant of a
# N-dimensional Array Objects
panel_8 = Panel("4")
ndarray_eig_04 = Hops(
    Rows=panel_8,
    Columns=panel_8,
    CacheResultsInMemory=False,
    CacheSolveResults=False,
    RemoteDefinitionLocation="http://127.0.0.1:5000/ndarray_eig_04",
    RemoteSolveVersion=(0, 1, 0),
    ShowInput_Enabled=False,
    ShowInput_Path=False,
    SynchronousSolve=True)
panel_9 = Panel(ndarray_eig_04)

# ----
# #print(arr.list_to_tree()) not working in grasshopper canvas
# # use entwine node in gh to convert lists to tree
# 
# return arr.tolist()[0], arr.tolist()[1], arr.tolist()[2]
panel_10 = Panel("4")
# Instructions:
# 1. Drag and drop a hops node on the canvas.
# 2. Set path to:
# http://127.0.0.1:5000/ndarray_diag_01
# 3. Name and toggle  component name to :
# ndarray_diag_01
ndarray_trace_03 = Hops(
    Rows=panel_5,
    Columns=panel_5,
    CacheResultsInMemory=True,
    CacheSolveResults=True,
    RemoteDefinitionLocation="http://127.0.0.1:5000/ndarray_trace_03",
    RemoteSolveVersion=(0, 1, 0),
    ShowInput_Enabled=False,
    ShowInput_Path=False,
    SynchronousSolve=True)
# Instructions:
# 1. Drag and drop a hops node on the canvas.
# 2. Set path to:
# http://127.0.0.1:5000/ndarray_diag_01
# 3. Name and toggle  component name to :
# ndarray_diag_01
ndarray_det_01 = Hops(
    Rows=panel_7,
    Columns=panel_7,
    CacheResultsInMemory=True,
    CacheSolveResults=True,
    RemoteDefinitionLocation="http://127.0.0.1:5000/ndarray_det_01",
    RemoteSolveVersion=(0, 1, 0),
    ShowInput_Enabled=False,
    ShowInput_Path=False,
    SynchronousSolve=True)
# Instructions:
# 1. Drag and drop a hops node on the canvas.
# 2. Set path to:
# http://127.0.0.1:5000/ndarray_diag_01
# 3. Name and toggle  component name to :
# ndarray_diag_01
ndarray_diag_01 = Hops(
    Rows=panel_6,
    Columns=panel_6,
    CacheResultsInMemory=False,
    CacheSolveResults=False,
    RemoteDefinitionLocation="http://127.0.0.1:5000/ndarray_diag_01",
    RemoteSolveVersion=(0, 1, 0),
    ShowInput_Enabled=False,
    ShowInput_Path=False,
    SynchronousSolve=True)
# Instructions:
# 1. Drag and drop a hops node on the canvas.
# 2. Set path to:
# http://127.0.0.1:5000/ndarray_diag_01
# 3. Name and toggle  component name to :
# ndarray_diag_01
ndarray_det_01_2 = Hops(
    Rows=panel_10,
    Columns=panel_10,
    CacheResultsInMemory=True,
    CacheSolveResults=True,
    RemoteDefinitionLocation="http://127.0.0.1:5000/ndarray_det_01",
    RemoteSolveVersion=(0, 1, 0),
    ShowInput_Enabled=False,
    ShowInput_Path=False,
    SynchronousSolve=True)
# Instructions:
# 1. Drag and drop a hops node on the canvas.
# 2. Set path to:
# http://127.0.0.1:5000/ndarray_inverse_03
# 3. Name and toggle  component name to :
# ndarray_inverse_03
entwine = Entwine(
    Branch00=ndarray_inverse_03.Arr1list1,
    Branch01=ndarray_inverse_03.Arr1list2,
    Branch02=ndarray_inverse_03.Arr1list3,
    Branch03=ndarray_inverse_03.Arr1list4,
    FlattenInputs=True)
entwine_2 = Entwine(
    Branch00=ndarray_inverse_03.Arr2list1,
    Branch01=ndarray_inverse_03.Arr2list2,
    Branch02=ndarray_inverse_03.Arr2list3,
    Branch03=ndarray_inverse_03.Arr2list4,
    FlattenInputs=True)
panel_11 = Panel(ndarray_matrix_multiplication.List2)
panel_12 = Panel(ndarray_matrix_multiplication.List1)
panel_13 = Panel(ndarray_diag_01)
panel_14 = Panel(entwine_2)
panel_15 = Panel(ndarray_trace_03)
panel_16 = Panel(ndarray_det_01)
panel_17 = Panel(ndarray_det_01_2)
panel_18 = Panel(entwine)

# ----
# Data Visualization
construct_point = ConstructPoint(XCoordinate=panel_12, YCoordinate=graft(panel_11), ZCoordinate=0)
number_slider_3 = Slider(0.19, range=0..1)
circle = Circle(Plane=construct_point, Radius=number_slider_3)
region_union = RegionUnion(Curves=circle)
unit_z = UnitZ(Factor=Slider(3, range=0..3))
curve = Curve(graft(region_union))
move = Move(Geometry=region_union, Motion=unit_z)  # -> graft(Geometry), Transform
area = Area(Geometry=move.Geometry)  # -> Area, Centroid
shift_list = ShiftList(List=flatten(area.Centroid), Shift=Slider(5, range=0..10), Wrap=True)
line = Line(StartPoint=flatten(area.Centroid), EndPoint=shift_list)
join_curves = JoinCurves(Curves=line, Preserve=False)
rebuild_curve = RebuildCurve(Curve=join_curves, Degree="3", Count=10, Tangents=False)
dispatch = Dispatch(List=rebuild_curve, DispatchPattern=[True, False])  # -> ListA, ListB
pipe = Pipe(Curve=dispatch.ListB, Radius=number_slider_3, Caps="1")
loft = Loft(
    Curves=[curve, move.Geometry],
    Options={Adjust=False, Closed=False, LoftEnds=0, LoftSimp=0, LoftType=0, Rebuild=10, Refit=0.01})  # -> flatten(Loft)
pipe_2 = Pipe(Curve=dispatch.ListA, Radius=number_slider_3, Caps="1")
# #print(arr.list_to_tree()) not working in grasshopper canvas
# # use entwine node in gh to convert lists to tree
# 
# return arr.tolist()[0], arr.tolist()[1], arr.tolist()[2]
geometry = Geometry([loft, pipe_2, pipe])

# ----
# Multiple Random Walkers
# 2-dimensional Array Objects
# #print(arr.list_to_tree()) not working in grasshopper canvas
# # use entwine node in gh to convert lists to tree
# 
# return arr.tolist()[0], arr.tolist()[1], arr.tolist()[2]
number_slider_4 = Slider(100, range=0..100)
number_slider_5 = Slider(0, range=0..100)
ndarray_random_walk_02 = Hops(
    Nwalks="4",
    Nsteps=number_slider_4,
    CacheResultsInMemory=True,
    CacheSolveResults=True,
    RemoteDefinitionLocation="http://127.0.0.1:5000/ndarray_random_walk_02",
    RemoteSolveVersion=(0, 1, 0),
    ShowInput_Enabled=False,
    ShowInput_Path=False,
    SynchronousSolve=True)  # -> WalksList1, WalksList2, WalksList3, WalksList4
# #Example: Random Walks
# to End our Numpy : Basics
# Bundle of Scipts
# Single Random Walk
# 1-dimensional Array Objects
ndarray_random_walk_01 = Hops(
    Nsteps=number_slider_5,
    CacheResultsInMemory=False,
    CacheSolveResults=False,
    RemoteDefinitionLocation="http://127.0.0.1:5000/ndarray_random_walk_01",
    RemoteSolveVersion=(0, 1, 0),
    ShowInput_Enabled=False,
    ShowInput_Path=False,
    SynchronousSolve=True)
# Instructions:
# 1. Drag and drop a hops node on the canvas.
# 2. Set path to:
# http://127.0.0.1:5000/ndarray_random_walk_02
# 3. Name and toggle  component name to :
# ndarray_random_walk_02
entwine_3 = Entwine(
    Branch00=ndarray_random_walk_02.WalksList1,
    Branch01=ndarray_random_walk_02.WalksList2,
    Branch02=ndarray_random_walk_02.WalksList3,
    Branch03=ndarray_random_walk_02.WalksList4,
    FlattenInputs=True)
# Instructions:
# 1. Drag and drop a hops node on the canvas.
# 2. Set path to:
# http://127.0.0.1:5000/ndarray_random_walk_01
# 3. Name and toggle  component name to :
# ndarray_random_walk_01
panel_19 = Panel(ndarray_random_walk_01)
panel_20 = Panel(entwine_3)

# ----
# Data Visualization
sphere = Sphere(Base=PlaneXY(0, 0, 0), Radius="2")
number_slider_6 = Slider(100, range=0..100)
populate_geometry = PopulateGeometry(Geometry=sphere, Count=number_slider_5, Seed=1)
deconstruct = Deconstruct(Point=populate_geometry)  # -> XComponent, YComponent, ZComponent
negative = Negative(Value=number_slider_6)
addition = Addition(A=deconstruct.XComponent, B=panel_19)
construct_domain = ConstructDomain(DomainStart=negative, DomainEnd=number_slider_6)
construct_point_2 = ConstructPoint(XCoordinate=addition, YCoordinate=deconstruct.YComponent, ZCoordinate=deconstruct.ZComponent)
interpolate = Interpolate(Vertices=construct_point_2, Degree=3, Periodic=False, KnotStyle=1)  # -> Curve, Length, Domain
rectangle = Rectangle(Plane=PlaneXY(0, 0, 0), XSize=construct_domain, YSize=construct_domain, Radius=0)  # -> Rectangle, Length
multipipe = MultiPipe(Curves=interpolate.Curve, NodeSize=".1", EndOffset=1, StrutSize=1, Segment=0, KinkAngle=0.6, CubeFit=0, Caps=0)
boundary_surfaces = BoundarySurfaces(Edges=rectangle.Rectangle)
custom_preview = CustomPreview(Geometry=multipipe, Material=graft(ColourSwatch(SwatchColor=RGB(0, 255, 0))))

# ----
# Data Visualization
sphere_2 = Sphere(Base=PlaneXY(0, 0, 0), Radius="2")
number_slider_7 = Slider(100, range=0..100)
populate_geometry_2 = PopulateGeometry(Geometry=sphere_2, Count=number_slider_4, Seed=1)
deconstruct_2 = Deconstruct(Point=populate_geometry_2)  # -> XComponent, YComponent, ZComponent
negative_2 = Negative(Value=number_slider_7)
addition_2 = Addition(A=deconstruct_2.XComponent, B=panel_20)
construct_domain_2 = ConstructDomain(DomainStart=negative_2, DomainEnd=number_slider_7)
construct_point_3 = ConstructPoint(XCoordinate=addition_2, YCoordinate=deconstruct_2.YComponent, ZCoordinate=deconstruct_2.ZComponent)
interpolate_2 = Interpolate(Vertices=construct_point_3, Degree=3, Periodic=False, KnotStyle=1)  # -> Curve, Length, Domain
rectangle_2 = Rectangle(Plane=PlaneXY(0, 0, 0), XSize=construct_domain_2, YSize=construct_domain_2, Radius=0)  # -> Rectangle, Length
multipipe_2 = MultiPipe(Curves=interpolate_2.Curve, NodeSize=".1", EndOffset=1, StrutSize=1, Segment=0, KinkAngle=0.6, CubeFit=0, Caps=0)
boundary_surfaces_2 = BoundarySurfaces(Edges=rectangle_2.Rectangle)
custom_preview_2 = CustomPreview(
    Geometry=multipipe_2,
    Material=graft([ColourSwatch(SwatchColor=RGB(255, 0, 255)), ColourSwatch(SwatchColor=RGB(0, 255, 255)), ColourSwatch(SwatchColor=RGB(0, 0, 255)), ColourSwatch(SwatchColor=RGB(255, 0, 0))]))
