# Grasshopper definition AI_copilot_to_AI_stablediffusion_007.gh (Grasshopper 1.0.7)
# plug-ins: Hops, Kangaroo2 Components

# From AI copilot to AI Stable Diffusion
# at www.wickersonstudios.com
# Python for Data Manipulation and Mudging
# ADVANCED NUMPY: Array and Vectorized
# Computation into Grasshopper for Generating
# Rhino3D Geometries
# ndarray Object Internals
# Saving Single Array
# N-dimensional Array Objects
# #print(arr.list_to_tree()) not working in grasshopper canvas
# # use entwine node in gh to convert lists to tree
# 
# return arr.tolist()[0], arr.tolist()[1], arr.tolist()[2]
number_slider = Slider(3, range=0..10)
# np.issubtype Method for int and float
# N-dimensional Array Objects
number_slider_2 = Slider(5, range=0..10)
# #print(arr.list_to_tree()) not working in grasshopper canvas
# # use entwine node in gh to convert lists to tree
# 
# return arr.tolist()[0], arr.tolist()[1], arr.tolist()[2]
range = Range(Domain=Domain(0, 1), Steps=10)
# #print(arr.list_to_tree()) not working in grasshopper canvas
# # use entwine node in gh to convert lists to tree
# 
# return arr.tolist()[0], arr.tolist()[1], arr.tolist()[2]
range_2 = Range(Domain=Domain(0, 1), Steps=10)
# np.mro Method for int and float
# N-dimensional Array Objects
series = Series(Start=0, Step=1, Count=10)
series_2 = Series(Start=0, Step=1, Count=10)
# Instructions:
# 1. Drag and drop a hops node on the canvas.
# 2. Set path to:
# http://127.0.0.1:5000/ndarray_strides_02
# 3. Name and toggle  component name to :
# ndarray_strides_02
ndarray_strides_02 = Hops(
    Rows=number_slider,
    Columns=Slider(4, range=0..10),
    Depth=number_slider_2,
    CacheResultsInMemory=False,
    CacheSolveResults=False,
    RemoteDefinitionLocation="http://127.0.0.1:5000/ndarray_strides_02",
    RemoteSolveVersion=(0, 1, 0),
    ShowInput_Enabled=False,
    ShowInput_Path=False,
    SynchronousSolve=True)
# Instructions:
# 1. Drag and drop a hops node on the canvas.
# 2. Set path to:
# http://127.0.0.1:5000/ndarray_issubdtype_01
# 3. Name and toggle  component name to :
# ndarray_issubdtype_01
ndarray_issubdtype_01 = Hops(
    Ints=range,
    Floats=series,
    CacheResultsInMemory=True,
    CacheSolveResults=True,
    RemoteDefinitionLocation="http://127.0.0.1:5000/ndarray_issubdtype_01",
    RemoteSolveVersion=(0, 1, 0),
    ShowInput_Enabled=False,
    ShowInput_Path=False,
    SynchronousSolve=True)  # -> Ints, Floats
# Instructions:
# 1. Drag and drop a hops node on the canvas.
# 2. Set path to:
# http://127.0.0.1:5000/ndarray_mro_01
# 3. Name and toggle  component name to :
# ndarray_mro_01
ndarray_mro_01 = Hops(
    Float64=range_2,
    Int32=series_2,
    CacheResultsInMemory=True,
    CacheSolveResults=True,
    RemoteDefinitionLocation="http://127.0.0.1:5000/ndarray_mro_01",
    RemoteSolveVersion=(0, 1, 0),
    ShowInput_Enabled=False,
    ShowInput_Path=False,
    SynchronousSolve=True)  # -> Float64, Int32
panel = Panel(ndarray_issubdtype_01.Floats)
panel_2 = Panel(ndarray_issubdtype_01.Ints)
panel_3 = Panel(ndarray_strides_02)
panel_4 = Panel(ndarray_mro_01.Float64)
panel_5 = Panel(ndarray_mro_01.Int32)

# ----
# Reshape Array
# N-dimensional Array Objects
number_slider_3 = Slider(20, range=0..40)
series_3 = Series(Start=0, Step=1, Count=number_slider_3)
division = Division(A=number_slider_3, B="4")

# ----
# Advanced Array Manipulation
# Reshape Array
# N-dimensional Array Objects
# #print(arr.list_to_tree()) not working in grasshopper canvas
# # use entwine node in gh to convert lists to tree
# 
# return arr.tolist()[0], arr.tolist()[1], arr.tolist()[2]
# Reshape Array
# N-dimensional Array Objects
number_slider_4 = Slider(2, range=0..10)
# Flattening  an Array
# N-dimensional Array Objects
number_slider_5 = Slider(4, range=0..10)
number_slider_6 = Slider(4, range=0..10)
# Raveling an Array
# N-dimensional Array Objects
number_slider_7 = Slider(2, range=0..10)
# Instructions:
# 1. Drag and drop a hops node on the canvas.
# 2. Set path to:
# http://127.0.0.1:5000/ndarray_reshape_02
# 3. Name and toggle  component name to :
# ndarray_reshape_02
ndarray_reshape_02 = Hops(
    Rows="4",
    Columns=number_slider_4,
    CacheResultsInMemory=True,
    CacheSolveResults=True,
    RemoteDefinitionLocation="http://127.0.0.1:5000/ndarray_reshape_02",
    RemoteSolveVersion=(0, 1, 0),
    ShowInput_Enabled=False,
    ShowInput_Path=False,
    SynchronousSolve=True)  # -> ArrList1, ArrList2, ArrList3, ArrList4
entwine = Entwine(
    Branch00=ndarray_reshape_02.ArrList1,
    Branch01=ndarray_reshape_02.ArrList2,
    Branch02=ndarray_reshape_02.ArrList3,
    Branch03=ndarray_reshape_02.ArrList4,
    FlattenInputs=True)
# Instructions:
# 1. Drag and drop a hops node on the canvas.
# 2. Set path to:
# http://127.0.0.1:5000/ndarray_ravel_02
# 3. Name and toggle  component name to :
# ndarray_ravel_02
ndarray_ravel_02 = Hops(
    Rows="4",
    Columns=number_slider_5,
    CacheResultsInMemory=True,
    CacheSolveResults=True,
    RemoteDefinitionLocation="http://127.0.0.1:5000/ndarray_ravel_02",
    RemoteSolveVersion=(0, 1, 0),
    ShowInput_Enabled=False,
    ShowInput_Path=False,
    SynchronousSolve=True)
# Instructions:
# 1. Drag and drop a hops node on the canvas.
# 2. Set path to:
# http://127.0.0.1:5000/ndarray_reshape_03
# 3. Name and toggle  component name to :
# ndarray_reshape_03
ndarray_reshape_03 = Hops(
    List1=series_3,
    Rows="4",
    Columns=division,
    CacheResultsInMemory=False,
    CacheSolveResults=False,
    RemoteDefinitionLocation="http://127.0.0.1:5000/ndarray_reshape_03",
    RemoteSolveVersion=(0, 1, 0),
    ShowInput_Enabled=False,
    ShowInput_Path=False,
    SynchronousSolve=True)  # -> ArrList1, ArrList2, ArrList3, ArrList4
# Instructions:
# 1. Drag and drop a hops node on the canvas.
# 2. Set path to:
# http://127.0.0.1:5000/ndarray_reshape_04
# 3. Name and toggle  component name to :
# ndarray_reshape_04
ndarray_reshape_04 = Hops(
    Rows="4",
    Columns=number_slider_7,
    CacheResultsInMemory=True,
    CacheSolveResults=True,
    RemoteDefinitionLocation="http://127.0.0.1:5000/ndarray_reshape_04",
    RemoteSolveVersion=(0, 1, 0),
    ShowInput_Enabled=False,
    ShowInput_Path=False,
    SynchronousSolve=True)  # -> ArrList1, ArrList2, ArrList3, ArrList4
# Instructions:
# 1. Drag and drop a hops node on the canvas.
# 2. Set path to:
# http://127.0.0.1:5000/ndarray_flatten_01
# 3. Name and toggle  component name to :
# ndarray_flatten_01
ndarray_flatten_01 = Hops(
    Rows="4",
    Columns=Slider(4, range=0..10),
    CacheResultsInMemory=True,
    CacheSolveResults=True,
    RemoteDefinitionLocation="http://127.0.0.1:5000/ndarray_flatten_01",
    RemoteSolveVersion=(0, 1, 0),
    ShowInput_Enabled=False,
    ShowInput_Path=False,
    SynchronousSolve=True)
panel_6 = Panel(entwine)
entwine_2 = Entwine(
    Branch00=ndarray_reshape_04.ArrList1,
    Branch01=ndarray_reshape_04.ArrList2,
    Branch02=ndarray_reshape_04.ArrList3,
    Branch03=ndarray_reshape_04.ArrList4,
    FlattenInputs=True)
entwine_3 = Entwine(
    Branch00=ndarray_reshape_03.ArrList1,
    Branch01=ndarray_reshape_03.ArrList2,
    Branch02=ndarray_reshape_03.ArrList3,
    Branch03=ndarray_reshape_03.ArrList4,
    FlattenInputs=True)
panel_7 = Panel(ndarray_flatten_01)
panel_8 = Panel(ndarray_ravel_02)
panel_9 = Panel(entwine_3)
panel_10 = Panel(entwine_2)
# #Must hardcore in rows equal to # of outputs
# (in the grasshopper canvas, the terminal will show any array of parametric rows)
# 
# #print(arr.list_to_tree()) not working in grasshopper canvas
# # use entwine node in gh to convert lists to tree
# return arr.tolist()[0], arr.tolist()[1], arr.tolist()[2]
# C Versus FORTRAN Order
# Flattening  an Array
# N-dimensional Array Objects
number_slider_8 = Slider(12, range=0..100)
series_4 = Series(Start=0, Step=1, Count=number_slider_8)
# Data Visualization
panel_11 = Panel("3")
# Instructions:
# 1. Drag and drop a hops node on the canvas.
# 2. Set path to:
# http://127.0.0.1:5000/ndarray_reshape_02
# 3. Name and toggle  component name to :
# ndarray_reshape_02
ndarray_reshape_02_2 = Hops(
    List1=series_4,
    Rows="4",
    Columns=panel_11,
    CacheResultsInMemory=True,
    CacheSolveResults=True,
    RemoteDefinitionLocation="http://127.0.0.1:5000/ndarray_reshape_02",
    RemoteSolveVersion=(0, 1, 0),
    ShowInput_Enabled=False,
    ShowInput_Path=False,
    SynchronousSolve=True)  # -> ArrList1, ArrList2, ArrList3, ArrList4
entwine_4 = Entwine(
    Branch00=ndarray_reshape_02_2.ArrList1,
    Branch01=ndarray_reshape_02_2.ArrList2,
    Branch02=ndarray_reshape_02_2.ArrList3,
    Branch03=ndarray_reshape_02_2.ArrList4,
    FlattenInputs=True)
panel_12 = Panel(series_4)
# Concatenating and
# Splitting Arrays
# Concatenating  two
# 2-dimensional Array Objects
# by axis=0
panel_13 = Panel(entwine_4)
number_slider_9 = Slider(1, range=0..10)
# vstack Method
# N-dimensional Array Objects
number_slider_10 = Slider(9, range=0..10)
# #Must hardcode in rows equal to # of outputs
# (in the grasshopper canvas, the terminal will show any array of parametric rows)
# 
# #print(arr.list_to_tree()) not working in grasshopper canvas
# # use entwine node in gh to convert lists to tree
# return arr.tolist()[0], arr.tolist()[1], arr.tolist()[2]
number_slider_11 = Slider(1, range=0..10)
# Concatenating  two
# 2-dimensional Array Objects
# by axis=1
number_slider_12 = Slider(9, range=0..10)
number_slider_13 = Slider(1, range=0..10)
# hstack Method
# N-dimensional Array Objects
number_slider_14 = Slider(9, range=0..10)
number_slider_15 = Slider(1, range=0..10)
series_5 = Series(Start=number_slider_9, Step=number_slider_9, Count="3")
series_6 = Series(Start=Slider(4, range=0..10), Step=number_slider_9, Count="3")
series_7 = Series(Start=Slider(7, range=0..10), Step=number_slider_9, Count="3")
series_8 = Series(Start=number_slider_10, Step=number_slider_9, Count="3")
series_9 = Series(Start=number_slider_11, Step=number_slider_11, Count="3")
series_10 = Series(Start=Slider(4, range=0..10), Step=number_slider_11, Count="3")
series_11 = Series(Start=Slider(7, range=0..10), Step=number_slider_11, Count="3")
series_12 = Series(Start=number_slider_12, Step=number_slider_11, Count="3")
series_13 = Series(Start=number_slider_13, Step=number_slider_13, Count="3")
series_14 = Series(Start=Slider(4, range=0..10), Step=number_slider_13, Count="3")
series_15 = Series(Start=Slider(7, range=0..10), Step=number_slider_13, Count="3")
series_16 = Series(Start=number_slider_14, Step=number_slider_13, Count="3")
series_17 = Series(Start=number_slider_15, Step=number_slider_15, Count="3")
series_18 = Series(Start=Slider(4, range=0..10), Step=number_slider_15, Count="3")
series_19 = Series(Start=Slider(7, range=0..10), Step=number_slider_15, Count="3")
series_20 = Series(Start=Slider(9, range=0..10), Step=number_slider_15, Count="3")
# Instructions:
# 1. Drag and drop a hops node on the canvas.
# 2. Set path to:
# http://127.0.0.1:5000/ndarray_hstack_01
# 3. Name and toggle  component name to :
# ndarray_hstack_01
ndarray_hstack_01 = Hops(
    List1=series_17,
    List2=series_18,
    List3=series_19,
    List4=series_20,
    CacheResultsInMemory=True,
    CacheSolveResults=True,
    RemoteDefinitionLocation="http://127.0.0.1:5000/ndarray_hstack_01",
    RemoteSolveVersion=(0, 1, 0),
    ShowInput_Enabled=False,
    ShowInput_Path=False,
    SynchronousSolve=True)  # -> ArrList1, ArrList2
# Instructions:
# 1. Drag and drop a hops node on the canvas.
# 2. Set path to:
# http://127.0.0.1:5000/ndarray_concatenate_02
# 3. Name and toggle  component name to :
# ndarray_concatenate_02
ndarray_concatenate_02 = Hops(
    List1=series_9,
    List2=series_10,
    List3=series_11,
    List4=series_12,
    CacheResultsInMemory=True,
    CacheSolveResults=True,
    RemoteDefinitionLocation="http://127.0.0.1:5000/ndarray_concatenate_02",
    RemoteSolveVersion=(0, 1, 0),
    ShowInput_Enabled=False,
    ShowInput_Path=False,
    SynchronousSolve=True)  # -> ArrList1, ArrList2, ArrList3, ArrList4
# Instructions:
# 1. Drag and drop a hops node on the canvas.
# 2. Set path to:
# http://127.0.0.1:5000/ndarray_concatenate_03
# 3. Name and toggle  component name to :
# ndarray_concatenate_03
ndarray_concatenate_03 = Hops(
    List1=series_5,
    List2=series_6,
    List3=series_7,
    List4=series_8,
    CacheResultsInMemory=True,
    CacheSolveResults=True,
    RemoteDefinitionLocation="http://127.0.0.1:5000/ndarray_concatenate_03",
    RemoteSolveVersion=(0, 1, 0),
    ShowInput_Enabled=False,
    ShowInput_Path=False,
    SynchronousSolve=True)  # -> ArrList1, ArrList2
# Instructions:
# 1. Drag and drop a hops node on the canvas.
# 2. Set path to:
# http://127.0.0.1:5000/ndarray_vstack_01
# 3. Name and toggle  component name to :
# ndarray_vstack_01
ndarray_vstack_01 = Hops(
    List1=series_13,
    List2=series_14,
    List3=series_15,
    List4=series_16,
    CacheResultsInMemory=True,
    CacheSolveResults=True,
    RemoteDefinitionLocation="http://127.0.0.1:5000/ndarray_vstack_01",
    RemoteSolveVersion=(0, 1, 0),
    ShowInput_Enabled=False,
    ShowInput_Path=False,
    SynchronousSolve=True)  # -> ArrList1, ArrList2, ArrList3, ArrList4
entwine_5 = Entwine(Branch00=ndarray_concatenate_03.ArrList1, Branch01=ndarray_concatenate_03.ArrList2, FlattenInputs=True)
entwine_6 = Entwine(
    Branch00=ndarray_vstack_01.ArrList1,
    Branch01=ndarray_vstack_01.ArrList2,
    Branch02=ndarray_vstack_01.ArrList3,
    Branch03=ndarray_vstack_01.ArrList4,
    FlattenInputs=True)
entwine_7 = Entwine(Branch00=ndarray_hstack_01.ArrList1, Branch01=ndarray_hstack_01.ArrList2, FlattenInputs=True)
entwine_8 = Entwine(
    Branch00=ndarray_concatenate_02.ArrList1,
    Branch01=ndarray_concatenate_02.ArrList2,
    Branch02=ndarray_concatenate_02.ArrList3,
    Branch03=ndarray_concatenate_02.ArrList4,
    FlattenInputs=True)
panel_14 = Panel(entwine_5)
panel_15 = Panel(entwine_6)
panel_16 = Panel(entwine_7)
panel_17 = Panel(entwine_8)
# row-stack Method
# N-dimensional Array Objects
number_slider_16 = Slider(1, range=0..10)
# column-stack Method
# N-dimensional Array Objects
number_slider_17 = Slider(9, range=0..10)
number_slider_18 = Slider(1, range=0..10)
series_21 = Series(Start=number_slider_16, Step=number_slider_16, Count="3")
series_22 = Series(Start=Slider(4, range=0..10), Step=number_slider_16, Count="3")
series_23 = Series(Start=Slider(7, range=0..10), Step=number_slider_16, Count="3")
series_24 = Series(Start=number_slider_17, Step=number_slider_16, Count="3")
series_25 = Series(Start=number_slider_18, Step=number_slider_18, Count="3")
series_26 = Series(Start=Slider(4, range=0..10), Step=number_slider_18, Count="3")
series_27 = Series(Start=Slider(7, range=0..10), Step=number_slider_18, Count="3")
series_28 = Series(Start=Slider(9, range=0..10), Step=number_slider_18, Count="3")
# Instructions:
# 1. Drag and drop a hops node on the canvas.
# 2. Set path to:
# http://127.0.0.1:5000/ndarray_row_stack_01
# 3. Name and toggle  component name to :
# ndarray_row_stack_01
ndarray_row_stack_01 = Hops(
    List1=series_21,
    List2=series_22,
    List3=series_23,
    List4=series_24,
    CacheResultsInMemory=True,
    CacheSolveResults=True,
    RemoteDefinitionLocation="http://127.0.0.1:5000/ndarray_row_stack_01",
    RemoteSolveVersion=(0, 1, 0),
    ShowInput_Enabled=False,
    ShowInput_Path=False,
    SynchronousSolve=True)  # -> ArrList1, ArrList2, ArrList3, ArrList4
# Instructions:
# 1. Drag and drop a hops node on the canvas.
# 2. Set path to:
# http://127.0.0.1:5000/ndarray_column_stack_01
# 3. Name and toggle  component name to :
# ndarray_column_stack_01
ndarray_column_stack_01 = Hops(
    List1=series_25,
    List2=series_26,
    List3=series_27,
    List4=series_28,
    CacheResultsInMemory=True,
    CacheSolveResults=True,
    RemoteDefinitionLocation="http://127.0.0.1:5000/ndarray_column_stack_01",
    RemoteSolveVersion=(0, 1, 0),
    ShowInput_Enabled=False,
    ShowInput_Path=False,
    SynchronousSolve=True)  # -> ArrList1, ArrList2
entwine_9 = Entwine(Branch00=ndarray_column_stack_01.ArrList1, Branch01=ndarray_column_stack_01.ArrList2, FlattenInputs=True)
entwine_10 = Entwine(
    Branch00=ndarray_row_stack_01.ArrList1,
    Branch01=ndarray_row_stack_01.ArrList2,
    Branch02=ndarray_row_stack_01.ArrList3,
    Branch03=ndarray_row_stack_01.ArrList4,
    FlattenInputs=True)
# dstack Method
# N-dimensional Array Objects
panel_18 = Panel(entwine_10)
panel_19 = Panel(entwine_9)
number_slider_19 = Slider(1, range=0..10)
series_29 = Series(Start=number_slider_19, Step=number_slider_19, Count="2")
series_30 = Series(Start=Slider(3, range=0..10), Step=number_slider_19, Count="2")
series_31 = Series(Start=Slider(5, range=0..10), Step=number_slider_19, Count="2")
series_32 = Series(Start=Slider(7, range=0..10), Step=number_slider_19, Count="2")
# Instructions:
# 1. Drag and drop a hops node on the canvas.
# 2. Set path to:
# http://127.0.0.1:5000/ndarray_dstack_01
# 3. Name and toggle  component name to :
# ndarray_dstack_01
ndarray_dstack_01 = Hops(
    List1=series_29,
    List2=series_30,
    List3=series_31,
    List4=series_32,
    CacheResultsInMemory=False,
    CacheSolveResults=False,
    RemoteDefinitionLocation="http://127.0.0.1:5000/ndarray_dstack_01",
    RemoteSolveVersion=(0, 1, 0),
    ShowInput_Enabled=False,
    ShowInput_Path=False,
    SynchronousSolve=True)  # -> Arr1List1, Arr1List2, Arr2List1, Arr2List2
entwine_11 = Entwine(
    Branch00=ndarray_dstack_01.Arr1List1,
    Branch01=ndarray_dstack_01.Arr1List2,
    Branch02=ndarray_dstack_01.Arr2List1,
    Branch03=ndarray_dstack_01.Arr2List2,
    FlattenInputs=True)
panel_20 = Panel(entwine_11)
# split Method
# N-dimensional Array Objects
number_slider_20 = Slider(5, range=0..10)
# hsplit Method
# N-dimensional Array Objects
number_slider_21 = Slider(5, range=0..10)
# vsplit Method
# N-dimensional Array Objects
number_slider_22 = Slider(5, range=0..10)
number_slider_23 = Slider(2, range=1..10)
# Stacking Helpers: r_
# N-dimensional Array Objects
# #a bit useless for the
# grasshopper canvas
gene_pool = GenePool(Decimals=0, Maximum=100, Minimum=0, Value=[35.83469458, 10.58182121])
gene_pool_2 = GenePool(Decimals=0, Maximum=100, Minimum=0, Value=[63.66239677, 78.14013175])
gene_pool_3 = GenePool(Decimals=0, Maximum=100, Minimum=0, Value=[27.45952514, 90.93277026])
gene_pool_4 = GenePool(Decimals=0, Maximum=100, Minimum=0, Value=[49.81207547, 32.51855235])
gene_pool_5 = GenePool(Decimals=0, Maximum=100, Minimum=0, Value=[10.12256127, 50.24641876])
# Stacking Helpers: c_
# N-dimensional Array Objects
gene_pool_6 = GenePool(Decimals=0, Maximum=100, Minimum=0, Value=[38.03918694, 93.56926912])
number_slider_24 = Slider(2, range=1..10)
# Instructions:
# 1. Drag and drop a hops node on the canvas.
# 2. Set path to:
# http://127.0.0.1:5000/ndarray_split_16
# 3. Name and toggle  component name to :
# ndarray_split_16
ndarray_split_16 = Hops(
    Rows=number_slider_20,
    Columns=Slider(2, range=0..10),
    SplitStart=Slider(1, range=0..10),
    SplitEnd=Slider(3, range=0..10),
    CacheResultsInMemory=False,
    CacheSolveResults=False,
    RemoteDefinitionLocation="http://127.0.0.1:5000/ndarray_split_16",
    RemoteSolveVersion=(0, 1, 0),
    ShowInput_Enabled=False,
    ShowInput_Path=False,
    SynchronousSolve=True)  # -> First, Second, Third
# Instructions:
# 1. Drag and drop a hops node on the canvas.
# 2. Set path to:
# http://127.0.0.1:5000/ndarray_vsplit_01
# 3. Name and toggle  component name to :
# ndarray_vsplit_01
ndarray_vsplit_01 = Hops(
    Rows=number_slider_22,
    Columns=Slider(2, range=0..10),
    SplitStart=Slider(1, range=0..10),
    SplitEnd=Slider(3, range=0..10),
    CacheResultsInMemory=False,
    CacheSolveResults=False,
    RemoteDefinitionLocation="http://127.0.0.1:5000/ndarray_vsplit_01",
    RemoteSolveVersion=(0, 1, 0),
    ShowInput_Enabled=False,
    ShowInput_Path=False,
    SynchronousSolve=True)  # -> First, Second
# Instructions:
# 1. Drag and drop a hops node on the canvas.
# 2. Set path to:
# http://127.0.0.1:5000/ndarray_r_02
# 3. Name and toggle  component name to :
# ndarray_r_02
ndarray_r_02 = Hops(
    List1=gene_pool,
    List2=gene_pool_2,
    List3=gene_pool_3,
    List4=gene_pool_4,
    List5=gene_pool_5,
    List6=gene_pool_6,
    CacheResultsInMemory=True,
    CacheSolveResults=True,
    RemoteDefinitionLocation="http://127.0.0.1:5000/ndarray_r_02",
    RemoteSolveVersion=(0, 1, 0),
    ShowInput_Enabled=False,
    ShowInput_Path=False,
    SynchronousSolve=True)  # -> ArrList1, ArrList2, ArrList3, ArrList4, ArrList5, ArrList6
# Instructions:
# 1. Drag and drop a hops node on the canvas.
# 2. Set path to:
# http://127.0.0.1:5000/ndarray_hsplit_01
# 3. Name and toggle  component name to :
# ndarray_hsplit_01
ndarray_hsplit_01 = Hops(
    Rows=number_slider_21,
    Columns=Slider(2, range=0..10),
    SplitStart=Slider(1, range=0..10),
    SplitEnd=Slider(3, range=0..10),
    CacheResultsInMemory=True,
    CacheSolveResults=True,
    RemoteDefinitionLocation="http://127.0.0.1:5000/ndarray_hsplit_01",
    RemoteSolveVersion=(0, 1, 0),
    ShowInput_Enabled=False,
    ShowInput_Path=False,
    SynchronousSolve=True)  # -> First, Second
addition = Addition(A=number_slider_24, B="5")
addition_2 = Addition(A=number_slider_23, B="5")
entwine_12 = Entwine(Branch00=ndarray_split_16.First, Branch01=ndarray_split_16.Second, Branch02=ndarray_split_16.Third, FlattenInputs=True)
entwine_13 = Entwine(Branch00=ndarray_vsplit_01.First, Branch01=ndarray_vsplit_01.Second, FlattenInputs=True)
entwine_14 = Entwine(
    Branch00=ndarray_r_02.ArrList1,
    Branch01=ndarray_r_02.ArrList2,
    Branch02=ndarray_r_02.ArrList3,
    Branch03=ndarray_r_02.ArrList4,
    Branch04=ndarray_r_02.ArrList5,
    Branch05=ndarray_r_02.ArrList6,
    FlattenInputs=True)
entwine_15 = Entwine(Branch00=ndarray_hsplit_01.First, Branch01=ndarray_hsplit_01.Second, FlattenInputs=True)
# #Better to start using HopsStrings
# as the data gets more complex
# #Specifying outputs to split arrays
# is a bit too hardcoded
# 
# CONSIDER RETURNING TO GRASSHOPPER
# AND USE SPLITTREE AND MASKS
# 
# #print(arr.list_to_tree()) not working in grasshopper canvas
# # use entwine node in gh to convert lists to tree
# return arr.tolist()[0], arr.tolist()[1], arr.tolist()[2]
panel_21 = Panel(entwine_12)
# Instructions:
# 1. Drag and drop a hops node on the canvas.
# 2. Set path to:
# http://127.0.0.1:5000/ndarray_c_02
# 3. Name and toggle  component name to :
# ndarray_c_02
ndarray_c_02 = Hops(
    Start1=number_slider_24,
    End1=addition,
    Start2=number_slider_23,
    End2=addition_2,
    CacheResultsInMemory=True,
    CacheSolveResults=True,
    RemoteDefinitionLocation="http://127.0.0.1:5000/ndarray_c_02",
    RemoteSolveVersion=(0, 1, 0),
    ShowInput_Enabled=False,
    ShowInput_Path=False,
    SynchronousSolve=True)  # -> ArrList1, ArrList2, ArrList3, ArrList4, ArrList5
panel_22 = Panel(entwine_13)
panel_23 = Panel(entwine_14)
panel_24 = Panel(entwine_15)
entwine_16 = Entwine(
    Branch00=ndarray_c_02.ArrList1,
    Branch01=ndarray_c_02.ArrList2,
    Branch02=ndarray_c_02.ArrList3,
    Branch03=ndarray_c_02.ArrList4,
    Branch04=ndarray_c_02.ArrList5,
    FlattenInputs=True)
panel_25 = Panel(entwine_16)

# ----
# Data Visualization
number_slider_25 = Slider(6.12, range=0..10)
yz_plane = YZPlane(Origin=Point(0, 0, 0))
dispatch = Dispatch(List=panel_25, DispatchPattern=[True, False])  # -> ListA, ListB
negative = Negative(Value=number_slider_25)
construct_domain = ConstructDomain(DomainStart=negative, DomainEnd=number_slider_25)
construct_domain_2 = ConstructDomain(DomainStart=negative, DomainEnd=number_slider_25)
list_length = ListLength(List=flatten(dispatch.ListA))
list_length_2 = ListLength(List=flatten(dispatch.ListB))
construct_point = ConstructPoint(XCoordinate=dispatch.ListA, YCoordinate=flatten(dispatch.ListA), ZCoordinate=0)
construct_point_2 = ConstructPoint(XCoordinate=dispatch.ListB, YCoordinate=flatten(dispatch.ListB), ZCoordinate=0)
range_3 = Range(Domain=construct_domain, Steps=expr("x-1", list_length))
range_4 = Range(Domain=construct_domain_2, Steps=expr("x-1", list_length_2))
unit_z = UnitZ(Factor=range_3)
unit_z_2 = UnitZ(Factor=range_4)
move = Move(Geometry=construct_point_2, Motion=graft(unit_z_2))  # -> Geometry, Transform
move_2 = Move(Geometry=construct_point, Motion=graft(unit_z))  # -> Geometry, Transform
move_3 = Move(Geometry=construct_point, Motion=unit_z)  # -> Geometry, Transform
move_4 = Move(Geometry=construct_point_2, Motion=unit_z_2)  # -> Geometry, Transform
polyline = PolyLine(Vertices=move_2.Geometry, Closed=False)
polyline_2 = PolyLine(Vertices=move.Geometry, Closed=False)
line = Line(StartPoint=move_2.Geometry, EndPoint=move_3.Geometry)
line_2 = Line(StartPoint=move_2.Geometry, EndPoint=move_4.Geometry)
line_3 = Line(StartPoint=move.Geometry, EndPoint=move_4.Geometry)
line_4 = Line(StartPoint=move_3.Geometry, EndPoint=move.Geometry)
entwine_17 = Entwine(
    Branch00=polyline,
    Branch01=line,
    Branch02=line_2,
    Branch03=polyline_2,
    Branch04=line_3,
    Branch05=line_4,
    FlattenInputs=True)
number_slider_26 = Slider(0.22, range=0..1)
clean_tree = CleanTree(RemoveNulls="1", RemoveInvalid="1", RemoveEmpty="1", Tree=entwine_17)
multipipe = MultiPipe(NodeSize=number_slider_26, EndOffset=1, StrutSize=1, Segment=0, KinkAngle=0.6, CubeFit=0, Caps=0)
join_curves = JoinCurves(Curves=flatten(clean_tree), Preserve=False)
pipe = Pipe(Curve=join_curves, Radius=number_slider_26, Caps="1")

# ----
# Repeating Elements :
#  tile and repeat
# repeat method for
# N-dimensional Array Objects
number_slider_27 = Slider(0, range=0..10)
# repeat method for
# N-dimensional Array Objects
number_slider_28 = Slider(3, range=0..10)
# tile method with count
# N-dimensional Array Objects
number_slider_29 = Slider(2, range=0..5)
number_slider_30 = Slider(3, range=0..5)
of_outputs = Panel("5")
rows_optional = Slider(2, range=0..10)
# tile method with tuple layout of the 'tiling'
# N-dimensional Array Objects
number_slider_31 = Slider(2, range=0..5)
# repeat method axis = 0
# with array of integers for
# N-dimensional Array Objects
number_slider_32 = Slider(2, range=0..10)
rows_optional_2 = Slider(2, range=0..10)
series_33 = Series(Start=number_slider_27, Step=Slider(2, range=0..10), Count=number_slider_28)
subtraction = Subtraction(A=of_outputs, B=number_slider_29)
subtraction_2 = Subtraction(A="5", B=number_slider_30)
# Instructions:
# 1. Drag and drop a hops node on the canvas.
# 2. Set path to:
# http://127.0.0.1:5000/ndarray_repeat_07
# 3. Name and toggle  component name to :
# ndarray_repeat_07
ndarray_repeat_07 = Hops(
    Rows="2",
    Columns=Slider(4, range=0..10),
    Repeat=number_slider_32,
    CacheResultsInMemory=False,
    CacheSolveResults=False,
    RemoteDefinitionLocation="http://127.0.0.1:5000/ndarray_repeat_07",
    RemoteSolveVersion=(0, 1, 0),
    ShowInput_Enabled=False,
    ShowInput_Path=False,
    SynchronousSolve=True)  # -> ArrList1, ArrList2, ArrList3, ArrList4
# Instructions:
# 1. Drag and drop a hops node on the canvas.
# 2. Set path to:
# http://127.0.0.1:5000/ndarray_repeat_08
# 3. Name and toggle  component name to :
# ndarray_repeat_08
ndarray_repeat_08 = Hops(
    Rows="2",
    Columns=Slider(2, range=0..10),
    Repeat1=number_slider_29,
    Repeat2=subtraction,
    CacheResultsInMemory=False,
    CacheSolveResults=False,
    RemoteDefinitionLocation="http://127.0.0.1:5000/ndarray_repeat_08",
    RemoteSolveVersion=(0, 1, 0),
    ShowInput_Enabled=False,
    ShowInput_Path=False,
    SynchronousSolve=True)  # -> ArrList1, ArrList2, ArrList3, ArrList4, ArrList5
# Instructions:
# 1. Drag and drop a hops node on the canvas.
# 2. Set path to:
# http://127.0.0.1:5000/ndarray_tile_03
# 3. Name and toggle  component name to :
# ndarray_tile_03
ndarray_tile_03 = Hops(
    Rows="2",
    Columns=rows_optional,
    TileCount=number_slider_31,
    CacheResultsInMemory=False,
    CacheSolveResults=False,
    RemoteDefinitionLocation="http://127.0.0.1:5000/ndarray_tile_03",
    RemoteSolveVersion=(0, 1, 0),
    ShowInput_Enabled=False,
    ShowInput_Path=False,
    SynchronousSolve=True)  # -> ArrList1, ArrList2
# Instructions:
# 1. Drag and drop a hops node on the canvas.
# 2. Set path to:
# http://127.0.0.1:5000/ndarray_tile_04
# 3. Name and toggle  component name to :
# ndarray_tile_04
ndarray_tile_04 = Hops(
    Rows="2",
    Columns=rows_optional_2,
    TileCount1=number_slider_30,
    TileCount2=subtraction_2,
    CacheResultsInMemory=True,
    CacheSolveResults=True,
    RemoteDefinitionLocation="http://127.0.0.1:5000/ndarray_tile_04",
    RemoteSolveVersion=(0, 1, 0),
    ShowInput_Enabled=False,
    ShowInput_Path=False,
    SynchronousSolve=True)  # -> ArrList1, ArrList2, ArrList3, ArrList4, ArrList5, ArrList6
# Instructions:
# 1. Drag and drop a hops node on the canvas.
# 2. Set path to:
# http://127.0.0.1:5000/ndarray_repeat_01
# 3. Name and toggle  component name to :
# ndarray_repeat_01
ndarray_repeat_01 = Hops(
    List1=series_33,
    Repeating=Slider(3, range=0..10),
    CacheResultsInMemory=True,
    CacheSolveResults=True,
    RemoteDefinitionLocation="http://127.0.0.1:5000/ndarray_repeat_01",
    RemoteSolveVersion=(0, 1, 0),
    ShowInput_Enabled=False,
    ShowInput_Path=False,
    SynchronousSolve=True)
entwine_18 = Entwine(
    Branch00=ndarray_repeat_07.ArrList1,
    Branch01=ndarray_repeat_07.ArrList2,
    Branch02=ndarray_repeat_07.ArrList3,
    Branch03=ndarray_repeat_07.ArrList4,
    FlattenInputs=True)
entwine_19 = Entwine(
    Branch00=ndarray_repeat_08.ArrList1,
    Branch01=ndarray_repeat_08.ArrList2,
    Branch02=ndarray_repeat_08.ArrList3,
    Branch03=ndarray_repeat_08.ArrList4,
    Branch04=ndarray_repeat_08.ArrList5,
    FlattenInputs=True)
entwine_20 = Entwine(Branch00=ndarray_tile_03.ArrList1, Branch01=ndarray_tile_03.ArrList2, FlattenInputs=True)
entwine_21 = Entwine(
    Branch00=ndarray_tile_04.ArrList1,
    Branch01=ndarray_tile_04.ArrList2,
    Branch02=ndarray_tile_04.ArrList3,
    Branch03=ndarray_tile_04.ArrList4,
    Branch04=ndarray_tile_04.ArrList5,
    Branch05=ndarray_tile_04.ArrList6,
    FlattenInputs=True)
panel_26 = Panel(entwine_18)
panel_27 = Panel(entwine_19)
panel_28 = Panel(entwine_20)
# tile method for
# N-dimensional Array Objects
panel_29 = Panel(ndarray_repeat_01)
panel_30 = Panel(entwine_21)
construct_point_3 = ConstructPoint(XCoordinate=panel_27, YCoordinate=graft(panel_27), ZCoordinate=0)
construct_point_4 = ConstructPoint(XCoordinate=panel_28, YCoordinate=graft(panel_28), ZCoordinate=0)
construct_point_5 = ConstructPoint(XCoordinate=panel_26, YCoordinate=graft(panel_26), ZCoordinate=0)
construct_point_6 = ConstructPoint(XCoordinate=panel_30, YCoordinate=graft(panel_30), ZCoordinate=0)
series_34 = Series(Start=Slider(0, range=0..10), Step=Slider(2, range=0..10), Count=Slider(3, range=0..10))
# Instructions:
# 1. Drag and drop a hops node on the canvas.
# 2. Set path to:
# http://127.0.0.1:5000/ndarray_tile_01
# 3. Name and toggle  component name to :
# ndarray_tile_01
ndarray_tile_01 = Hops(
    List1=series_34,
    Repeating=Slider(3, range=0..10),
    CacheResultsInMemory=True,
    CacheSolveResults=True,
    RemoteDefinitionLocation="http://127.0.0.1:5000/ndarray_tile_01",
    RemoteSolveVersion=(0, 1, 0),
    ShowInput_Enabled=False,
    ShowInput_Path=False,
    SynchronousSolve=True)
# Fancy Indexing Equivalents:
# take and put
panel_31 = Panel(ndarray_tile_01)
# take method for
# 1-dimensional Array Objects
number_slider_33 = Slider(0, range=0..10)
# put method for
# 1-dimensional Array Objects
number_slider_34 = Slider(10, range=0..10)
# put method for
# 1-dimensional Array Objects
number_slider_35 = Slider(42, range=0..100)
# take along other axis
# N-dimensional Array Objects
number_slider_36 = Slider(61, range=0..100)
series_35 = Series(Start=number_slider_33, Step=Slider(100, range=0..100), Count=number_slider_34)
series_36 = Series(Start=Slider(0, range=0..10), Step=Slider(100, range=0..100), Count=Slider(10, range=0..10))
series_37 = Series(Start=Slider(0, range=0..10), Step=Slider(100, range=0..100), Count=Slider(10, range=0..10))
# Instructions:
# 1. Drag and drop a hops node on the canvas.
# 2. Set path to:
# http://127.0.0.1:5000/ndarray_take_01
# 3. Name and toggle  component name to :
# ndarray_take_01
ndarray_take_01 = Hops(
    List1=series_35,
    Index1=Slider(7, range=0..10),
    Index2=Slider(2, range=0..10),
    Index3=Slider(2, range=0..10),
    Index4=Slider(6, range=0..10),
    CacheResultsInMemory=True,
    CacheSolveResults=True,
    RemoteDefinitionLocation="http://127.0.0.1:5000/ndarray_take_01",
    RemoteSolveVersion=(0, 1, 0),
    ShowInput_Enabled=False,
    ShowInput_Path=False,
    SynchronousSolve=True)
# Instructions:
# 1. Drag and drop a hops node on the canvas.
# 2. Set path to:
# http://127.0.0.1:5000/ndarray_take_02
# 3. Name and toggle  component name to :
# ndarray_take_02
ndarray_take_02 = Hops(
    Rows="2",
    Columns=Slider(4, range=0..10),
    Index1=Slider(2, range=0..3),
    Index2=Slider(0, range=0..3),
    Index3=Slider(2, range=0..3),
    Index4=Slider(1, range=0..3),
    Axis="1",
    CacheResultsInMemory=False,
    CacheSolveResults=False,
    RemoteDefinitionLocation="http://127.0.0.1:5000/ndarray_take_02",
    RemoteSolveVersion=(0, 1, 0),
    ShowInput_Enabled=False,
    ShowInput_Path=False,
    SynchronousSolve=True)  # -> ArrList1, ArrList2
# Instructions:
# 1. Drag and drop a hops node on the canvas.
# 2. Set path to:
# http://127.0.0.1:5000/ndarray_put_02
# 3. Name and toggle  component name to :
# ndarray_put_02
ndarray_put_02 = Hops(
    List1=series_36,
    Index1=Slider(7, range=0..10),
    Index2=Slider(2, range=0..10),
    Index3=Slider(2, range=0..10),
    Index4=Slider(6, range=0..10),
    Value=number_slider_35,
    CacheResultsInMemory=True,
    CacheSolveResults=True,
    RemoteDefinitionLocation="http://127.0.0.1:5000/ndarray_put_02",
    RemoteSolveVersion=(0, 1, 0),
    ShowInput_Enabled=False,
    ShowInput_Path=False,
    SynchronousSolve=True)
# Instructions:
# 1. Drag and drop a hops node on the canvas.
# 2. Set path to:
# http://127.0.0.1:5000/ndarray_put_03
# 3. Name and toggle  component name to :
# ndarray_put_03
ndarray_put_03 = Hops(
    List1=series_37,
    Index1=Slider(7, range=0..10),
    Index2=Slider(2, range=0..10),
    Index3=Slider(2, range=0..10),
    Index4=Slider(6, range=0..10),
    Value1=Slider(56, range=0..100),
    Value2=Slider(46, range=0..100),
    Value3=Slider(58, range=0..100),
    Value4=number_slider_36,
    CacheResultsInMemory=False,
    CacheSolveResults=False,
    RemoteDefinitionLocation="http://127.0.0.1:5000/ndarray_put_03",
    RemoteSolveVersion=(0, 1, 0),
    ShowInput_Enabled=False,
    ShowInput_Path=False,
    SynchronousSolve=True)
# Broadcasting
panel_32 = Panel(ndarray_take_01)
entwine_22 = Entwine(Branch00=ndarray_take_02.ArrList1, Branch01=ndarray_take_02.ArrList2, FlattenInputs=True)
# Data Visualization
panel_33 = Panel(ndarray_put_03)
panel_34 = Panel(ndarray_put_02)
panel_35 = Panel(entwine_22)
