# Grasshopper definition AI_copilot_to_AI_stablediffusion_008.gh (Grasshopper 1.0.7)
# plug-ins: Hops

# Broadcasting over axis 0
# with a 3d array
number_slider = Slider(4, range=0..10)
# Broadcasting over axis 0
# of a 3d array
number_slider_2 = Slider(3, range=0..10)
# Broadcasting over axis 1
# with a 2d array
number_slider_3 = Slider(3, range=0..10)
# ADVANCED NUMPY: Array and Vectorized
# Computation into Grasshopper for Generating
# Rhino3D Geometries
# Broadcasting
# scalar broadcast for
# N-dimensional Array Objects
# Broadcasting over axis 0
# with a 1d array
number_slider_4 = Slider(3, range=0..10)
# From AI copilot to AI Stable Diffusion
# at www.wickersonstudios.com
# Python for Data Manipulation and Mudging
panel = Panel("4")
# Instructions:
# 1. Drag and drop a hops node on the canvas.
# 2. Set path to:
# http://127.0.0.1:5000/ndarray_broadcasting_01
# 3. Name and toggle  component name to :
# ndarray_broadcasting_01
ndarray_broadcasting_01 = Hops(
    Rows="4",
    Columns=number_slider_3,
    CacheResultsInMemory=False,
    CacheSolveResults=False,
    RemoteDefinitionLocation="http://127.0.0.1:5000/ndarray_broadcasting_01",
    RemoteSolveVersion=(0, 1, 0),
    ShowInput_Enabled=False,
    ShowInput_Path=False,
    SynchronousSolve=True)  # -> ArrList1, ArrList2, ArrList3, ArrList4
# Instructions:
# 1. Drag and drop a hops node on the canvas.
# 2. Set path to:
# http://127.0.0.1:5000/ndarray_broadcasting_3d
# 3. Name and toggle  component name to :
# ndarray_broadcasting_3d
ndarray_broadcasting_3d = Hops(
    Rows=number_slider,
    Columns=Slider(2, range=0..10),
    Depth=number_slider_2,
    CacheResultsInMemory=False,
    CacheSolveResults=False,
    RemoteDefinitionLocation="http://127.0.0.1:5000/ndarray_broadcasting_3d",
    RemoteSolveVersion=(0, 1, 0),
    ShowInput_Enabled=False,
    ShowInput_Path=False,
    SynchronousSolve=True)
# Instructions:
# 1. Drag and drop a hops node on the canvas.
# 2. Set path to:
# http://127.0.0.1:5000/ndarray_broadcasting_01
# 3. Name and toggle  component name to :
# ndarray_broadcasting_01
ndarray_broadcasting_01_2 = Hops(
    Rows=panel,
    Columns=number_slider_4,
    CacheResultsInMemory=False,
    CacheSolveResults=False,
    RemoteDefinitionLocation="http://127.0.0.1:5000/ndarray_broadcasting_01",
    RemoteSolveVersion=(0, 1, 0),
    ShowInput_Enabled=False,
    ShowInput_Path=False,
    SynchronousSolve=True)  # -> ArrList1, ArrList2, ArrList3, ArrList4
# Instructions:
# 1. Drag and drop a hops node on the canvas.
# 2. Set path to:
# http://127.0.0.1:5000/ndarray_broadcasting_02
# 3. Name and toggle  component name to :
# ndarray_broadcasting_02
ndarray_broadcasting_02 = Hops(
    Rows="4",
    Columns=Slider(3, range=0..10),
    CacheResultsInMemory=False,
    CacheSolveResults=False,
    RemoteDefinitionLocation="http://127.0.0.1:5000/ndarray_broadcasting_02",
    RemoteSolveVersion=(0, 1, 0),
    ShowInput_Enabled=False,
    ShowInput_Path=False,
    SynchronousSolve=True)  # -> ArrList1, ArrList2, ArrList3, ArrList4
# Instructions:
# 1. Drag and drop a hops node on the canvas.
# 2. Set path to:
# http://127.0.0.1:5000/ndarray_broadcasting_3f
# 3. Name and toggle  component name to :
# ndarray_broadcasting_3f
ndarray_broadcasting_3f = Hops(
    Rows=Slider(4, range=0..10),
    Columns=Slider(2, range=0..10),
    Depth=Slider(3, range=0..10),
    CacheResultsInMemory=False,
    CacheSolveResults=False,
    RemoteDefinitionLocation="http://127.0.0.1:5000/ndarray_broadcasting_3f",
    RemoteSolveVersion=(0, 1, 0),
    ShowInput_Enabled=False,
    ShowInput_Path=False,
    SynchronousSolve=True)  # -> Arr1List1, Arr1List2, Arr2List1, Arr2List2, Arr3List1, Arr3List2, Arr4List1, Arr4List2
entwine = Entwine(
    Branch00=ndarray_broadcasting_01.ArrList1,
    Branch01=ndarray_broadcasting_01.ArrList2,
    Branch02=ndarray_broadcasting_01.ArrList3,
    Branch03=ndarray_broadcasting_01.ArrList4,
    FlattenInputs=True)
entwine_2 = Entwine(
    Branch00=ndarray_broadcasting_02.ArrList1,
    Branch01=ndarray_broadcasting_02.ArrList2,
    Branch02=ndarray_broadcasting_02.ArrList3,
    Branch03=ndarray_broadcasting_02.ArrList4,
    FlattenInputs=True)
entwine_3 = Entwine(
    Branch00=ndarray_broadcasting_01_2.ArrList1,
    Branch01=ndarray_broadcasting_01_2.ArrList2,
    Branch02=ndarray_broadcasting_01_2.ArrList3,
    Branch03=ndarray_broadcasting_01_2.ArrList4,
    FlattenInputs=True)
entwine_4 = Entwine(
    Branch00=ndarray_broadcasting_3f.Arr1List1,
    Branch01=ndarray_broadcasting_3f.Arr1List2,
    Branch02=ndarray_broadcasting_3f.Arr2List1,
    Branch03=ndarray_broadcasting_3f.Arr2List2,
    Branch04=ndarray_broadcasting_3f.Arr3List1,
    Branch05=ndarray_broadcasting_3f.Arr3List2,
    Branch06=ndarray_broadcasting_3f.Arr4List1,
    Branch07=ndarray_broadcasting_3f.Arr4List2,
    FlattenInputs=True)
panel_2 = Panel(entwine)
panel_3 = Panel(entwine_2)
panel_4 = Panel(entwine_3)
panel_5 = Panel(ndarray_broadcasting_3d)
panel_6 = Panel(entwine_4)
# Broadcasting over Other Axes
# newaxis method of a
# N-dimensional array
number_slider_5 = Slider(3, range=0..10)
# newaxis method of a
# N-dimensional array
number_slider_6 = Slider(3, range=0..10)
# newaxis method of a
# N-dimensional array
number_slider_7 = Slider(3, range=0..10)
# newaxis method of a
# N-dimensional array
number_slider_8 = Slider(2, range=0..10)
# Instructions:
# 1. Drag and drop a hops node on the canvas.
# 2. Set path to:
# http://127.0.0.1:5000/ndarray_newaxis_01c
# 3. Name and toggle  component name to :
# ndarray_newaxis_01c
ndarray_newaxis_01c = Hops(
    Rows=Slider(3, range=0..10),
    Columns=Slider(1, range=0..10),
    Depth=number_slider_7,
    Count="3",
    CacheResultsInMemory=False,
    CacheSolveResults=False,
    RemoteDefinitionLocation="http://127.0.0.1:5000/ndarray_newaxis_01c",
    RemoteSolveVersion=(0, 1, 0),
    ShowInput_Enabled=False,
    ShowInput_Path=False,
    SynchronousSolve=True)
# Instructions:
# 1. Drag and drop a hops node on the canvas.
# 2. Set path to:
# http://127.0.0.1:5000/ndarray_newaxis_01
# 3. Name and toggle  component name to :
# ndarray_newaxis_01
ndarray_newaxis_01 = Hops(
    Rows=number_slider_5,
    Columns=Slider(1, range=0..10),
    Depth=number_slider_6,
    Count="3",
    CacheResultsInMemory=False,
    CacheSolveResults=False,
    RemoteDefinitionLocation="http://127.0.0.1:5000/ndarray_newaxis_01",
    RemoteSolveVersion=(0, 1, 0),
    ShowInput_Enabled=False,
    ShowInput_Path=False,
    SynchronousSolve=True)  # -> ArrList1, ArrList2, ArrList3
# Instructions:
# 1. Drag and drop a hops node on the canvas.
# 2. Set path to:
# http://127.0.0.1:5000/ndarray_newaxis_02c
# 3. Name and toggle  component name to :
# ndarray_newaxis_02c
ndarray_newaxis_02c = Hops(
    Rows=Slider(4, range=0..10),
    Columns=Slider(2, range=0..10),
    Depth=Slider(2, range=0..10),
    Count=number_slider_8,
    CacheResultsInMemory=False,
    CacheSolveResults=False,
    RemoteDefinitionLocation="http://127.0.0.1:5000/ndarray_newaxis_02c",
    RemoteSolveVersion=(0, 1, 0),
    ShowInput_Enabled=False,
    ShowInput_Path=False,
    SynchronousSolve=True)  # -> ArrList1, ArrList2, ArrList3
# Instructions:
# 1. Drag and drop a hops node on the canvas.
# 2. Set path to:
# http://127.0.0.1:5000/ndarray_newaxis_02e
# 3. Name and toggle  component name to :
# ndarray_newaxis_02e
ndarray_newaxis_02e = Hops(
    Rows=Slider(4, range=0..10),
    Columns=Slider(2, range=0..10),
    Depth=Slider(2, range=0..10),
    Count=Slider(2, range=0..10),
    CacheResultsInMemory=False,
    CacheSolveResults=False,
    RemoteDefinitionLocation="http://127.0.0.1:5000/ndarray_newaxis_02e",
    RemoteSolveVersion=(0, 1, 0),
    ShowInput_Enabled=False,
    ShowInput_Path=False,
    SynchronousSolve=True)  # -> ArrList1, ArrList2, ArrList3, ArrList4, ArrList5, ArrList6, ArrList7, ArrList8
entwine_5 = Entwine(
    Branch00=ndarray_newaxis_01.ArrList1,
    Branch01=ndarray_newaxis_01.ArrList2,
    Branch02=ndarray_newaxis_01.ArrList3,
    FlattenInputs=True)
entwine_6 = Entwine(
    Branch00=ndarray_newaxis_02c.ArrList1,
    Branch01=ndarray_newaxis_02c.ArrList2,
    Branch02=ndarray_newaxis_02c.ArrList3,
    FlattenInputs=True)
entwine_7 = Entwine(
    Branch00=ndarray_newaxis_02e.ArrList1,
    Branch01=ndarray_newaxis_02e.ArrList2,
    Branch02=ndarray_newaxis_02e.ArrList3,
    Branch03=ndarray_newaxis_02e.ArrList4,
    Branch04=ndarray_newaxis_02e.ArrList5,
    Branch05=ndarray_newaxis_02e.ArrList6,
    Branch06=ndarray_newaxis_02e.ArrList7,
    Branch07=ndarray_newaxis_02e.ArrList8,
    FlattenInputs=True)
panel_7 = Panel(ndarray_newaxis_01c)
panel_8 = Panel(entwine_5)
panel_9 = Panel(entwine_6)
panel_10 = Panel(entwine_7)
# Setting Array Values by Broadcasting
# indexing methods of a
# N-dimensional array
number_slider_9 = Slider(4, range=0..10)
# indexing methods of a
# N-dimensional array
number_slider_10 = Slider(2, range=0..10)
number_slider_11 = Slider(2, range=0..10)
# indexing methods of a
# N-dimensional array
number_slider_12 = Slider(8, range=0..10)
# Instructions:
# 1. Drag and drop a hops node on the canvas.
# 2. Set path to:
# http://127.0.0.1:5000/ndarray_broadcasting_03
# 3. Name and toggle  component name to :
# ndarray_broadcasting_03
ndarray_broadcasting_03 = Hops(
    Rows=number_slider_9,
    Columns=Slider(2, range=0..10),
    Value=number_slider_10,
    CacheResultsInMemory=True,
    CacheSolveResults=True,
    RemoteDefinitionLocation="http://127.0.0.1:5000/ndarray_broadcasting_03",
    RemoteSolveVersion=(0, 1, 0),
    ShowInput_Enabled=False,
    ShowInput_Path=False,
    SynchronousSolve=True)  # -> ArrList1, ArrList2, ArrList3, ArrList4
# Instructions:
# 1. Drag and drop a hops node on the canvas.
# 2. Set path to:
# http://127.0.0.1:5000/ndarray_broadcasting_05
# 3. Name and toggle  component name to :
# ndarray_broadcasting_05
ndarray_broadcasting_06 = Hops(
    Rows=Slider(4, range=0..10),
    Columns=Slider(3, range=0..10),
    Value1=Slider(0, range=0..10),
    Value2=Slider(9, range=0..10),
    Value3=Slider(10, range=0..10),
    Index1="2",
    CacheResultsInMemory=False,
    CacheSolveResults=False,
    RemoteDefinitionLocation="http://127.0.0.1:5000/ndarray_broadcasting_06",
    RemoteSolveVersion=(0, 1, 0),
    ShowInput_Enabled=False,
    ShowInput_Path=False,
    SynchronousSolve=True)  # -> ArrList1, ArrList2, ArrList3, ArrList4
# Instructions:
# 1. Drag and drop a hops node on the canvas.
# 2. Set path to:
# http://127.0.0.1:5000/ndarray_broadcasting_04
# 3. Name and toggle  component name to :
# ndarray_broadcasting_04
ndarray_broadcasting_04 = Hops(
    Rows=Slider(4, range=0..10),
    Columns=Slider(3, range=0..10),
    Value1=Slider(0, range=0..10),
    Value2=Slider(2, range=0..10),
    Value3=Slider(4, range=0..10),
    Value4=Slider(6, range=0..10),
    Value5=number_slider_12,
    CacheResultsInMemory=True,
    CacheSolveResults=True,
    RemoteDefinitionLocation="http://127.0.0.1:5000/ndarray_broadcasting_04",
    RemoteSolveVersion=(0, 1, 0),
    ShowInput_Enabled=False,
    ShowInput_Path=False,
    SynchronousSolve=True)  # -> ArrList1, ArrList2, ArrList3, ArrList4
entwine_8 = Entwine(
    Branch00=ndarray_broadcasting_03.ArrList1,
    Branch01=ndarray_broadcasting_03.ArrList2,
    Branch02=ndarray_broadcasting_03.ArrList3,
    Branch03=ndarray_broadcasting_03.ArrList4,
    FlattenInputs=True)
entwine_9 = Entwine(
    Branch00=ndarray_broadcasting_06.ArrList1,
    Branch01=ndarray_broadcasting_06.ArrList2,
    Branch02=ndarray_broadcasting_06.ArrList3,
    Branch03=ndarray_broadcasting_06.ArrList4,
    FlattenInputs=True)
entwine_10 = Entwine(
    Branch00=ndarray_broadcasting_04.ArrList1,
    Branch01=ndarray_broadcasting_04.ArrList2,
    Branch02=ndarray_broadcasting_04.ArrList3,
    Branch03=ndarray_broadcasting_04.ArrList4,
    FlattenInputs=True)
panel_11 = Panel(entwine_8)
panel_12 = Panel(entwine_9)
panel_13 = Panel(entwine_10)
# outer dimension method of a
# N-dimensional array
number_slider_13 = Slider(3, range=0..10)
# reduceat method of a
# N-dimensional array
number_slider_14 = Slider(5, range=0..10)
# accumulate method of a
# N-dimensional array
number_slider_15 = Slider(5, range=0..10)
# reduceat with axis method of a
# N-dimensional array
number_slider_16 = Slider(8, range=0..10)
# Advanced ufunc Usage
# reduce method of a
# N-dimensional array
# #Must hardcode in rows equal to # of outputs
# (in the grasshopper canvas, the terminal will show any array of parametric rows)
# 
# #print(arr.list_to_tree()) not working in grasshopper canvas
# # use entwine node in gh to convert lists to tree
# return arr.tolist()[0], arr.tolist()[1], arr.tolist()[2]
# logical_and reduce method of a
# N-dimensional array
number_slider_17 = Slider(10, range=0..10)
# outer method of a
# N-dimensional array
number_slider_18 = Slider(5, range=0..10)
# Instructions:
# 1. Drag and drop a hops node on the canvas.
# 2. Set path to:
# http://127.0.0.1:5000/ndarray_reduce_02
# 3. Name and toggle  component name to :
# ndarray_reduce_02
ndarray_reduce_12 = Hops(
    Rows=number_slider_15,
    Columns=number_slider_15,
    CacheResultsInMemory=False,
    CacheSolveResults=False,
    RemoteDefinitionLocation="http://127.0.0.1:5000/ndarray_reduce_12",
    RemoteSolveVersion=(0, 1, 0),
    ShowInput_Enabled=False,
    ShowInput_Path=False,
    SynchronousSolve=True)
# Instructions:
# 1. Drag and drop a hops node on the canvas.
# 2. Set path to:
# http://127.0.0.1:5000/ndarray_outer_03
# 3. Name and toggle  component name to :
# ndarray_outer_03
ndarray_outer_03 = Hops(
    Rows=number_slider_13,
    Columns=Slider(4, range=0..10),
    Count=number_slider_14,
    CacheResultsInMemory=True,
    CacheSolveResults=True,
    RemoteDefinitionLocation="http://127.0.0.1:5000/ndarray_outer_03",
    RemoteSolveVersion=(0, 1, 0),
    ShowInput_Enabled=False,
    ShowInput_Path=False,
    SynchronousSolve=True)  # -> ArrList1, Shape
# Instructions:
# 1. Drag and drop a hops node on the canvas.
# 2. Set path to:
# http://127.0.0.1:5000/ndarray_reduce_02
# 3. Name and toggle  component name to :
# ndarray_reduce_02
ndarray_reduce_02 = Hops(
    Count=number_slider_17,
    CacheResultsInMemory=True,
    CacheSolveResults=True,
    RemoteDefinitionLocation="http://127.0.0.1:5000/ndarray_reduce_02",
    RemoteSolveVersion=(0, 1, 0),
    ShowInput_Enabled=False,
    ShowInput_Path=False,
    SynchronousSolve=True)
# Instructions:
# 1. Drag and drop a hops node on the canvas.
# 2. Set path to:
# http://127.0.0.1:5000/ndarray_outer_01
# 3. Name and toggle  component name to :
# ndarray_outer_01
ndarray_outer_01 = Hops(
    Count="3",
    CacheResultsInMemory=True,
    CacheSolveResults=True,
    RemoteDefinitionLocation="http://127.0.0.1:5000/ndarray_outer_01",
    RemoteSolveVersion=(0, 1, 0),
    ShowInput_Enabled=False,
    ShowInput_Path=False,
    SynchronousSolve=True)  # -> ArrList1, ArrList2, ArrList3, ArrList4, ArrList5
# Instructions:
# 1. Drag and drop a hops node on the canvas.
# 2. Set path to:
# http://127.0.0.1:5000/ndarray_reduceat_01
# 3. Name and toggle  component name to :
# ndarray_reduceat_01
ndarray_reduceat_01 = Hops(
    Count=Slider(10, range=0..10),
    Index1=Slider(0, range=0..10),
    Index2=Slider(5, range=0..10),
    Index3=number_slider_16,
    CacheResultsInMemory=True,
    CacheSolveResults=True,
    RemoteDefinitionLocation="http://127.0.0.1:5000/ndarray_reduceat_01",
    RemoteSolveVersion=(0, 1, 0),
    ShowInput_Enabled=False,
    ShowInput_Path=False,
    SynchronousSolve=True)  # -> ArrList1, ArrList2, ArrList3
# Instructions:
# 1. Drag and drop a hops node on the canvas.
# 2. Set path to:
# http://127.0.0.1:5000/ndarray_accumulate_01
# 3. Name and toggle  component name to :
# ndarray_accumulate_01
ndarray_accumulate_01 = Hops(
    Rows="3",
    Columns=number_slider_18,
    CacheResultsInMemory=False,
    CacheSolveResults=False,
    RemoteDefinitionLocation="http://127.0.0.1:5000/ndarray_accumulate_01",
    RemoteSolveVersion=(0, 1, 0),
    ShowInput_Enabled=False,
    ShowInput_Path=False,
    SynchronousSolve=True)  # -> ArrList1, ArrList2, ArrList3
# Instructions:
# 1. Drag and drop a hops node on the canvas.
# 2. Set path to:
# http://127.0.0.1:5000/ndarray_reduceat_03
# 3. Name and toggle  component name to :
# ndarray_reduceat_03
ndarray_reduceat_03 = Hops(
    Rows="4",
    Columns=Slider(5, range=0..10),
    Index1=Slider(0, range=0..10),
    Index2=Slider(2, range=0..10),
    Index3=Slider(4, range=0..10),
    Axis="1",
    CacheResultsInMemory=False,
    CacheSolveResults=False,
    RemoteDefinitionLocation="http://127.0.0.1:5000/ndarray_reduceat_03",
    RemoteSolveVersion=(0, 1, 0),
    ShowInput_Enabled=False,
    ShowInput_Path=False,
    SynchronousSolve=True)  # -> ArrList1, ArrList2, ArrList3, ArrList4
entwine_11 = Entwine(
    Branch00=ndarray_reduceat_01.ArrList1,
    Branch01=ndarray_reduceat_01.ArrList2,
    Branch02=ndarray_reduceat_01.ArrList3,
    FlattenInputs=True)
panel_14 = Panel(ndarray_reduce_12)
panel_15 = Panel(ndarray_outer_03.Shape)
panel_16 = Panel(ndarray_reduce_02)
entwine_12 = Entwine(
    Branch00=ndarray_accumulate_01.ArrList1,
    Branch01=ndarray_accumulate_01.ArrList2,
    Branch02=ndarray_accumulate_01.ArrList3,
    FlattenInputs=True)
entwine_13 = Entwine(
    Branch00=ndarray_reduceat_03.ArrList1,
    Branch01=ndarray_reduceat_03.ArrList2,
    Branch02=ndarray_reduceat_03.ArrList3,
    Branch03=ndarray_reduceat_03.ArrList4,
    FlattenInputs=True)
panel_17 = Panel(ndarray_outer_03.ArrList1)
panel_18 = Panel(entwine_11)
panel_19 = Panel(entwine_12)
entwine_14 = Entwine(
    Branch00=ndarray_outer_01.ArrList1,
    Branch01=ndarray_outer_01.ArrList2,
    Branch02=ndarray_outer_01.ArrList3,
    Branch03=ndarray_outer_01.ArrList4,
    Branch04=ndarray_outer_01.ArrList5,
    FlattenInputs=True)
panel_20 = Panel(entwine_13)
panel_21 = Panel(entwine_14)
# writing new ufuncs in Python
# np.frompyfunc  method of a
# N-dimensional array
number_slider_19 = Slider(10, range=0..10)
# Instructions:
# 1. Drag and drop a hops node on the canvas.
# 2. Set path to:
# http://127.0.0.1:5000/ndarray_frompyfunc_01
# 3. Name and toggle  component name to :
# ndarray_frompyfunc_01
ndarray_frompyfunc_01 = Hops(
    Count=number_slider_19,
    CacheResultsInMemory=False,
    CacheSolveResults=False,
    RemoteDefinitionLocation="http://127.0.0.1:5000/ndarray_frompyfunc_01",
    RemoteSolveVersion=(0, 1, 0),
    ShowInput_Enabled=False,
    ShowInput_Path=False,
    SynchronousSolve=True)
panel_22 = Panel(ndarray_frompyfunc_01)
