# Grasshopper definition AI_copilot_to_AI_stablediffusion_009.gh (Grasshopper 1.0.7)
# plug-ins: Hops

# From AI copilot to AI Stable Diffusion
# at www.wickersonstudios.com
# Python for Data Manipulation and Mudging
# ADVANCED NUMPY: Array and Vectorized
# Computation into Grasshopper for Generating
# Rhino3D Geometries
# Structured and Record Arrays
# dtype for
# N-dimensional Array Objects
number_slider = Slider(1.5, range=0..10)
# Nested Data Types and
# Multidimensional Feilds
# Nested Data Types for
# N-dimensional Array Objects
number_slider_2 = Slider(-2, range=-2..2)
pi = Pi(Factor=1)
# Nested Data Types for
# N-dimensional Array Objects
boolean_toggle = BooleanToggle(False)
# Instructions:
# 1. Drag and drop a hops node on the canvas.
# 2. Set path to:
# http://127.0.0.1:5000/ndarray_structured_03
# 3. Name and toggle  component name to :
# ndarray_structured_03
ndarray_structured_03 = Hops(
    Value1=number_slider,
    Value2=Slider(6, range=0..10),
    Value3=pi,
    Value4=number_slider_2,
    CacheResultsInMemory=True,
    CacheSolveResults=True,
    RemoteDefinitionLocation="http://127.0.0.1:5000/ndarray_structured_03",
    RemoteSolveVersion=(0, 1, 0),
    ShowInput_Enabled=False,
    ShowInput_Path=False,
    SynchronousSolve=True)  # -> ArrList1, ArrList2, ArrList3
# Instructions:
# 1. Drag and drop a hops node on the canvas.
# 2. Set path to:
# http://127.0.0.1:5000/ndarray_structured_03
# 3. Name and toggle  component name to :
# ndarray_structured_03
ndarray_structured_06 = Hops(
    Value1=boolean_toggle,
    CacheResultsInMemory=False,
    CacheSolveResults=False,
    RemoteDefinitionLocation="http://127.0.0.1:5000/ndarray_structured_06",
    RemoteSolveVersion=(0, 1, 0),
    ShowInput_Enabled=False,
    ShowInput_Path=False,
    SynchronousSolve=True)  # -> ArrList1, ArrList2, ArrList3, ArrList4
# Instructions:
# 1. Drag and drop a hops node on the canvas.
# 2. Set path to:
# http://127.0.0.1:5000/ndarray_structured_07
# 3. Name and toggle  component name to :
# ndarray_structured_07
ndarray_structured_07 = Hops(
    Value1=Toggle(False),
    CacheResultsInMemory=True,
    CacheSolveResults=True,
    RemoteDefinitionLocation="http://127.0.0.1:5000/ndarray_structured_07",
    RemoteSolveVersion=(0, 1, 0),
    ShowInput_Enabled=False,
    ShowInput_Path=False,
    SynchronousSolve=True)  # -> ArrList1, ArrList2, ArrList3, ArrList4
entwine = Entwine(
    Branch00=ndarray_structured_03.ArrList1,
    Branch01=ndarray_structured_03.ArrList2,
    Branch02=ndarray_structured_03.ArrList3,
    FlattenInputs=True)
entwine_2 = Entwine(
    Branch00=ndarray_structured_06.ArrList1,
    Branch01=ndarray_structured_06.ArrList2,
    Branch02=ndarray_structured_06.ArrList3,
    Branch03=ndarray_structured_06.ArrList4,
    FlattenInputs=True)
entwine_3 = Entwine(
    Branch00=ndarray_structured_07.ArrList1,
    Branch01=ndarray_structured_07.ArrList2,
    Branch02=ndarray_structured_07.ArrList3,
    Branch03=ndarray_structured_07.ArrList4,
    FlattenInputs=True)
panel = Panel(entwine_2)
panel_2 = Panel(entwine)
panel_3 = Panel(entwine_3)
# decending order of a
# N-dimensional array
number_slider_3 = Slider(1, range=0..1)
# sorted copy method of a
# N-dimensional array
number_slider_4 = Slider(3, range=0..10)
# More About Sorting
# sort method of a
# N-dimensional array
number_slider_5 = Slider(3, range=0..10)
# optional axis argument of a
# N-dimensional array
number_slider_6 = Slider(5, range=0..10)
# Instructions:
# 1. Drag and drop a hops node on the canvas.
# 2. Set path to:
# http://127.0.0.1:5000/ndarray_sort_07
# 3. Name and toggle  component name to :
# ndarray_sort_07
ndarray_sort_07 = Hops(
    Rows=Slider(3, range=0..10),
    Columns=Slider(5, range=0..10),
    Axis=number_slider_3,
    CacheResultsInMemory=False,
    CacheSolveResults=False,
    RemoteDefinitionLocation="http://127.0.0.1:5000/ndarray_sort_07",
    RemoteSolveVersion=(0, 1, 0),
    ShowInput_Enabled=False,
    ShowInput_Path=False,
    SynchronousSolve=True)  # -> ArrList1, ArrList2, ArrList3
# Instructions:
# 1. Drag and drop a hops node on the canvas.
# 2. Set path to:
# http://127.0.0.1:5000/ndarray_sort_08
# 3. Name and toggle  component name to :
# ndarray_sort_08
ndarray_sort_08 = Hops(
    Rows=Slider(3, range=0..10),
    Columns=Slider(5, range=0..10),
    Axis=Slider(1, range=0..1),
    CacheResultsInMemory=False,
    CacheSolveResults=False,
    RemoteDefinitionLocation="http://127.0.0.1:5000/ndarray_sort_08",
    RemoteSolveVersion=(0, 1, 0),
    ShowInput_Enabled=False,
    ShowInput_Path=False,
    SynchronousSolve=True)  # -> ArrList1, ArrList2, ArrList3
# Instructions:
# 1. Drag and drop a hops node on the canvas.
# 2. Set path to:
# http://127.0.0.1:5000/ndarray_sort_05
# 3. Name and toggle  component name to :
# ndarray_sort_05
ndarray_sort_05 = Hops(
    Rows=number_slider_5,
    Columns=number_slider_4,
    CacheResultsInMemory=False,
    CacheSolveResults=False,
    RemoteDefinitionLocation="http://127.0.0.1:5000/ndarray_sort_05",
    RemoteSolveVersion=(0, 1, 0),
    ShowInput_Enabled=False,
    ShowInput_Path=False,
    SynchronousSolve=True)  # -> ArrList1, ArrList2, ArrList3
# Instructions:
# 1. Drag and drop a hops node on the canvas.
# 2. Set path to:
# http://127.0.0.1:5000/ndarray_sort_06
# 3. Name and toggle  component name to :
# ndarray_sort_06
ndarray_sort_06 = Hops(
    Count=number_slider_6,
    CacheResultsInMemory=False,
    CacheSolveResults=False,
    RemoteDefinitionLocation="http://127.0.0.1:5000/ndarray_sort_06",
    RemoteSolveVersion=(0, 1, 0),
    ShowInput_Enabled=False,
    ShowInput_Path=False,
    SynchronousSolve=True)  # -> ArrList1, ArrList2
entwine_4 = Entwine(
    Branch00=ndarray_sort_08.ArrList1,
    Branch01=ndarray_sort_08.ArrList2,
    Branch02=ndarray_sort_08.ArrList3,
    FlattenInputs=True)
entwine_5 = Entwine(
    Branch00=ndarray_sort_05.ArrList1,
    Branch01=ndarray_sort_05.ArrList2,
    Branch02=ndarray_sort_05.ArrList3,
    FlattenInputs=True)
entwine_6 = Entwine(Branch00=ndarray_sort_06.ArrList1, Branch01=ndarray_sort_06.ArrList2, FlattenInputs=True)
entwine_7 = Entwine(
    Branch00=ndarray_sort_07.ArrList1,
    Branch01=ndarray_sort_07.ArrList2,
    Branch02=ndarray_sort_07.ArrList3,
    FlattenInputs=True)
# indirect sorts:
# argsort and lexsort
# argsort method of a
# N-dimensional array
panel_4 = Panel(entwine_5)
panel_5 = Panel(entwine_6)
panel_6 = Panel(entwine_7)
panel_7 = Panel(entwine_4)
# lexsort method of a
# N-dimensional array
number_slider_7 = Slider(5, range=0..10)
# argsort method of a
# N-dimensional array
number_slider_8 = Slider(5, range=0..10)
# Instructions:
# 1. Drag and drop a hops node on the canvas.
# 2. Set path to:
# http://127.0.0.1:5000/ndarray_lexsort_02
# 3. Name and toggle  component name to :
# ndarray_lexsort_02
ndarray_lexsort_02 = Hops(
    Value1="Mike",
    Value2="Beth",
    Value3="Oscar",
    Value4="Max",
    Value5="Ella",
    CacheResultsInMemory=True,
    CacheSolveResults=True,
    RemoteDefinitionLocation="http://127.0.0.1:5000/ndarray_lexsort_02",
    RemoteSolveVersion=(0, 1, 0),
    ShowInput_Enabled=False,
    ShowInput_Path=False,
    SynchronousSolve=True)
# Instructions:
# 1. Drag and drop a hops node on the canvas.
# 2. Set path to:
# http://127.0.0.1:5000/ndarray_argsort_03
# 3. Name and toggle  component name to :
# ndarray_argsort_03
ndarray_argsort_03 = Hops(
    Rows=Slider(3, range=0..10),
    Columns=number_slider_7,
    CacheResultsInMemory=False,
    CacheSolveResults=False,
    RemoteDefinitionLocation="http://127.0.0.1:5000/ndarray_argsort_03",
    RemoteSolveVersion=(0, 1, 0),
    ShowInput_Enabled=False,
    ShowInput_Path=False,
    SynchronousSolve=True)  # -> ArrList1, ArrList2, ArrList3
# Instructions:
# 1. Drag and drop a hops node on the canvas.
# 2. Set path to:
# http://127.0.0.1:5000/ndarray_argsort_01
# 3. Name and toggle  component name to :
# ndarray_argsort_01
ndarray_argsort_01 = Hops(
    Count=number_slider_8,
    CacheResultsInMemory=True,
    CacheSolveResults=True,
    RemoteDefinitionLocation="http://127.0.0.1:5000/ndarray_argsort_01",
    RemoteSolveVersion=(0, 1, 0),
    ShowInput_Enabled=False,
    ShowInput_Path=False,
    SynchronousSolve=True)  # -> ArrList1, ArrList2
panel_8 = Panel(ndarray_lexsort_02)
entwine_8 = Entwine(Branch00=ndarray_argsort_01.ArrList1, Branch01=ndarray_argsort_01.ArrList2, FlattenInputs=True)
entwine_9 = Entwine(
    Branch00=ndarray_argsort_03.ArrList1,
    Branch01=ndarray_argsort_03.ArrList2,
    Branch02=ndarray_argsort_03.ArrList3,
    FlattenInputs=True)
panel_9 = Panel(entwine_8)
panel_10 = Panel(entwine_9)
# searchsorted method of a
# N-dimensional array
number_slider_9 = Slider(0, range=0..100)
# searchsorted method of a
# N-dimensional array
number_slider_10 = Slider(2, range=0..10)
# searchsorted method of a
# N-dimensional array
number_slider_11 = Slider(2, range=0..10)
# Alternative Sort Algorithms
# mergesort method of a
# N-dimensional array
# #Must hardcode in rows equal to # of outputs
# (in the grasshopper canvas, the terminal will show any array of parametric rows)
# 
# #print(arr.list_to_tree()) not working in grasshopper canvas
# # use entwine node in gh to convert lists to tree
# return arr.tolist()[0], arr.tolist()[1], arr.tolist()[2]
number_slider_12 = Slider(2, range=0..10)
# Partially Sorting Arrays
# partition method of a
# N-dimensional array
number_slider_13 = Slider(1, range=0..10)
# searchsorted method of a
# N-dimensional array
number_slider_14 = Slider(5, range=0..10)
# argpartition method of a
# N-dimensional array
number_slider_15 = Slider(5, range=0..10)
series = Series(Start=number_slider_9, Step=number_slider_10, Count=10)
series_2 = Series(Start=Slider(0, range=0..100), Step=number_slider_11, Count=10)
# Instructions:
# 1. Drag and drop a hops node on the canvas.
# 2. Set path to:
# http://127.0.0.1:5000/ndarray_argsort_04
# 3. Name and toggle  component name to :
# ndarray_argsort_04
ndarray_argsort_04 = Hops(
    Value1=number_slider_12,
    Value2=Slider(3, range=0..10),
    Value3=Slider(4, range=0..10),
    Value4=Slider(0, range=0..10),
    Value5=number_slider_13,
    CacheResultsInMemory=True,
    CacheSolveResults=True,
    RemoteDefinitionLocation="http://127.0.0.1:5000/ndarray_argsort_04",
    RemoteSolveVersion=(0, 1, 0),
    ShowInput_Enabled=False,
    ShowInput_Path=False,
    SynchronousSolve=True)
# Instructions:
# 1. Drag and drop a hops node on the canvas.
# 2. Set path to:
# http://127.0.0.1:5000/ndarray_partition_03
# 3. Name and toggle  component name to :
# ndarray_partition_03
ndarray_partition_03 = Hops(
    Count=Slider(10, range=0..10),
    Index1=number_slider_15,
    CacheResultsInMemory=True,
    CacheSolveResults=True,
    RemoteDefinitionLocation="http://127.0.0.1:5000/ndarray_partition_03",
    RemoteSolveVersion=(0, 1, 0),
    ShowInput_Enabled=False,
    ShowInput_Path=False,
    SynchronousSolve=True)
# Instructions:
# 1. Drag and drop a hops node on the canvas.
# 2. Set path to:
# http://127.0.0.1:5000/ndarray_searchsorted_01
# 3. Name and toggle  component name to :
# ndarray_searchsorted_01
ndarray_searchsorted_01 = Hops(
    Count=Slider(10, range=0..10),
    Index1=Slider(5, range=0..10),
    CacheResultsInMemory=True,
    CacheSolveResults=True,
    RemoteDefinitionLocation="http://127.0.0.1:5000/ndarray_searchsorted_01",
    RemoteSolveVersion=(0, 1, 0),
    ShowInput_Enabled=False,
    ShowInput_Path=False,
    SynchronousSolve=True)
# Instructions:
# 1. Drag and drop a hops node on the canvas.
# 2. Set path to:
# http://127.0.0.1:5000/ndarray_argpartition_02
# 3. Name and toggle  component name to :
# ndarray_argpartition_02
ndarray_argpartition_02 = Hops(
    Count=Slider(10, range=0..10),
    Index1=number_slider_14,
    CacheResultsInMemory=True,
    CacheSolveResults=True,
    RemoteDefinitionLocation="http://127.0.0.1:5000/ndarray_argpartition_02",
    RemoteSolveVersion=(0, 1, 0),
    ShowInput_Enabled=False,
    ShowInput_Path=False,
    SynchronousSolve=True)
# Instructions:
# 1. Drag and drop a hops node on the canvas.
# 2. Set path to:
# http://127.0.0.1:5000/ndarray_searchsorted_03
# 3. Name and toggle  component name to :
# ndarray_searchsorted_03
ndarray_searchsorted_03 = Hops(
    List1=series,
    Index1=Slider(2, range=0..10),
    Index2=Slider(5, range=0..10),
    Index3=Slider(9, range=0..10),
    CacheResultsInMemory=True,
    CacheSolveResults=True,
    RemoteDefinitionLocation="http://127.0.0.1:5000/ndarray_searchsorted_03",
    RemoteSolveVersion=(0, 1, 0),
    ShowInput_Enabled=False,
    ShowInput_Path=False,
    SynchronousSolve=True)
# Instructions:
# 1. Drag and drop a hops node on the canvas.
# 2. Set path to:
# http://127.0.0.1:5000/ndarray_searchsorted_04
# 3. Name and toggle  component name to :
# ndarray_searchsorted_04
ndarray_searchsorted_04 = Hops(
    List1=series_2,
    Index1=Slider(2, range=0..10),
    Index2=Slider(5, range=0..10),
    Index3=Slider(9, range=0..10),
    CacheResultsInMemory=True,
    CacheSolveResults=True,
    RemoteDefinitionLocation="http://127.0.0.1:5000/ndarray_searchsorted_04",
    RemoteSolveVersion=(0, 1, 0),
    ShowInput_Enabled=False,
    ShowInput_Path=False,
    SynchronousSolve=True)
# Instructions:
# 1. Drag and drop a hops node on the canvas.
# 2. Set path to:
# http://127.0.0.1:5000/ndarray_searchsorted_04
# 3. Name and toggle  component name to :
# ndarray_searchsorted_04
hops = Hops(
    Count=Slider(75, range=0..200),
    Index1="0",
    Index2="100",
    Index3="1000",
    Index4="5000",
    Index5="10000",
    CacheResultsInMemory=False,
    CacheSolveResults=False,
    RemoteDefinitionLocation="http://127.0.0.1:5000/ndarray_searchsorted_05",
    RemoteSolveVersion=(0, 1, 0),
    ShowInput_Enabled=False,
    ShowInput_Path=False,
    SynchronousSolve=True)
panel_11 = Panel(ndarray_argsort_04)
panel_12 = Panel(ndarray_partition_03)
panel_13 = Panel(ndarray_searchsorted_01)
panel_14 = Panel(ndarray_argpartition_02)
panel_15 = Panel(ndarray_searchsorted_03)
panel_16 = Panel(ndarray_searchsorted_04)
panel_17 = Panel(hops)
