# Grasshopper definition AI_copilot_to_AI_stablediffusion_010.gh (Grasshopper 1.0.7)
# plug-ins: Hops

# ADVANCED NUMPY: Array and Vectorized
# Computation into Grasshopper for Generating
# Rhino3D Geometries
# Writing Fast NumPy Functions with Numba
# numba nb.jit
# N-dimensional Array Objects
# #Must hardcode in rows equal to # of outputs
# (in the grasshopper canvas, the terminal will show any array of parametric rows)
# 
# #print(arr.list_to_tree()) not working in grasshopper canvas
# # use entwine node in gh to convert lists to tree
# return arr.tolist()[0], arr.tolist()[1], arr.tolist()[2]
# Creating Custom numpy.ufunc
# Objects with Numba
# numba nb.vectorize
# N-dimensional Array Objects
number_slider = Slider(100000, range=0..100000)
ndarray_numba_02 = Hops(
    Count=Slider(1000, range=0..1000),
    CacheResultsInMemory=False,
    CacheSolveResults=False,
    RemoteDefinitionLocation="http://127.0.0.1:5000/ndarray_numba_02",
    RemoteSolveVersion=(0, 1, 0),
    ShowInput_Enabled=False,
    ShowInput_Path=False,
    SynchronousSolve=True)
# From AI copilot to AI Stable Diffusion
# at www.wickersonstudios.com
# Python for Data Manipulation and Mudging
ndarray_numba_01 = Hops(
    Count=number_slider,
    CacheResultsInMemory=False,
    CacheSolveResults=False,
    RemoteDefinitionLocation="http://127.0.0.1:5000/ndarray_numba_01",
    RemoteSolveVersion=(0, 1, 0),
    ShowInput_Enabled=False,
    ShowInput_Path=False,
    SynchronousSolve=True)
# Instructions:
# 1. Drag and drop a hops node on the canvas.
# 2. Set path to:
# http://127.0.0.1:5000/ndarray_numba_02
# 3. Name and toggle  component name to :
# ndarray_numba_02
panel = Panel(ndarray_numba_02)
# Instructions:
# 1. Drag and drop a hops node on the canvas.
# 2. Set path to:
# http://127.0.0.1:5000/ndarray_numba_01
# 3. Name and toggle  component name to :
# ndarray_numba_01
panel_2 = Panel(ndarray_numba_01)

# ----
# Advanced Array Input and Output
# np.memmap (create a memory-mapped file)
# N-dimensional Array Objects
# HDF5 and Other Array Storage Options
number_slider_2 = Slider(100000, range=0..100000)
hops = Hops(
    CacheResultsInMemory=True,
    CacheSolveResults=True,
    RemoteSolveVersion=(0, 1, 0),
    ShowInput_Enabled=False,
    ShowInput_Path=False,
    SynchronousSolve=True)

# ----
# Performance Tips
# #Convert Python loops and conditional logic to
# array operations and boolean array operations
# #Use broadcasting whenever possible
# #Use arrays views (slicing) to avoid copying data
# #Utilize ufuncs and ufunc methods
number_slider_3 = Slider(100000, range=0..100000)
hops_2 = Hops(
    CacheResultsInMemory=True,
    CacheSolveResults=True,
    RemoteSolveVersion=(0, 1, 0),
    ShowInput_Enabled=False,
    ShowInput_Path=False,
    SynchronousSolve=True)
